# Grasshopper definition Csharp_updateComponent.gh (Grasshopper 1.0.8)

ccc = Python3Script()  # -> out, b
# ---------- ccc: Python ----------
"""Grasshopper Script"""
a = "Heeeeeee!!!!!!"
for i in range(1000):
    print(a)
# ---------- end ccc ----------
ccc_2 = Python3Script()  # -> out, b; same code as ccc
c_script = CSharpScript(Run=Button(), Template=ccc_2.out)  # -> out, Log; inputs Run: Boolean, Template: tree
# ---------- c_script: C# ----------
// Grasshopper Script Instance
#region Usings
using System;
using System.Linq;
using System.Collections;
using System.Collections.Generic;
using System.Drawing;

using Rhino;
using Rhino.Geometry;

using Grasshopper;
using Grasshopper.Kernel;
using Grasshopper.Kernel.Data;
using Grasshopper.Kernel.Types;
#endregion


public class Script_Instance : GH_ScriptInstance
{
  private void RunScript(bool Run, DataTree<object> Template, ref object Log)
  {
    if (!Run)
    {
      Log = "Run = false";
      return;
    }

    GH_Document doc = GrasshopperDocument;
    if (doc == null)
    {
      Log = "No GH_Document";
      return;
    }

    // ---------------------------
    // Phase 1: 回溯 Template（只讀）
    // ---------------------------
    if (Component.Params.Input.Count < 2)
    {
      Log = "Template input missing";
      return;
    }

    var templateInput = Component.Params.Input[1];
    if (templateInput.Sources.Count == 0)
    {
      Log = "Template input has no source wire";
      return;
    }

    IGH_Param src = templateInput.Sources[0];
    IGH_DocumentObject topObj =
      src.Attributes?.GetTopLevel?.DocObject ??
      src.Attributes?.Parent?.DocObject;

    IGH_Component templateComp = topObj as IGH_Component;
    if (templateComp == null)
    {
      Log = "Upstream object is not an IGH_Component";
      return;
    }

    string targetName = templateComp.NickName;
    Guid templateComponentGuid = templateComp.ComponentGuid;
    Guid templateInstanceGuid = templateComp.InstanceGuid;

    if (string.IsNullOrWhiteSpace(targetName))
    {
      Log = "Template NickName is empty";
      return;
    }

    List<Guid> oldIds = doc.Objects
      .OfType<IGH_Component>()
      .Where(c => c.InstanceGuid != templateInstanceGuid)
      .Where(c => c.NickName == targetName)
      .Select(c => c.InstanceGuid)
      .ToList();

    if (oldIds.Count == 0)
    {
      Log = "No components to replace";
      return;
    }

    // ---------------------------
    // Phase 2: 延後修改（安全）
    // ---------------------------
    doc.ScheduleSolution(1, d =>
    {
      ReplaceComponents(d, templateComponentGuid, templateInstanceGuid, oldIds);
    });

    Log = "Scheduled replace: " + oldIds.Count;
  }

  // ============================================================
  // Replace + Rewire + Keep Position
  // ============================================================
  private void ReplaceComponents(
    GH_Document doc,
    Guid templateComponentGuid,
    Guid templateInstanceGuid,
    List<Guid> oldInstanceIds
  )
  {
    var proxy = Instances.ComponentServer.ObjectProxies
      .FirstOrDefault(p => p.Guid == templateComponentGuid);
    if (proxy == null) return;

    var templateObj = doc.FindObject(templateInstanceGuid, false) as IGH_Component;
    if (templateObj == null) return;

    doc.UndoUtil.RecordEvent("Replace components");

    string Key(IGH_Param p)
    {
      return string.IsNullOrWhiteSpace(p.NickName) ? p.Name : p.NickName;
    }

    foreach (var id in oldInstanceIds)
    {
      IGH_Component oldObj = doc.FindObject(id, false) as IGH_Component;
      if (oldObj == null) continue;

      // -------- 0) 記錄舊位置（Pivot）--------
      // 你要的：替換後還在原位
      PointF oldPivot = PointF.Empty;
      try
      {
        if (oldObj.Attributes == null) oldObj.CreateAttributes();
        oldPivot = oldObj.Attributes.Pivot;
      }
      catch { }

      // -------- 1) 記錄舊連線 --------
      var oldInWires = oldObj.Params.Input
        .ToDictionary(p => Key(p), p => p.Sources.ToList());

      var oldOutWires = oldObj.Params.Output
        .ToDictionary(p => Key(p), p => p.Recipients.ToList());

      // -------- 2) 建立新元件 --------
      IGH_Component newC = proxy.CreateInstance() as IGH_Component;
      if (newC == null) continue;

      newC.CreateAttributes();

      // 先放到舊位置（等下 Clone 會蓋掉，所以還要再設一次）
      newC.Attributes.Pivot = oldPivot;

      // NickName 維持（用於你後續同名管理）
      newC.NickName = oldObj.NickName;

      doc.AddObject(newC, false);

      // -------- 3) 複製 Template 狀態（含 GhPython script / IO）--------
      CloneComponentState(templateObj, newC);

      // 🔥 重要：Clone 可能把 Pivot 蓋成 template 的位置
      // 所以一定要在 Clone 之後再把 Pivot 設回來
      if (newC.Attributes == null) newC.CreateAttributes();
      newC.Attributes.Pivot = oldPivot;
      newC.Attributes.ExpireLayout(); // 讓 GH 重新算 bounds

      // -------- 4) 建立新 IO 對照表 --------
      var newInMap = newC.Params.Input
        .GroupBy(Key)
        .ToDictionary(g => g.Key, g => g.First());

      var newOutMap = newC.Params.Output
        .GroupBy(Key)
        .ToDictionary(g => g.Key, g => g.First());

      // -------- 5) INPUT：來源 → 新 input --------
      foreach (var kv in oldInWires)
      {
        if (!newInMap.TryGetValue(kv.Key, out IGH_Param newIn)) continue;

        foreach (var s in kv.Value)
          newIn.AddSource(s);
      }

      // -------- 6) OUTPUT：新 output → 舊 recipients --------
      foreach (var kv in oldOutWires)
      {
        if (!newOutMap.TryGetValue(kv.Key, out IGH_Param newOut)) continue;

        foreach (var r in kv.Value)
          r.AddSource(newOut);
      }

      // -------- 7) 刪除舊元件 --------
      doc.RemoveObject(oldObj, false);
    }
  }

  // ============================================================
  // Clone component instance state via GH_Archive
  // (works across GH versions; includes GhPython script)
  // ============================================================
  private bool CloneComponentState(IGH_Component source, IGH_Component target)
  {
    if (source == null || target == null) return false;

    var archive = new GH_Archive();
    archive.AppendObject(source, "Component");
    return archive.ExtractObject(target, "Component");
  }
}
# ---------- end c_script ----------
panel = Panel(c_script.Log)
panel_2 = Panel(ccc_2.out)
