# Grasshopper definition openshell_test.ghx (Grasshopper 1.0.8)

number_slider = Slider(1, range=0..10)
object = ModelObject([<model object referenced from the Rhino model> x3])
object_2 = ModelObject([<model object referenced from the Rhino model> x15])
block_definition = ModelBlockDefinition(BlockDefinition=object)  # -> BlockDefinition, Name
block_definition_2 = ModelBlockDefinition(BlockDefinition=object_2)  # -> BlockDefinition, Name
split = TextSplit(Text=block_definition.Name, Separators="_")
split_2 = TextSplit(Text=block_definition_2.Name, Separators="_")
object_3 = ModelObject([<model object referenced from the Rhino model> x15])
object_4 = ModelObject([<model object referenced from the Rhino model> x2])
item = ListItem(List=reverse(split), Index=0, Wrap=True)
item_2 = ListItem(List=reverse(split_2), Index=0, Wrap=True)
object_5 = ModelObject(object_3)
num = Number(flatten(item))
num_2 = Number(simplify(item_2))
panel = Panel(num)
item_3 = ListItem(List=num, Index=number_slider, Wrap=True)
block_definition_3 = ModelBlockDefinition(BlockDefinition=object_5)  # -> BlockDefinition, Name
item_4 = ListItem(List=object, Index=number_slider, Wrap=True)
split_3 = TextSplit(Text=block_definition_3.Name, Separators="_")
object_6 = ModelObject(item_4)
object_7 = ModelObject(object_2)
block_definition_4 = ModelBlockDefinition(BlockDefinition=object_5)  # -> BlockDefinition, Name
item_5 = ListItem(List=reverse(split_3), Index=0, Wrap=True)
explode = ExplodeObject(Object=object_5, Recursive=False)
block_definition_5 = ModelBlockDefinition(BlockDefinition=object_7)  # -> BlockDefinition, Name
graft = GraftTree(Tree=block_definition_4.Name, IncludeEmptyLists=True, IncludeNullItems=True)  # -> simplify(Tree)
block_definition_6 = ModelBlockDefinition(BlockDefinition=object_6)  # -> BlockDefinition, Name
explode_2 = ExplodeObject(Object=object_6, Recursive=False)
explode_3 = ExplodeObject(Object=object_7, Recursive=False)
num_3 = Number(simplify(item_5))
graft_2 = GraftTree(Tree=block_definition_5.Name, IncludeEmptyLists=True, IncludeNullItems=True)  # -> simplify(Tree)
cluster = Cluster(data=explode_2, name="N02")  # -> geo_2, guid_3
cluster_2 = Cluster(data=explode_2, name="N15")  # -> geo_2, guid_3
cluster_3 = Cluster(data=explode_2, name="N08")  # -> geo_2, guid_3
cluster_4 = Cluster(data=explode_2, name="N19")  # -> geo_2, guid_3
cluster_5 = Cluster(data=explode_2, name="N69")  # -> geo_2, guid_3
cluster_6 = Cluster(data=explode_2, name="N20 ")  # -> geo_2, guid_3
cluster_7 = Cluster(data=explode_3, name="N02")  # -> geo_2, guid_3
cluster_8 = Cluster(data=explode_2, name="N01")  # -> geo_2, guid_3
cluster_9 = Cluster(data=explode_3, name="N15")  # -> geo_2, guid_3
cluster_10 = Cluster(data=explode_3, name="N08")  # -> geo_2, guid_3
cluster_11 = Cluster(data=explode_2, name="N07")  # -> geo_2, guid_3
cluster_12 = Cluster(data=explode_3, name="N19")  # -> geo_2, guid_3
cluster_13 = Cluster(data=explode_3, name="N69")  # -> geo_2, guid_3
cluster_14 = Cluster(data=explode_3, name="N20 ")  # -> geo_2, guid_3
cluster_15 = Cluster(data=explode_3, name="N01")  # -> geo_2, guid_3
cluster_16 = Cluster(data=explode_3, name="N07")  # -> geo_2, guid_3
cluster_17 = Cluster(data=explode, name="N01")  # -> geo_2, guid_3
cluster_18 = Cluster(data=explode, name="N02")  # -> geo_2, guid_3
cluster_19 = Cluster(data=explode, name="N15")  # -> geo_2, guid_3
cluster_20 = Cluster(data=explode, name="N14")  # -> geo_2, guid_3
cluster_21 = Cluster(data=explode, name="N10")  # -> geo_2, guid_3
cluster_22 = Cluster(data=explode, name="N67")  # -> geo_2, guid_3
cluster_23 = Cluster(data=explode, name="N11")  # -> geo_2, guid_3
cluster_24 = Cluster(data=explode, name="N12")  # -> geo_2, guid_3
cluster_25 = Cluster(data=explode, name="N13")  # -> geo_2, guid_3
cluster_26 = Cluster(data=explode, name="N08")  # -> geo_2, guid_3
cluster_27 = Cluster(data=explode, name="N19")  # -> geo_2, guid_3
cluster_28 = Cluster(data=explode, name="N69")  # -> geo_2, guid_3
cluster_29 = Cluster(data=explode, name="N68")  # -> geo_2, guid_3
cluster_30 = Cluster(data=explode, name="N20 ")  # -> geo_2, guid_3
cluster_31 = Cluster(data=explode, name="N66")  # -> geo_2, guid_3
cluster_32 = Cluster(data=explode, name="AL01")  # -> geo_2, guid_3
cluster_33 = Cluster(data=explode, name="N28")  # -> geo_2, guid_3
cluster_34 = Cluster(data=explode, name="AL02")  # -> geo_2, guid_3
cluster_35 = Cluster(data=explode, name="N61 ")  # -> geo_2, guid_3
cluster_36 = Cluster(data=explode, name="N32 ")  # -> geo_2, guid_3
cluster_37 = Cluster(data=explode, name="N32B")  # -> geo_2, guid_3
cluster_38 = Cluster(data=explode, name="N07")  # -> geo_2, guid_3
entwine = Entwine(Branch00=cluster_8.guid_3, Branch01=cluster.guid_3, Branch02=cluster_2.guid_3, FlattenInputs=True)  # -> flatten(Result)
entwine_2 = Entwine(Branch00=cluster_8.geo_2, Branch01=cluster.geo_2, Branch02=cluster_2.geo_2, FlattenInputs=True)  # -> flatten(Result)
entwine_3 = Entwine(
    Branch00=cluster_11.guid_3,
    Branch01=cluster_3.guid_3,
    Branch02=cluster_4.guid_3,
    Branch03=cluster_5.guid_3,
    Branch04=cluster_6.guid_3,
    FlattenInputs=True)  # -> flatten(Result)
entwine_4 = Entwine(
    Branch00=cluster_11.geo_2,
    Branch01=cluster_3.geo_2,
    Branch02=cluster_4.geo_2,
    Branch03=cluster_5.geo_2,
    Branch04=cluster_6.geo_2,
    FlattenInputs=True)  # -> flatten(Result)
merge = Merge(Data1=cluster_15.geo_2, Data2=cluster_7.geo_2, Data3=cluster_9.geo_2)  # -> simplify(Result)
merge_2 = Merge(Data1=cluster_15.guid_3, Data2=cluster_7.guid_3, Data3=cluster_9.guid_3)  # -> simplify(Result)
merge_3 = Merge(Data1=cluster_16.geo_2, Data2=cluster_10.geo_2, Data3=cluster_12.geo_2, Data4=cluster_13.geo_2, Data5=cluster_14.geo_2)  # -> simplify(Result)
merge_4 = Merge(
    Data1=cluster_16.guid_3,
    Data2=cluster_10.guid_3,
    Data3=cluster_12.guid_3,
    Data4=cluster_13.guid_3,
    Data5=cluster_14.guid_3)  # -> simplify(Result)
merge_5 = Merge(Data1=cluster_32.geo_2, Data2=cluster_34.geo_2, Data3=cluster_35.geo_2, Data4=cluster_36.geo_2, Data5=cluster_37.geo_2)  # -> simplify(Result)
merge_6 = Merge(
    Data1=cluster_17.geo_2,
    Data2=cluster_18.geo_2,
    Data3=cluster_19.geo_2,
    Data4=cluster_21.geo_2,
    Data5=cluster_23.geo_2,
    Data6=cluster_24.geo_2,
    Data7=cluster_25.geo_2,
    Data8=cluster_20.geo_2)  # -> simplify(Result)
merge_7 = Merge(
    Data1=cluster_32.guid_3,
    Data2=cluster_34.guid_3,
    Data3=cluster_35.guid_3,
    Data4=cluster_36.guid_3,
    Data5=cluster_37.guid_3)  # -> simplify(Result)
merge_8 = Merge(
    Data1=cluster_17.guid_3,
    Data2=cluster_18.guid_3,
    Data3=cluster_19.guid_3,
    Data4=cluster_21.guid_3,
    Data5=cluster_23.guid_3,
    Data6=cluster_24.guid_3,
    Data7=cluster_25.guid_3,
    Data8=cluster_20.guid_3)  # -> simplify(Result)
merge_9 = Merge(
    Data1=cluster_38.guid_3,
    Data2=cluster_26.guid_3,
    Data3=cluster_27.guid_3,
    Data4=cluster_28.guid_3,
    Data5=cluster_30.guid_3,
    Data6=cluster_22.guid_3,
    Data7=cluster_29.guid_3,
    Data8=cluster_31.guid_3,
    Data9=cluster_33.guid_3)  # -> simplify(Result)
merge_10 = Merge(
    Data1=cluster_38.geo_2,
    Data2=cluster_26.geo_2,
    Data3=cluster_27.geo_2,
    Data4=cluster_28.geo_2,
    Data5=cluster_30.geo_2,
    Data6=cluster_22.geo_2,
    Data7=cluster_29.geo_2,
    Data8=cluster_31.geo_2,
    Data9=cluster_33.geo_2)  # -> simplify(Result)
py3 = Python3Script()  # -> main_path
# ---------- py3: Python ----------
import os
gh_doc = ghenv.Component.OnPingDocument()

main_path = os.path.dirname(gh_doc.FilePath)
# ---------- end py3 ----------
list = ValueList({"Vertical", "Horizontal", "Loose"}, selected="Vertical")
path = FilePath("D:\Kevin\GH\ifc_test\")
panel_2 = Panel(py3)
list_2 = ValueList({"Vertical", "Horizontal", "Loose"}, selected="Horizontal")
list_3 = ValueList({"Vertical", "Horizontal", "Loose"}, selected="Loose")
concat = Concatenate(FragmentA=py3, FragmentC="\ifc_test_file")
py3_2 = Python3Script(Geo=merge_6, Name=merge_8, Category=list, UnitId=graft)  # -> out, Log, MatData; inputs Geo: tree of GeometryBase, Name: tree of String, Category: String, UnitId: tree of String
# ---------- py3_2: Python ----------
import sys, os, importlib

# Rhino/GH 裡通常能拿到目前 .gh 的路徑
import Grasshopper as gh
ghdoc_path = gh.Instances.ActiveCanvas.Document.FilePath  # 可能是空字串（未存檔）
if not ghdoc_path:
    raise Exception("GH document not saved yet. Save .gh first to use relative module path.")

proj_dir = os.path.dirname(ghdoc_path)
module_dir = os.path.join(proj_dir, "py_modules")

if module_dir not in sys.path:
    sys.path.append(module_dir)

import ifc_builder
importlib.reload(ifc_builder)

MatData, Log = ifc_builder.build_matdata(
    Geo,
    Name,
    Category,
    UnitId
)
# ---------- end py3_2 ----------
py3_3 = Python3Script(Geo=merge_10, Name=merge_9, Category=list_2, UnitId=graft)  # -> out, Log, MatData; inputs Geo: tree of GeometryBase, Name: tree of String, Category: String, UnitId: tree of String; same code as py3_2
py3_4 = Python3Script(Geo=merge_5, Name=merge_7, Category=list_3, UnitId=graft)  # -> out, Log, MatData; inputs Geo: tree of GeometryBase, Name: tree of String, Category: String, UnitId: tree of String; same code as py3_2
py3_5 = Python3Script(
    V_Geo=entwine_2,
    V_Name=entwine,
    H_Geo=entwine_4,
    H_Name=entwine_3,
    StoreyName="N02F",
    StoreyElev=Slider(0, range=0..100),
    UnitId=block_definition_6.Name,
    BayNo=item_3,
    OutPath=path,
    Run=Toggle(False))  # -> out, OK, Log; inputs V_Geo: list of GeometryBase, V_Name: list of String, H_Geo: list of GeometryBase, H_Name: list of String, StoreyName: String, StoreyElev: Double, UnitId: String, BayNo: String, OutPath: String, Run: Boolean
# ---------- py3_5: Python ----------
"""
Grasshopper Python 3 (Rhino 8) -> IFC4 exporter for unit members (vertical/horizontal)

This version fixes:
- "Only single object visible" / "Zoom in disappears" / "Storey shows only a frame"
Root cause was double-transform (centering + object placement + unit_scale).
Solution:
- DO NOT edit element ObjectPlacement at all.
- Export mesh vertices in Rhino world coords (mm).
- Use unit_scale=LengthUnitScale (mm->m = 1000) exactly once.
- Use force_faceted_brep=True for better viewer compatibility (BIMvision / many web viewers).

Inputs (GH):
V_Geo: list[Rhino.Geometry.GeometryBase]   (Brep/Mesh/Extrusion/Surface ok)
V_Name: list[str]
H_Geo: list[Rhino.Geometry.GeometryBase]
H_Name: list[str]
StoreyName: str
StoreyElev: float          # Rhino document units (e.g. mm)
UnitId: str
BayNo: str or int
OutPath: str               # folder OR file
Run: bool

Outputs:
OK: bool
Log: str
"""

import os
import traceback

OK = False
Log = ""

if not Run:
    Log = "Run=False"
else:
    try:
        import Rhino
        import Rhino.Geometry as rg

        import ifcopenshell
        from ifcopenshell.api import run as ifc_run

        # -------------------------
        # Input normalization
        # -------------------------
        def to_list(x):
            if x is None:
                return []
            return x if isinstance(x, (list, tuple)) else [x]

        V_Geo_  = to_list(V_Geo)
        V_Name_ = to_list(V_Name)
        H_Geo_  = to_list(H_Geo)
        H_Name_ = to_list(H_Name)

        if len(V_Geo_) != len(V_Name_):
            raise ValueError(f"V_Geo({len(V_Geo_)}) must match V_Name({len(V_Name_)}) by index.")
        if len(H_Geo_) != len(H_Name_):
            raise ValueError(f"H_Geo({len(H_Geo_)}) must match H_Name({len(H_Name_)}) by index.")

        Log += f"ifcopenshell version: {getattr(ifcopenshell, 'version', 'unknown')}\n"
        Log += f"Vertical count: {len(V_Geo_)}\n"
        Log += f"Horizontal count: {len(H_Geo_)}\n"

        # -------------------------
        # Normalize OutPath
        # -------------------------
        def normalize_outpath(out_path: str) -> str:
            p = str(out_path).strip().strip('"')
            ext = os.path.splitext(p)[1]

            if os.path.isdir(p) or ext == "":
                out_dir = p
                if not os.path.exists(out_dir):
                    os.makedirs(out_dir, exist_ok=True)
                safe_unit = str(UnitId).replace("\\", "_").replace("/", "_").replace(":", "_")
                safe_storey = str(StoreyName).replace("\\", "_").replace("/", "_").replace(":", "_")
                safe_bay = str(BayNo).replace("\\", "_").replace("/", "_").replace(":", "_")
                filename = f"{safe_unit}_{safe_storey}_{safe_bay}.ifc"
                return os.path.join(out_dir, filename)

            out_dir = os.path.dirname(p)
            if out_dir and not os.path.exists(out_dir):
                os.makedirs(out_dir, exist_ok=True)

            root, ext = os.path.splitext(p)
            return root + ".ifc" if ext.lower() != ".ifc" else p

        OutPath = normalize_outpath(OutPath)
        Log += f"Resolved OutPath: {OutPath}\n"

        # -------------------------
        # Geometry helpers
        # -------------------------
        def brep_to_mesh(brep: rg.Brep) -> rg.Mesh:
            mp = rg.MeshingParameters.FastRenderMesh
            meshes = rg.Mesh.CreateFromBrep(brep, mp)
            if not meshes:
                return None
            m = rg.Mesh()
            for part in meshes:
                if part:
                    m.Append(part)
            m.Normals.ComputeNormals()
            m.Compact()
            return m

        def geom_to_mesh(geo) -> rg.Mesh:
            if geo is None:
                return None
            if isinstance(geo, rg.Mesh):
                m = geo.DuplicateMesh()
                m.Normals.ComputeNormals()
                m.Compact()
                return m
            if isinstance(geo, rg.Brep):
                return brep_to_mesh(geo)
            if isinstance(geo, rg.Extrusion):
                return brep_to_mesh(geo.ToBrep())
            if isinstance(geo, rg.Surface):
                return brep_to_mesh(geo.ToBrep())
            brep = rg.Brep.TryConvertBrep(geo)
            if brep:
                return brep_to_mesh(brep)
            return None

        def mesh_to_vertices_faces(mesh: rg.Mesh):
            if mesh is None or mesh.Vertices.Count == 0:
                return [], []
            m = mesh.DuplicateMesh()
            m.Faces.ConvertQuadsToTriangles()
            m.Normals.ComputeNormals()
            m.Compact()
            verts = [(float(v.X), float(v.Y), float(v.Z)) for v in m.Vertices]  # mm
            faces = [(int(f.A), int(f.B), int(f.C)) for f in m.Faces]
            return verts, faces

        # -------------------------
        # IFC setup (explicit mm units)
        # -------------------------
        model = ifcopenshell.file(schema="IFC4")

        project = ifc_run("root.create_entity", model, ifc_class="IfcProject", name=f"Unit_{UnitId}")

        # Explicitly define LENGTHUNIT = millimetre
        # This avoids viewers interpreting your coords as metres.
        ifc_run("unit.assign_unit", model, length={"is_metric": True, "raw": "MILLIMETRE"})

        model_context = ifc_run("context.add_context", model, context_type="Model")
        body_context = ifc_run(
            "context.add_context",
            model,
            context_type="Model",
            context_identifier="Body",
            target_view="MODEL_VIEW",
            parent=model_context
        )

        site = ifc_run("root.create_entity", model, ifc_class="IfcSite", name="Default Site")
        building = ifc_run("root.create_entity", model, ifc_class="IfcBuilding", name="Default Building")
        storey = ifc_run("root.create_entity", model, ifc_class="IfcBuildingStorey", name=str(StoreyName))
        storey.Elevation = float(StoreyElev)  # mm because project unit = mm

        ifc_run("aggregate.assign_object", model, products=[site], relating_object=project)
        ifc_run("aggregate.assign_object", model, products=[building], relating_object=site)
        ifc_run("aggregate.assign_object", model, products=[storey], relating_object=building)

        # -------------------------
        # Create elements
        # -------------------------
        def add_member(geo, name: str, member_axis: str):
            if member_axis == "Vertical":
                ifc_class = "IfcMember"
            else:
                ifc_class = "IfcBeam"

            mesh = geom_to_mesh(geo)
            if mesh is None:
                raise ValueError(f"Geometry '{name}' cannot be converted to mesh.")

            verts, faces = mesh_to_vertices_faces(mesh)
            if not verts or not faces:
                raise ValueError(f"Geometry '{name}' mesh is empty.")

            elem = ifc_run("root.create_entity", model, ifc_class=ifc_class, name=str(name))
            ifc_run("spatial.assign_container", model, products=[elem], relating_structure=storey)

            # unit_scale = 1 because IFC is in mm already
            shape = ifc_run(
                "geometry.add_mesh_representation",
                model,
                context=body_context,
                vertices=[verts],
                faces=[faces],
                unit_scale=1.0,
                force_faceted_brep=False
            )
            ifc_run("geometry.assign_representation", model, product=elem, representation=shape)

            pset = ifc_run("pset.add_pset", model, product=elem, name="UnitMeta")
            ifc_run("pset.edit_pset", model, pset=pset, properties={
                "UnitId": str(UnitId),
                "BayNo": str(BayNo),
                "StoreyName": str(StoreyName),
                "StoreyElevation_mm": float(StoreyElev),
                "MemberAxis": str(member_axis),
                "MemberName": str(name)
            })

            return elem

        created = []
        for g, n in zip(V_Geo_, V_Name_):
            created.append(add_member(g, n, "Vertical"))
        for g, n in zip(H_Geo_, H_Name_):
            created.append(add_member(g, n, "Horizontal"))

        model.write(OutPath)

        OK = True
        Log += f"\nExported {len(created)} elements.\n{OutPath}\n"

    except Exception as e:
        OK = False
        Log += "\nFAILED:\n" + str(e) + "\n\n" + traceback.format_exc()
# ---------- end py3_5 ----------
py3_6 = Python3Script(
    V_Geo=merge,
    V_Name=merge_2,
    H_Geo=merge_3,
    H_Name=merge_4,
    StoreyName="N02F",
    StoreyElev=Slider(0, range=0..100),
    UnitIdTree=graft_2,
    BayNoTree=num_2,
    OutPath=concat,
    Run=Toggle(False))  # -> out, OK, Log; inputs V_Geo: tree of GeometryBase, V_Name: tree of String, H_Geo: tree of GeometryBase, H_Name: tree of String, StoreyName: String, StoreyElev: Double, UnitIdTree: tree of String, BayNoTree: tree of String, OutPath: String, Run: Boolean
# ---------- py3_6: Python ----------
import os
import traceback

OK = False
Log = ""

if not Run:
    Log = "Run=False"
else:
    try:
        import Rhino
        import Rhino.Geometry as rg

        import ifcopenshell
        from ifcopenshell.api import run as ifc_run

        # -------------------------
        # Debug helpers
        # -------------------------
        def tname(x):
            try:
                return x.GetType().FullName
            except:
                return str(type(x))

        # Duck-typing: treat as "tree-like" if it has GH DataTree API
        def is_tree_like(x):
            return (
                x is not None and
                hasattr(x, "BranchCount") and
                hasattr(x, "Path") and
                hasattr(x, "Branch")
            )

        def normalize_outpath(out_path: str, storey_name: str) -> str:
            p = str(out_path).strip().strip('"')
            ext = os.path.splitext(p)[1]
            if os.path.isdir(p) or ext == "":
                out_dir = p
                if not os.path.exists(out_dir):
                    os.makedirs(out_dir, exist_ok=True)
                return os.path.join(out_dir, f"{storey_name}_multi_units.ifc")
            out_dir = os.path.dirname(p)
            if out_dir and not os.path.exists(out_dir):
                os.makedirs(out_dir, exist_ok=True)
            root, ext = os.path.splitext(p)
            return root + ".ifc" if ext.lower() != ".ifc" else p

        def to_list(x):
            if x is None:
                return []
            return x if isinstance(x, (list, tuple)) else [x]

        # -------------------------
        # Convert "anything" -> branch dict
        # - Works for generic DataTree`1[...] because we don't rely on isinstance()
        # -------------------------
        def to_branch_dict_any(x):
            branches = {}
            paths = []

            # Case 1: tree-like (GH DataTree)
            if is_tree_like(x):
                bc = int(x.BranchCount)
                for i in range(bc):
                    path = x.Path(i)     # GH_Path
                    key = str(path)      # "{0}" "{1}" ...
                    branches[key] = list(x.Branch(path))
                    paths.append(key)
                paths.sort()
                return branches, paths

            # Case 2: list/tuple may contain a tree-like object
            if isinstance(x, (list, tuple)):
                # If it's [Tree] unwrap
                if len(x) == 1 and is_tree_like(x[0]):
                    return to_branch_dict_any(x[0])

                # If it contains multiple tree-like objects, merge by path
                if any(is_tree_like(it) for it in x):
                    for it in x:
                        if is_tree_like(it):
                            b, ps = to_branch_dict_any(it)
                            for k in ps:
                                branches.setdefault(k, []).extend(b.get(k, []))
                                if k not in paths:
                                    paths.append(k)
                        else:
                            branches.setdefault("{0}", []).append(it)
                            if "{0}" not in paths:
                                paths.append("{0}")
                    paths.sort()
                    return branches, paths

                # Plain list => single branch
                branches["{0}"] = list(x)
                return branches, ["{0}"]

            # Case 3: single item => single branch
            branches["{0}"] = [x]
            return branches, ["{0}"]

        def first_or_default(lst, default=""):
            return lst[0] if lst else default

        # -------------------------
        # Log input types
        # -------------------------
        Log += "IN TYPES:\n"
        Log += f"  V_Geo: {tname(V_Geo)}\n"
        Log += f"  V_Name: {tname(V_Name)}\n"
        Log += f"  H_Geo: {tname(H_Geo)}\n"
        Log += f"  H_Name: {tname(H_Name)}\n"
        Log += f"  UnitIdTree: {tname(UnitIdTree)}\n"
        Log += f"  BayNoTree: {tname(BayNoTree)}\n"

        # -------------------------
        # Read trees (duck-typed)
        # -------------------------
        VGeo_dict, V_paths   = to_branch_dict_any(V_Geo)
        VName_dict, Vn_paths = to_branch_dict_any(V_Name)
        HGeo_dict, H_paths   = to_branch_dict_any(H_Geo)
        HName_dict, Hn_paths = to_branch_dict_any(H_Name)
        Uid_dict, Uid_paths  = to_branch_dict_any(UnitIdTree)
        Bay_dict, Bay_paths  = to_branch_dict_any(BayNoTree)

        all_paths = sorted(set(V_paths) | set(Vn_paths) | set(H_paths) | set(Hn_paths) | set(Uid_paths) | set(Bay_paths))

        OutPath = normalize_outpath(OutPath, str(StoreyName))
        Log += f"ifcopenshell version: {getattr(ifcopenshell, 'version', 'unknown')}\n"
        Log += f"Resolved OutPath: {OutPath}\n"
        Log += f"Branches (units): {len(all_paths)}\n"
        Log += f"Branch keys: {all_paths}\n"
        Log += f"V_Geo branch sizes: {[len(VGeo_dict.get(p, [])) for p in all_paths]}\n"
        Log += f"H_Geo branch sizes: {[len(HGeo_dict.get(p, [])) for p in all_paths]}\n"

        # Validate alignment branch-wise
        for p in all_paths:
            vg = VGeo_dict.get(p, [])
            vn = VName_dict.get(p, [])
            hg = HGeo_dict.get(p, [])
            hn = HName_dict.get(p, [])
            if len(vg) != len(vn):
                raise ValueError(f"Branch {p}: V_Geo({len(vg)}) != V_Name({len(vn)})")
            if len(hg) != len(hn):
                raise ValueError(f"Branch {p}: H_Geo({len(hg)}) != H_Name({len(hn)})")

        # -------------------------
        # Geometry helpers
        # -------------------------
        def brep_to_mesh(brep: rg.Brep) -> rg.Mesh:
            mp = rg.MeshingParameters.FastRenderMesh
            meshes = rg.Mesh.CreateFromBrep(brep, mp)
            if not meshes:
                return None
            m = rg.Mesh()
            for part in meshes:
                if part:
                    m.Append(part)
            m.Normals.ComputeNormals()
            m.Compact()
            return m

        def geom_to_mesh(geo) -> rg.Mesh:
            # If a tree-like object gets here, inputs are still wrapped
            if is_tree_like(geo):
                raise TypeError(f"Geometry item is a DataTree-like object: {tname(geo)}")

            if geo is None:
                return None

            if isinstance(geo, rg.Mesh):
                m = geo.DuplicateMesh()
                m.Normals.ComputeNormals()
                m.Compact()
                return m

            if isinstance(geo, rg.Brep):
                return brep_to_mesh(geo)

            if isinstance(geo, rg.Extrusion):
                return brep_to_mesh(geo.ToBrep())

            if isinstance(geo, rg.Surface):
                return brep_to_mesh(geo.ToBrep())

            brep = rg.Brep.TryConvertBrep(geo)
            if brep:
                return brep_to_mesh(brep)

            return None

        def mesh_to_vertices_faces(mesh: rg.Mesh):
            if mesh is None or mesh.Vertices.Count == 0:
                return [], []
            m = mesh.DuplicateMesh()
            m.Faces.ConvertQuadsToTriangles()
            m.Normals.ComputeNormals()
            m.Compact()
            verts = [(float(v.X), float(v.Y), float(v.Z)) for v in m.Vertices]  # mm
            faces = [(int(f.A), int(f.B), int(f.C)) for f in m.Faces]
            return verts, faces

        # -------------------------
        # IFC setup (explicit mm)
        # -------------------------
        model = ifcopenshell.file(schema="IFC4")
        project = ifc_run("root.create_entity", model, ifc_class="IfcProject", name=f"{StoreyName}_Units")
        ifc_run("unit.assign_unit", model, length={"is_metric": True, "raw": "MILLIMETRE"})

        model_context = ifc_run("context.add_context", model, context_type="Model")
        body_context = ifc_run(
            "context.add_context",
            model,
            context_type="Model",
            context_identifier="Body",
            target_view="MODEL_VIEW",
            parent=model_context
        )

        site = ifc_run("root.create_entity", model, ifc_class="IfcSite", name="Default Site")
        building = ifc_run("root.create_entity", model, ifc_class="IfcBuilding", name="Default Building")
        storey = ifc_run("root.create_entity", model, ifc_class="IfcBuildingStorey", name=str(StoreyName))
        storey.Elevation = float(StoreyElev)  # mm

        ifc_run("aggregate.assign_object", model, products=[site], relating_object=project)
        ifc_run("aggregate.assign_object", model, products=[building], relating_object=site)
        ifc_run("aggregate.assign_object", model, products=[storey], relating_object=building)

        # -------------------------
        # Create elements + unit groups
        # -------------------------
        created_by_name = {}
        unit_groups = []

        def create_member(name: str, axis: str, geo):
            if axis == "Vertical":
                ifc_class = "IfcMember"
            else:
                ifc_class = "IfcBeam"

            mesh = geom_to_mesh(geo)
            if mesh is None:
                raise ValueError(f"'{name}': geometry cannot be meshed. Got type={tname(geo)}")

            verts, faces = mesh_to_vertices_faces(mesh)
            if not verts or not faces:
                raise ValueError(f"'{name}': empty mesh.")

            elem = ifc_run("root.create_entity", model, ifc_class=ifc_class, name=str(name))
            ifc_run("spatial.assign_container", model, products=[elem], relating_structure=storey)

            shape = ifc_run(
                "geometry.add_mesh_representation",
                model,
                context=body_context,
                vertices=[verts],
                faces=[faces],
                unit_scale=1.0,             # project is mm
                force_faceted_brep=True
            )
            ifc_run("geometry.assign_representation", model, product=elem, representation=shape)
            return elem

        def get_or_create(name: str, axis: str, geo):
            key = str(name)
            if key in created_by_name:
                return created_by_name[key]
            elem = create_member(key, axis, geo)
            created_by_name[key] = elem
            return elem

        for idx, p in enumerate(all_paths):
            unit_id = str(first_or_default(Uid_dict.get(p, []), default=f"Unit_{idx:03d}"))
            bay_no  = str(first_or_default(Bay_dict.get(p, []), default=""))

            members = []

            vg = VGeo_dict.get(p, [])
            vn = VName_dict.get(p, [])
            for g, n in zip(vg, vn):
                members.append(get_or_create(n, "Vertical", g))

            hg = HGeo_dict.get(p, [])
            hn = HName_dict.get(p, [])
            for g, n in zip(hg, hn):
                members.append(get_or_create(n, "Horizontal", g))

            # 不留下空 unit：空就直接跳過，連 group 都不建
            if not members:
                continue

            group = ifc_run("root.create_entity", model, ifc_class="IfcGroup", name=f"Unit_{unit_id}")
            unit_groups.append(group)

            ifc_run("group.assign_group", model, products=members, group=group)

            unit_pset = ifc_run("pset.add_pset", model, product=group, name="UnitInfo")
            ifc_run("pset.edit_pset", model, pset=unit_pset, properties={
                "UnitId": unit_id,
                "BayNo": bay_no,
            })


            ifc_run("pset.edit_pset", model, pset=unit_pset, properties={
                "UnitId": unit_id,
                "BayNo": bay_no,
            })



        model.write(OutPath)

        OK = True
        Log += f"\nCreated elements: {len(created_by_name)}\n"
        Log += f"Created unit groups: {len(unit_groups)}\n"
        Log += f"Wrote: {OutPath}\n"

    except Exception as e:
        OK = False
        Log += "\nFAILED:\n" + str(e) + "\n\n" + traceback.format_exc()
# ---------- end py3_6 ----------
py3_7 = Python3Script(x=py3_2.MatData)  # -> out, a
# ---------- py3_7: Python ----------
a = x
# ---------- end py3_7 ----------
number_slider_2 = Slider(9, range=0..100)
merge_11 = Merge(Data1=py3_2.MatData, Data2=py3_3.MatData, Data3=py3_4.MatData)
panel_3 = Panel(py3_5.Log)
path_2 = FilePath("D:\Kevin\GH\ifc_test\")
panel_4 = Panel(py3_7.a)
py3_8 = Python3Script()  # -> main_path; same code as py3
concat_2 = Concatenate(FragmentA=py3_8, FragmentC="\ifc_test_file")

# ----
# original Component
py3_9 = Python3Script(
    MatData=merge_11,
    UnitIdTree=graft,
    BayNoTree=num_3,
    StoreyName="N02F",
    StoreyElev=number_slider_2,
    OutPath=concat_2,
    Run=Toggle(False))  # -> out, OK, Log; inputs MatData: list, UnitIdTree: tree of String, BayNoTree: tree of String, StoreyName: String, StoreyElev: Double, OutPath: String, Run: Boolean; disabled
# ---------- py3_9: Python ----------
import os
import traceback

OK = False
Log = ""

if not Run:
    Log = "Run=False"
else:
    try:
        import Rhino.Geometry as rg

        import ifcopenshell
        from ifcopenshell.api import run as ifc_run

        # -------------------------
        # Debug helpers
        # -------------------------
        def tname(x):
            try:
                return x.GetType().FullName
            except:
                return str(type(x))

        # -------------------------
        # OutPath normalization (keep your original style)
        # -------------------------
        def normalize_outpath(out_path: str, storey_name: str) -> str:
            p = str(out_path).strip().strip('"')
            ext = os.path.splitext(p)[1]
            if os.path.isdir(p) or ext == "":
                out_dir = p
                if not os.path.exists(out_dir):
                    os.makedirs(out_dir, exist_ok=True)
                return os.path.join(out_dir, f"{storey_name}_multi_units.ifc")
            out_dir = os.path.dirname(p)
            if out_dir and not os.path.exists(out_dir):
                os.makedirs(out_dir, exist_ok=True)
            root, ext = os.path.splitext(p)
            return root + ".ifc" if ext.lower() != ".ifc" else p

        OutPath = normalize_outpath(OutPath, str(StoreyName))

        # -------------------------
        # GH goo / payload helpers
        # -------------------------
        try:
            from Grasshopper.Kernel.Types import GH_ObjectWrapper
        except:
            GH_ObjectWrapper = None

        def unwrap_payload(x):
            # Accept GH_ObjectWrapper(dict) or plain dict
            if GH_ObjectWrapper is not None and isinstance(x, GH_ObjectWrapper):
                x = x.Value
            if not isinstance(x, dict):
                raise TypeError(f"MatData item is not dict/goo(dict). Got {tname(x)}")
            return x

        def iter_payloads(obj):
            """
            Flatten ANY nested list/tuple structure into payload dicts.
            This means you can: Merge / Graft / Flatten freely.
            """
            if obj is None:
                return
            if isinstance(obj, (list, tuple)):
                for it in obj:
                    for p in iter_payloads(it):
                        yield p
                return
            yield unwrap_payload(obj)

        # -------------------------
        # Geometry helpers (keep your original approach)
        # -------------------------
        def brep_to_mesh(brep: rg.Brep) -> rg.Mesh:
            mp = rg.MeshingParameters.FastRenderMesh
            meshes = rg.Mesh.CreateFromBrep(brep, mp)
            if not meshes:
                return None
            m = rg.Mesh()
            for part in meshes:
                if part:
                    m.Append(part)
            m.Normals.ComputeNormals()
            m.Compact()
            return m

        def geom_to_mesh(geo) -> rg.Mesh:
            if geo is None:
                return None

            if isinstance(geo, rg.Mesh):
                m = geo.DuplicateMesh()
                m.Normals.ComputeNormals()
                m.Compact()
                return m

            if isinstance(geo, rg.Brep):
                return brep_to_mesh(geo)

            if isinstance(geo, rg.Extrusion):
                return brep_to_mesh(geo.ToBrep())

            if isinstance(geo, rg.Surface):
                return brep_to_mesh(geo.ToBrep())

            brep = rg.Brep.TryConvertBrep(geo)
            if brep:
                return brep_to_mesh(brep)

            return None

        def mesh_to_vertices_faces(mesh: rg.Mesh):
            if mesh is None or mesh.Vertices.Count == 0:
                return [], []
            m = mesh.DuplicateMesh()
            m.Faces.ConvertQuadsToTriangles()
            m.Normals.ComputeNormals()
            m.Compact()
            verts = [(float(v.X), float(v.Y), float(v.Z)) for v in m.Vertices]  # mm
            faces = [(int(f.A), int(f.B), int(f.C)) for f in m.Faces]
            return verts, faces

        # -------------------------
        # IFC setup (explicit mm) - keep your original structure
        # -------------------------
        model = ifcopenshell.file(schema="IFC4")
        project = ifc_run("root.create_entity", model, ifc_class="IfcProject", name=f"{StoreyName}_Units")
        ifc_run("unit.assign_unit", model, length={"is_metric": True, "raw": "MILLIMETRE"})

        model_context = ifc_run("context.add_context", model, context_type="Model")
        body_context = ifc_run(
            "context.add_context",
            model,
            context_type="Model",
            context_identifier="Body",
            target_view="MODEL_VIEW",
            parent=model_context
        )

        site = ifc_run("root.create_entity", model, ifc_class="IfcSite", name="Default Site")
        building = ifc_run("root.create_entity", model, ifc_class="IfcBuilding", name="Default Building")
        storey = ifc_run("root.create_entity", model, ifc_class="IfcBuildingStorey", name=str(StoreyName))
        storey.Elevation = float(StoreyElev)  # mm

        ifc_run("aggregate.assign_object", model, products=[site], relating_object=project)
        ifc_run("aggregate.assign_object", model, products=[building], relating_object=site)
        ifc_run("aggregate.assign_object", model, products=[storey], relating_object=building)

        # -------------------------
        # Pset helper (optional fields)
        # -------------------------
        def add_pset(product, pset_name: str, props: dict):
            if not props:
                return
            clean = {k: v for k, v in props.items() if v is not None and v != ""}
            if not clean:
                return
            pset = ifc_run("pset.add_pset", model, product=product, name=pset_name)
            ifc_run("pset.edit_pset", model, pset=pset, properties=clean)

        # -------------------------
        # Element creation (keeps your mesh->IFC approach)
        # IMPORTANT: vertices/faces must be list-of-items -> [verts], [faces]
        # -------------------------
        created_by_name = {}

        def category_to_ifc_class(cat: str) -> str:
            c = (cat or "").strip().lower()
            if c == "vertical":
                return "IfcMember"
            if c == "horizontal":
                return "IfcBeam"
            return "IfcBuildingElementProxy"

        def create_element(payload: dict):
            name = str(payload.get("name", "Unnamed"))
            cat  = str(payload.get("category", "Unspecified"))
            ifc_class = category_to_ifc_class(cat)

            geo = payload.get("geo", None)
            mesh = geom_to_mesh(geo)
            if mesh is None:
                raise ValueError(f"'{name}': geometry cannot be meshed. Got type={tname(geo)}")

            verts, faces = mesh_to_vertices_faces(mesh)
            if not verts or not faces:
                raise ValueError(f"'{name}': empty mesh.")

            elem = ifc_run("root.create_entity", model, ifc_class=ifc_class, name=name)
            ifc_run("spatial.assign_container", model, products=[elem], relating_structure=storey)

            shape = ifc_run(
                "geometry.add_mesh_representation",
                model,
                context=body_context,
                vertices=[verts],   # <-- FIX: list-of-items
                faces=[faces],      # <-- FIX: list-of-items
                unit_scale=1.0,     # project is mm
                force_faceted_brep=True
            )
            ifc_run("geometry.assign_representation", model, product=elem, representation=shape)

            # Write your required parameters if present
            # unit_id is required for grouping
            uid = payload.get("unit_id")
            add_pset(elem, "Pset_CWIdentity", {
                "UnitId": uid,
                "PartNo": payload.get("part_no"),
                "Category": cat
            })

            dims = payload.get("dims") or {}
            add_pset(elem, "Pset_CWDimensions", {
                "Length_mm": dims.get("L"),
                "Width_mm": dims.get("W"),
                "Radius_mm": dims.get("R")
            })

            mat = payload.get("material") or {}
            add_pset(elem, "Pset_CWMaterial", {
                "MaterialName": mat.get("name")
            })

            finish = payload.get("finish") or {}
            add_pset(elem, "Pset_CWSurfaceFinish", {
                "FinishType": finish.get("type"),
                "FinishThickness_um": finish.get("thickness_um")
            })

            add_pset(elem, "Pset_CWAppearance", {
                "ColorCode": payload.get("color_code")
            })

            return elem

        # -------------------------
        # 1) Flatten MatData -> payloads
        # 2) Regroup by unit_id (this solves missing vertical/horizontal units)
        # 3) Create IfcGroup per unit and assign members
        # -------------------------
        payloads = list(iter_payloads(MatData))
        if not payloads:
            raise ValueError("MatData is empty (no payloads).")

        units = {}
        for pl in payloads:
            uid = pl.get("unit_id", None)
            if not uid:
                raise ValueError("payload missing 'unit_id' (Builder must provide unit_id).")
            units.setdefault(str(uid), []).append(pl)

        Log += f"ifcopenshell version: {getattr(ifcopenshell, 'version', 'unknown')}\n"
        Log += f"Resolved OutPath: {OutPath}\n"
        Log += f"Units: {len(units)}\n"

        unit_groups = []
        created_count = 0

        for uid, items in units.items():
            group = ifc_run("root.create_entity", model, ifc_class="IfcGroup", name=f"Unit_{uid}")
            unit_groups.append(group)

            # unit-level Pset
            add_pset(group, "Pset_Unit", {"UnitId": uid})

            members = []
            for pl in items:
                nm = str(pl.get("name", "Unnamed"))
                # de-dup by name (keep your original idea)
                if nm in created_by_name:
                    elem = created_by_name[nm]
                else:
                    elem = create_element(pl)
                    created_by_name[nm] = elem
                    created_count += 1
                members.append(elem)

            if members:
                ifc_run("group.assign_group", model, products=members, group=group)

            # debug
            cats = [str(x.get("category", "Unspecified")) for x in items]
            Log += f"Unit {uid}: payloads={len(items)} cats={cats}\n"

        model.write(OutPath)

        OK = True
        Log += f"\nCreated elements: {created_count}\n"
        Log += f"Created unit groups: {len(unit_groups)}\n"
        Log += f"Wrote: {OutPath}\n"

    except Exception as e:
        OK = False
        Log += "\nFAILED:\n" + repr(e) + "\n\n" + traceback.format_exc()
# ---------- end py3_9 ----------

# ----
# import mode
py3_10 = Python3Script(
    MatData=merge_11,
    UnitIdTree=graft,
    BayNoTree=num_3,
    StoreyName="N02F",
    StoreyElev=number_slider_2,
    OutPath=concat_2,
    Run=Toggle(False))  # -> out, OK, Log; inputs MatData: list, UnitIdTree: tree of String, BayNoTree: tree of String, StoreyName: String, StoreyElev: Double, OutPath: String, Run: Boolean
# ---------- py3_10: Python ----------
import sys, os, importlib

# Rhino/GH 裡通常能拿到目前 .gh 的路徑
import Grasshopper as gh
ghdoc_path = gh.Instances.ActiveCanvas.Document.FilePath  # 可能是空字串（未存檔）
if not ghdoc_path:
    raise Exception("GH document not saved yet. Save .gh first to use relative module path.")

proj_dir = os.path.dirname(ghdoc_path)
module_dir = os.path.join(proj_dir, "py_modules")

if module_dir not in sys.path:
    sys.path.append(module_dir)

import ifc_exporter
importlib.reload(ifc_exporter) #development mode

OK, Log, ResolvedOutPath = ifc_exporter.export_ifc_from_matdata(
    Run,
    MatData,
    StoreyName,
    StoreyElev,
    OutPath
)
# ---------- end py3_10 ----------

panel_5 = Panel(py3_10.Log)

# ==== cluster Cluster
name = ClusterInput()
data = ClusterInput()
name_2 = Text(name)
filterdata = FilterData(data=simplify(data), mode=0, filter=name_2)  # -> object_3, bool_2
clean = CleanTree(RemoveNulls=True, RemoveInvalid=True, RemoveEmpty=invert(False), Tree=filterdata.object_3)
lng = ListLength(List=flatten(clean))
rep = ReplaceText(Text=name_2, Find=" ", RecursiveReplace=False)
guid = CreateGUID(NumberOfGuids=lng, Format="Hyphens")
repeat = RepeatData(Data=rep, Length=lng)
unflatten = UnflattenTree(Tree=repeat, Guide=clean)  # -> graft(Tree)
unflatten_2 = UnflattenTree(Tree=guid, Guide=clean)  # -> graft(Tree)
merge = Merge(Data1=unflatten, Data2=unflatten_2)
join = TextJoin(Text=merge, Join="_")
unflatten_3 = UnflattenTree(Tree=clean, Guide=join)
trimbranch = TrimBranch(tree=unflatten_3, level="1")  # -> result; inputs tree: tree, level: Int32
# ---------- trimbranch: Python ----------
from Grasshopper import DataTree
from Grasshopper.Kernel.Data import GH_Path
from Grasshopper.Kernel import GH_RuntimeMessageLevel

if tree is None or level is None or tree.DataCount==0:
    ghenv.Component.AddRuntimeMessage(
        GH_RuntimeMessageLevel.Warning,
        "data is empty"
    )

def integrate_branches(data_tree, level):
    new_tree = DataTree[object]()
    
    # 遍歷數據樹的每個分支
    for i in range(data_tree.BranchCount):
        path = data_tree.Path(i)  # 取得當前分支的路徑
        items = data_tree.Branch(i)  # 取得當前分支的數據
        
        # 根據指定層級截取路徑
        new_path_indices = [path[j] for j in range(level) if j < path.Length]
        new_path = GH_Path(new_path_indices)
        
        # 將數據添加到新的分支
        for item in items:
            new_tree.Add(item, new_path)
    
    return new_tree

# 輸入參數
# data_tree: 數據樹
# level_input: 整數，表示保留的層級數
result = integrate_branches(tree, level)
# ---------- end trimbranch ----------
trimbranch_2 = TrimBranch(tree=join, level="1")  # -> result; inputs tree: tree, level: Int32; same code as trimbranch
guid_2 = Text(trimbranch_2)
geo = Geometry(trimbranch)
panel = Panel(guid_2)
guid_3 = ClusterOutput(guid_2)
geo_2 = ClusterOutput(geo)

# ==== cluster FilterData
data = ClusterInput()
mode = ClusterInput()
filter = ClusterInput()
data_2 = ModelObject(data)
mode_2 = Integer(mode)
filter_2 = Data(filter)
object = ModelObject(Object=data_2)  # -> Object, Name, Layer
py3 = Python3Script(x=object.Object)  # -> a
# ---------- py3: Python ----------
if x:
    a = x
else:
    a = 'None'
# ---------- end py3 ----------
py3_2 = Python3Script(x=object.Name)  # -> a; same code as py3
py3_3 = Python3Script(x=object.Layer)  # -> a; same code as py3
matchtext = Python3Script(layerList=py3_3, searchList=filter_2)  # -> out_bool; inputs layerList: list, searchList: list of String
# ---------- matchtext: Python ----------
from ghpythonlib.components import MatchText
from Grasshopper import DataTree
from Grasshopper.Kernel.Data import GH_Path
from Grasshopper.Kernel import GH_RuntimeMessageLevel
from itertools import zip_longest

if layerList is None or searchList is None:
    ghenv.Component.AddRuntimeMessage(
        GH_RuntimeMessageLevel.Warning,
        "data is empty"
    )
else:
    def to_bool_seq(x):
        # 統一轉為「list[bool]」
        # IronPython 的 List 可以直接 list(x)
        if isinstance(x, bool) or x is None:
            return [bool(x)]
        try:
            # 若是 IronPython.Runtime.List、list、tuple 等可迭代
            return [bool(v) for v in list(x)]
        except TypeError:
            # 其他不可迭代的一律包成單一元素
            return [bool(x)]

    nest_bool = []
    for pattern in searchList:
        temp = MatchText(text=layerList, regex=pattern, case=True)
        seq = to_bool_seq(temp)     # 先規範化
        nest_bool.append(seq)

    # 只有一條序列 → 你想要：直接回傳它？還是壓成單一布林？
    # 1) 若要「逐欄結果」就直接複製那條：
    if len(nest_bool) == 1:
        out_bool = list(nest_bool[0])
    else:
        # 多條序列 → 逐欄 OR，長度不齊用 False 補齊
        out_bool = [any(col) for col in zip_longest(*nest_bool, fillvalue=False)]

    # 檢查
    # print(nest_bool)
    # print(out_bool)
# ---------- end matchtext ----------
matchtext_2 = Python3Script(layerList=py3_2, searchList=filter_2)  # -> out_bool; inputs layerList: list, searchList: list of String; same code as matchtext
matchtext_3 = Python3Script(layerList=py3, searchList=filter_2)  # -> out_bool; inputs layerList: list, searchList: list of String; same code as matchtext
tmatch = MatchText(Text=data_2, RegEx=filter_2, Case=True)
or = GateOr(A=tmatch, D=matchtext_3, B=matchtext_2, C=matchtext)
filter_3 = StreamFilter(Gate=mode_2, Stream0=or, Stream1=tmatch, Stream2=matchtext_3, Stream3=matchtext_2, Stream4=matchtext)
dispatch = Dispatch(List=data_2, DispatchPattern=filter_3)  # -> ListA, ListB
object_2 = ModelObject(dispatch.ListA)
bool = Boolean(filter_3)
bool_2 = ClusterOutput(bool)
object_3 = ClusterOutput(object_2)
