# Grasshopper definition openshell_test_dbml_v3.gh (Grasshopper 1.0.8)

# ----
# This is the way I synchronize the state of all components.
# Connect one of the outputs from the component that needs
#  to be synchronized to the template of the
# “Sync Component.”
# Then press the Run button to instantly update the inputs,
# outputs, and code of all components with the same name
# across the Grasshopper canvas.
assembly = Python3Script()  # -> out, Log, MatDataOut; inputs MatData: tree, Name: tree of String, KeySuffix: String, Key: tree of String, Value: tree of String, UnitId: tree of String
# ---------- assembly: Python ----------
import sys, os, importlib

# Rhino/GH 裡通常能拿到目前 .gh 的路徑
import Grasshopper as gh
ghdoc_path = gh.Instances.ActiveCanvas.Document.FilePath  # 可能是空字串（未存檔）
if not ghdoc_path:
    raise Exception("GH document not saved yet. Save .gh first to use relative module path.")

proj_dir = os.path.dirname(ghdoc_path)
module_dir = os.path.join(proj_dir, "py_modules")

if module_dir not in sys.path:
    sys.path.append(module_dir)

def reload_pkg(prefix: str):
    # reload children first (reverse length order)
    mods = [m for name, m in sys.modules.items() if name == prefix or name.startswith(prefix + ".")]
    mods.sort(key=lambda m: len(m.__name__), reverse=True)
    for m in mods:
        importlib.reload(m)

# 先 import utils（確保從 py_modules 來）
import utils

# (可選) 確認你抓到的是哪個 utils，避免載到別份
# import utils.gh_utils as gu
# print("utils path =", gu.__file__)

# reload utils 及其已載入子模組
reload_pkg("utils")


import ifc_assembly
importlib.reload(ifc_assembly)

MatDataOut, Log = ifc_assembly.annotate_subassembly(MatData, Name, KeySuffix, Role, Key, Value, UnitId)
# ---------- end assembly ----------
unit_builder = Python3Script()  # -> out, Log, MatData; inputs Obj: tree, Category: String, UnitId: tree of String
# ---------- unit_builder: Python ----------
import sys, os, importlib

# Rhino/GH 裡通常能拿到目前 .gh 的路徑
import Grasshopper as gh
ghdoc_path = gh.Instances.ActiveCanvas.Document.FilePath  # 可能是空字串（未存檔）
if not ghdoc_path:
    raise Exception("GH document not saved yet. Save .gh first to use relative module path.")

proj_dir = os.path.dirname(ghdoc_path)
module_dir = os.path.join(proj_dir, "py_modules")

if module_dir not in sys.path:
    sys.path.append(module_dir)

def reload_pkg(prefix: str):
    # reload children first (reverse length order)
    mods = [m for name, m in sys.modules.items() if name == prefix or name.startswith(prefix + ".")]
    mods.sort(key=lambda m: len(m.__name__), reverse=True)
    for m in mods:
        importlib.reload(m)

# 先 import utils（確保從 py_modules 來）
import utils

# (可選) 確認你抓到的是哪個 utils，避免載到別份
# import utils.gh_utils as gu
# print("utils path =", gu.__file__)

# reload utils 及其已載入子模組
reload_pkg("utils")

# reload builder（讓它重新綁定新的 utils）
import ifc_unit_builder
importlib.reload(ifc_unit_builder)

MatData, Log = ifc_unit_builder.build_matdata(Obj, Category, UnitId)
# ---------- end unit_builder ----------
nonunit_builder = Python3Script()  # -> out, Log, MatData; inputs Obj: tree, Category: String
# ---------- nonunit_builder: Python ----------
import sys, os, importlib

# Rhino/GH 裡通常能拿到目前 .gh 的路徑
import Grasshopper as gh
ghdoc_path = gh.Instances.ActiveCanvas.Document.FilePath  # 可能是空字串（未存檔）
if not ghdoc_path:
    raise Exception("GH document not saved yet. Save .gh first to use relative module path.")

proj_dir = os.path.dirname(ghdoc_path)
module_dir = os.path.join(proj_dir, "py_modules")

if module_dir not in sys.path:
    sys.path.append(module_dir)

def reload_pkg(prefix: str):
    # reload children first (reverse length order)
    mods = [m for name, m in sys.modules.items() if name == prefix or name.startswith(prefix + ".")]
    mods.sort(key=lambda m: len(m.__name__), reverse=True)
    for m in mods:
        importlib.reload(m)

# 先 import utils（確保從 py_modules 來）
import utils

# (可選) 確認你抓到的是哪個 utils，避免載到別份
# import utils.gh_utils as gu
# print("utils path =", gu.__file__)

# reload utils 及其已載入子模組
reload_pkg("utils")

import ifc_nonUnit_builder
importlib.reload(ifc_nonUnit_builder)

MatData, Log = ifc_nonUnit_builder.build_nonUnit_matdata(Obj, Category)
# ---------- end nonunit_builder ----------
bulk_builder = Python3Script()  # -> out, Log, MatData; inputs Obj: tree, Category: String, Scope: String, UnitId: tree of String
# ---------- bulk_builder: Python ----------
import sys, os, importlib

# Rhino/GH 裡通常能拿到目前 .gh 的路徑
import Grasshopper as gh
ghdoc_path = gh.Instances.ActiveCanvas.Document.FilePath  # 可能是空字串（未存檔）
if not ghdoc_path:
    raise Exception("GH document not saved yet. Save .gh first to use relative module path.")

proj_dir = os.path.dirname(ghdoc_path)
module_dir = os.path.join(proj_dir, "py_modules")

if module_dir not in sys.path:
    sys.path.append(module_dir)

def reload_pkg(prefix: str):
    # reload children first (reverse length order)
    mods = [m for name, m in sys.modules.items() if name == prefix or name.startswith(prefix + ".")]
    mods.sort(key=lambda m: len(m.__name__), reverse=True)
    for m in mods:
        importlib.reload(m)

# 先 import utils（確保從 py_modules 來）
import utils

# (可選) 確認你抓到的是哪個 utils，避免載到別份
# import utils.gh_utils as gu
# print("utils path =", gu.__file__)

# reload utils 及其已載入子模組
reload_pkg("utils")

# reload builder（讓它重新綁定新的 utils）
import ifc_bulk_builder
importlib.reload(ifc_bulk_builder)

MatData, Log = ifc_bulk_builder.build_bulk_matdata(Obj, Category, Scope, UnitId)
# ---------- end bulk_builder ----------
group = Python3Script()  # -> out, Log, MatData; inputs Obj: tree, Names: tree of String
# ---------- group: Python ----------
import sys, os, importlib

# Rhino/GH 裡通常能拿到目前 .gh 的路徑
import Grasshopper as gh
ghdoc_path = gh.Instances.ActiveCanvas.Document.FilePath  # 可能是空字串（未存檔）
if not ghdoc_path:
    raise Exception("GH document not saved yet. Save .gh first to use relative module path.")

proj_dir = os.path.dirname(ghdoc_path)
module_dir = os.path.join(proj_dir, "py_modules")

if module_dir not in sys.path:
    sys.path.append(module_dir)

def reload_pkg(prefix: str):
    # reload children first (reverse length order)
    mods = [m for name, m in sys.modules.items() if name == prefix or name.startswith(prefix + ".")]
    mods.sort(key=lambda m: len(m.__name__), reverse=True)
    for m in mods:
        importlib.reload(m)

# 先 import utils（確保從 py_modules 來）
import utils

# (可選) 確認你抓到的是哪個 utils，避免載到別份
# import utils.gh_utils as gu
# print("utils path =", gu.__file__)

# reload utils 及其已載入子模組
reload_pkg("utils")

# reload builder（讓它重新綁定新的 utils）
import ifc_group
importlib.reload(ifc_group)

MatData, Log = ifc_group.annotate_group(Obj, Names)
# ---------- end group ----------
override = Python3Script()  # -> out, Log, MatData; inputs Obj: tree, Key: tree of String, Value: tree of String, UnitId: tree of String
# ---------- override: Python ----------
import sys, os, importlib

# Rhino/GH 裡通常能拿到目前 .gh 的路徑
import Grasshopper as gh
ghdoc_path = gh.Instances.ActiveCanvas.Document.FilePath  # 可能是空字串（未存檔）
if not ghdoc_path:
    raise Exception("GH document not saved yet. Save .gh first to use relative module path.")

proj_dir = os.path.dirname(ghdoc_path)
module_dir = os.path.join(proj_dir, "py_modules")

if module_dir not in sys.path:
    sys.path.append(module_dir)

def reload_pkg(prefix: str):
    # reload children first (reverse length order)
    mods = [m for name, m in sys.modules.items() if name == prefix or name.startswith(prefix + ".")]
    mods.sort(key=lambda m: len(m.__name__), reverse=True)
    for m in mods:
        importlib.reload(m)

# 先 import utils（確保從 py_modules 來）
import utils

# (可選) 確認你抓到的是哪個 utils，避免載到別份
# import utils.gh_utils as gu
# print("utils path =", gu.__file__)

# reload utils 及其已載入子模組
reload_pkg("utils")

import ifc_override
importlib.reload(ifc_override)

MatData, Log = ifc_override.override_obj_tree(Obj, Key, Value, UnitId)
# ---------- end override ----------
sync_component = CSharpScript(Run=Button())  # -> out, Log; inputs Run: Boolean, Template: tree
# ---------- sync_component: C# ----------
// Grasshopper Script Instance
#region Usings
using System;
using System.Linq;
using System.Collections;
using System.Collections.Generic;
using System.Drawing;

using Rhino;
using Rhino.Geometry;

using Grasshopper;
using Grasshopper.Kernel;
using Grasshopper.Kernel.Data;
using Grasshopper.Kernel.Types;
#endregion


public class Script_Instance : GH_ScriptInstance
{
  private void RunScript(bool Run, DataTree<object> Template, ref object Log)
  {
    if (!Run)
    {
      Log = "Run = false";
      return;
    }

    GH_Document doc = GrasshopperDocument;
    if (doc == null)
    {
      Log = "No GH_Document";
      return;
    }

    // ---------------------------
    // Phase 1: 回溯 Template（只讀）
    // ---------------------------
    if (Component.Params.Input.Count < 2)
    {
      Log = "Template input missing";
      return;
    }

    var templateInput = Component.Params.Input[1];
    if (templateInput.Sources.Count == 0)
    {
      Log = "Template input has no source wire";
      return;
    }

    IGH_Param src = templateInput.Sources[0];
    IGH_DocumentObject topObj =
      src.Attributes?.GetTopLevel?.DocObject ??
      src.Attributes?.Parent?.DocObject;

    IGH_Component templateComp = topObj as IGH_Component;
    if (templateComp == null)
    {
      Log = "Upstream object is not an IGH_Component";
      return;
    }

    string targetName = templateComp.NickName;
    Guid templateComponentGuid = templateComp.ComponentGuid;
    Guid templateInstanceGuid = templateComp.InstanceGuid;

    if (string.IsNullOrWhiteSpace(targetName))
    {
      Log = "Template NickName is empty";
      return;
    }

    List<Guid> oldIds = doc.Objects
      .OfType<IGH_Component>()
      .Where(c => c.InstanceGuid != templateInstanceGuid)
      .Where(c => c.NickName == targetName)
      .Select(c => c.InstanceGuid)
      .ToList();

    if (oldIds.Count == 0)
    {
      Log = "No components to replace";
      return;
    }

    // ---------------------------
    // Phase 2: 延後修改（安全）
    // ---------------------------
    doc.ScheduleSolution(1, d =>
    {
      ReplaceComponents(d, templateComponentGuid, templateInstanceGuid, oldIds);
    });

    Log = "Scheduled replace: " + oldIds.Count;
  }

  // ============================================================
  // Replace + Rewire + Keep Position
  // ============================================================
  private void ReplaceComponents(
    GH_Document doc,
    Guid templateComponentGuid,
    Guid templateInstanceGuid,
    List<Guid> oldInstanceIds
  )
  {
    var proxy = Instances.ComponentServer.ObjectProxies
      .FirstOrDefault(p => p.Guid == templateComponentGuid);
    if (proxy == null) return;

    var templateObj = doc.FindObject(templateInstanceGuid, false) as IGH_Component;
    if (templateObj == null) return;

    doc.UndoUtil.RecordEvent("Replace components");

    string Key(IGH_Param p)
    {
      return string.IsNullOrWhiteSpace(p.NickName) ? p.Name : p.NickName;
    }

    foreach (var id in oldInstanceIds)
    {
      IGH_Component oldObj = doc.FindObject(id, false) as IGH_Component;
      if (oldObj == null) continue;

      // -------- 0) 記錄舊位置（Pivot）--------
      // 你要的：替換後還在原位
      PointF oldPivot = PointF.Empty;
      try
      {
        if (oldObj.Attributes == null) oldObj.CreateAttributes();
        oldPivot = oldObj.Attributes.Pivot;
      }
      catch { }

      // -------- 1) 記錄舊連線 --------
      var oldInWires = oldObj.Params.Input
        .ToDictionary(p => Key(p), p => p.Sources.ToList());

      var oldOutWires = oldObj.Params.Output
        .ToDictionary(p => Key(p), p => p.Recipients.ToList());

      // -------- 2) 建立新元件 --------
      IGH_Component newC = proxy.CreateInstance() as IGH_Component;
      if (newC == null) continue;

      newC.CreateAttributes();

      // 先放到舊位置（等下 Clone 會蓋掉，所以還要再設一次）
      newC.Attributes.Pivot = oldPivot;

      // NickName 維持（用於你後續同名管理）
      newC.NickName = oldObj.NickName;

      doc.AddObject(newC, false);

      // -------- 3) 複製 Template 狀態（含 GhPython script / IO）--------
      CloneComponentState(templateObj, newC);

      // 🔥 重要：Clone 可能把 Pivot 蓋成 template 的位置
      // 所以一定要在 Clone 之後再把 Pivot 設回來
      if (newC.Attributes == null) newC.CreateAttributes();
      newC.Attributes.Pivot = oldPivot;
      newC.Attributes.ExpireLayout(); // 讓 GH 重新算 bounds

      // -------- 4) 建立新 IO 對照表 --------
      var newInMap = newC.Params.Input
        .GroupBy(Key)
        .ToDictionary(g => g.Key, g => g.First());

      var newOutMap = newC.Params.Output
        .GroupBy(Key)
        .ToDictionary(g => g.Key, g => g.First());

      // -------- 5) INPUT：來源 → 新 input --------
      foreach (var kv in oldInWires)
      {
        if (!newInMap.TryGetValue(kv.Key, out IGH_Param newIn)) continue;

        foreach (var s in kv.Value)
          newIn.AddSource(s);
      }

      // -------- 6) OUTPUT：新 output → 舊 recipients --------
      foreach (var kv in oldOutWires)
      {
        if (!newOutMap.TryGetValue(kv.Key, out IGH_Param newOut)) continue;

        foreach (var r in kv.Value)
          r.AddSource(newOut);
      }

      // -------- 7) 刪除舊元件 --------
      doc.RemoveObject(oldObj, false);
    }
  }

  // ============================================================
  // Clone component instance state via GH_Archive
  // (works across GH versions; includes GhPython script)
  // ============================================================
  private bool CloneComponentState(IGH_Component source, IGH_Component target)
  {
    if (source == null || target == null) return false;

    var archive = new GH_Archive();
    archive.AppendObject(source, "Component");
    return archive.ExtractObject(target, "Component");
  }
}
# ---------- end sync_component ----------

object = ModelObject([<model object referenced from the Rhino model> x3])
object_2 = ModelObject([<model object referenced from the Rhino model> x14])
cluster = Cluster_3(layername="##_Kevin::")  # disabled
object_3 = ModelObject(object)
explode = ExplodeObject(Object=object_3, Recursive=False)
block_definition = ModelBlockDefinition(BlockDefinition=object_3)  # -> BlockDefinition, Name
rename = Rename(O=explode)
graft = GraftTree(Tree=block_definition.Name, IncludeEmptyLists=True, IncludeNullItems=True)  # -> simplify(Tree)
block_definition_2 = ModelBlockDefinition(BlockDefinition=graft)  # -> BlockDefinition, Name
split = TextSplit(Text=block_definition_2.Name, Separators="_")
graft_2 = GraftTree(Tree=block_definition.Name, IncludeEmptyLists=True, IncludeNullItems=True)  # -> simplify(Tree)
item = ListItem(List=reverse(split), Index=0, Wrap=True)
txt = Text(simplify(item))
object_4 = ModelObject([<model object referenced from the Rhino model> x79])
object_5 = ModelObject([<model object referenced from the Rhino model> x22])
object_6 = ModelObject([<model object referenced from the Rhino model> x777])

# ----
# Archived now
panel = Panel("N65")  # disabled
filterdata = FilterData(data=simplify(rename), mode=0, filter=panel)  # -> object_3, bool_2; disabled
cluster_2 = Cluster_4(B=filterdata.object_3)  # -> pln_2, crv_2; disabled
pln = Plane(cluster_2.pln_2)  # disabled
cluster1 = Cluster1(crv=cluster_2.crv_2, object=rename)  # disabled

cluster_3 = Cluster(data=rename, mode=0, name=" L01")  # -> geo_2, obj
cluster_4 = Cluster(data=rename, mode=0, name="鋁板3")  # -> geo_2, obj
cluster_5 = Cluster(data=rename, mode=0, name="N64")  # -> geo_2, obj
cluster_6 = Cluster(data=object_6, mode=0, name="N66")  # -> geo_2, obj
cluster_7 = Cluster(data=object_6, mode=0, name="N68")  # -> geo_2, obj
cluster_8 = Cluster(data=object_6, mode=0, name="N53")  # -> geo_2, obj
cluster_9 = Cluster(data=object_6, mode=0, name="N02")  # -> geo_2, obj
cluster_10 = Cluster(data=object_6, mode=0, name="N67")  # -> geo_2, obj
cluster_11 = Cluster(data=object_6, mode=0, name="N69")  # -> geo_2, obj
cluster_12 = Cluster(data=object_6, mode=0, name="AL01")  # -> geo_2, obj
cluster_13 = Cluster(data=rename, mode="4", name="装饰铝板")  # -> geo_2, obj
cluster_14 = Cluster(data=rename, mode=0, name="N71")  # -> geo_2, obj
cluster_15 = Cluster(data=rename, mode=0, name="N01")  # -> geo_2, obj
cluster_16 = Cluster(data=rename, mode=0, name="N02")  # -> geo_2, obj
cluster_17 = Cluster(data=rename, mode=0, name="N15")  # -> geo_2, obj
cluster_18 = Cluster(data=rename, mode=0, name="N14")  # -> geo_2, obj
cluster_19 = Cluster(data=rename, mode=0, name="N65")  # -> geo_2, obj
cluster_20 = Cluster(data=rename, mode=0, name="N10")  # -> geo_2, obj
cluster_21 = Cluster(data=rename, mode=0, name="N67 ")  # -> geo_2, obj
cluster_22 = Cluster(data=rename, mode=0, name="N11")  # -> geo_2, obj
cluster_23 = Cluster(data=rename, mode=0, name="N12")  # -> geo_2, obj
cluster_24 = Cluster(data=rename, mode=0, name="N13")  # -> geo_2, obj
cluster_25 = Cluster(data=rename, mode=0, name="N08")  # -> geo_2, obj
cluster_26 = Cluster(data=rename, mode=0, name="N29")  # -> geo_2, obj
cluster_27 = Cluster(data=object_4, mode=0, name="F13")  # -> geo_2, obj
cluster_28 = Cluster(data=rename, mode=0, name="N19")  # -> geo_2, obj
cluster_29 = Cluster(data=rename, mode=0, name="N69")  # -> geo_2, obj
cluster_30 = Cluster(data=rename, mode=0, name="N68 ")  # -> geo_2, obj
cluster_31 = Cluster(data=object_4, mode=0, name="F12")  # -> geo_2, obj
cluster_32 = Cluster(data=rename, mode=0, name="N20 ")  # -> geo_2, obj
cluster_33 = Cluster(data=rename, mode=0, name="AL01")  # -> geo_2, obj
cluster_34 = Cluster(data=rename, mode=0, name="N66")  # -> geo_2, obj
cluster_35 = Cluster(data=object_4, mode=0, name="N41")  # -> geo_2, obj
cluster_36 = Cluster(data=rename, mode=0, name="N28")  # -> geo_2, obj
cluster_37 = Cluster(data=rename, mode=0, name="N20a")  # -> geo_2, obj
cluster_38 = Cluster(data=object_6, mode=0, name="角鋁3")  # -> geo_2, obj
cluster_39 = Cluster(data=object_4, mode=0, name="F15")  # -> geo_2, obj
cluster_40 = Cluster(data=rename, mode=0, name="N21")  # -> geo_2, obj
cluster_41 = Cluster(data=object_4, mode=0, name="N43")  # -> geo_2, obj
cluster_42 = Cluster(data=rename, mode=0, name="AL02")  # -> geo_2, obj
cluster_43 = Cluster(data=object_6, mode=0, name="角鋁2")  # -> geo_2, obj
cluster_44 = Cluster(data=rename, mode=0, name="N61 ")  # -> geo_2, obj
cluster_45 = Cluster(data=rename, mode=0, name="N32 ")  # -> geo_2, obj
cluster_46 = Cluster(data=rename, mode=0, name="N32B")  # -> geo_2, obj
cluster_47 = Cluster(data=rename, mode=0, name="N07")  # -> geo_2, obj
cluster_48 = Cluster(data=object_5, mode=0, name="F13")  # -> geo_2, obj
cluster_49 = Cluster(data=object_5, mode=0, name="N41")  # -> geo_2, obj
cluster_50 = Cluster(data=object_6, mode=0, name="F22")  # -> geo_2, obj
cluster_51 = Cluster(data=object_6, mode=0, name="S09")  # -> geo_2, obj

# ----
# 正常測試
# nonUnit情況下，Key/Value是否正常運作
panel_2 = Panel("""N68_OverrideTest_1
N68_OverrideTest_2""")
data = Data(cluster_7.obj)
mockdata = MockData(key=panel_2, obj=data)  # -> okey_2, ovalue_2

merge = Merge(Data1=cluster_9.obj, Data2=cluster_8.obj)
merge_2 = Merge(Data1=cluster_11.obj)
merge_3 = Merge(Data1=cluster_5.obj)

# ----
# shared測試
# unit情況下，Key/Value是否會套用於
# 所有obj，若要shared，不能輸入UnitId
panel_3 = Panel("""N28_OverrideTest_1
N28_OverrideTest_2
N28_OverrideTest_3""")
panel_4 = Panel("""N28_CommonData_1
N28_CommonData_2
N28_CommonData_3""")

# ----
# 正常測試
# nonUnit情況下，Key/Value是否正常運作
panel_5 = Panel("""AL01_OverrideTest_1
AL01_OverrideTest_2
AL01_OverrideTest_3""")
data_2 = Data(cluster_12.obj)
mockdata_2 = MockData(key=panel_5, obj=data_2)  # -> okey_2, ovalue_2

panel_6 = Panel("""N01_Group
Vertical_Group""")
merge_4 = Merge(Data1=cluster_48.obj, Data2=cluster_49.obj)
merge_5 = Merge(Data1=cluster_44.obj, Data2=cluster_45.obj, Data3=cluster_46.obj)
merge_6 = Merge(Data1=cluster_33.obj, Data2=cluster_42.obj)

# ----
# shared測試
# nonUnit情況下，Key/Value是否會套用於
# 所有obj
panel_7 = Panel("""N67_CommonData_1
N67_CommonData_2""")
panel_8 = Panel("""N67_OverrideTest_1
N67_OverrideTest_2""")

merge_7 = Merge(Data1=cluster_39.obj, Data2=cluster_31.obj, Data3=cluster_27.obj, Data4=cluster_35.obj, Data5=cluster_41.obj)
group_2 = Python3Script(Obj=cluster_34.obj, Names="N66_Group")  # -> out, Log, MatData; inputs Obj: tree, Names: tree of String; same code as group
group_3 = Python3Script(Obj=cluster_15.obj, Names=panel_6)  # -> out, Log, MatData; inputs Obj: tree, Names: tree of String; same code as group
group_4 = Python3Script(Obj=cluster_20.obj, Names="Butterfly-fin_Group")  # -> out, Log, MatData; inputs Obj: tree, Names: tree of String; same code as group
group_5 = Python3Script(Obj=cluster_16.obj, Names="Vertical_Group")  # -> out, Log, MatData; inputs Obj: tree, Names: tree of String; same code as group
group_6 = Python3Script(Obj=cluster_23.obj, Names="Butterfly-fin_Group")  # -> out, Log, MatData; inputs Obj: tree, Names: tree of String; same code as group
group_7 = Python3Script(Obj=cluster_24.obj, Names="Butterfly-fin_Group")  # -> out, Log, MatData; inputs Obj: tree, Names: tree of String; same code as group
group_8 = Python3Script(Obj=cluster_18.obj, Names="Butterfly-fin_Group")  # -> out, Log, MatData; inputs Obj: tree, Names: tree of String; same code as group
group_9 = Python3Script(Obj=cluster_22.obj, Names="Butterfly-fin_Group")  # -> out, Log, MatData; inputs Obj: tree, Names: tree of String; same code as group
merge_8 = Merge(Data1=cluster_37.obj, Data2=cluster_40.obj)
list = ValueList({"Vertical", "Horizontal", "Fitting", "Panel", "Glass", "Mullion", "Transom", "Bracket", "Accessory", "Fastener", "Bolt", "Screw"}, selected="Fitting")

# ----
# 正常測試
# nonUnit情況下，Key/Value是否正常運作
panel_9 = Panel("""角鋁2_OverrideTest_1
角鋁2_OverrideTest_2""")
data_3 = Data(cluster_43.obj)
mockdata_3 = MockData(key=panel_9, obj=data_3)  # -> okey_2, ovalue_2

list_2 = ValueList({"Vertical", "Horizontal", "Fitting", "Panel", "Glass", "Mullion", "Transom", "Bracket", "Accessory", "Fastener", "Bolt", "Screw"}, selected="Fitting")
override_2 = Python3Script(Obj=cluster_30.obj, Key=panel_3, Value=panel_4)  # -> out, Log, MatData; inputs Obj: tree, Key: tree of String, Value: tree of String, UnitId: tree of String; same code as override
override_3 = Python3Script(Obj=data, Key=mockdata.okey_2, Value=mockdata.ovalue_2)  # -> out, Log, MatData; inputs Obj: tree, Key: tree of String, Value: tree of String, UnitId: tree of String; same code as override
override_4 = Python3Script(Obj=cluster_10.obj, Key=panel_8, Value=panel_7)  # -> out, Log, MatData; inputs Obj: tree, Key: tree of String, Value: tree of String, UnitId: tree of String; same code as override
list_3 = ValueList({"Vertical", "Horizontal", "Fitting", "Panel", "Glass", "Mullion", "Transom", "Bracket", "Accessory", "Fastener", "Bolt", "Screw"}, selected="Panel")
list_4 = ValueList({"Vertical", "Horizontal", "Fitting", "Panel", "Glass", "Mullion", "Transom", "Bracket", "Accessory", "Fastener", "Bolt", "Screw"}, selected="Vertical")
list_5 = ValueList({"Vertical", "Horizontal", "Fitting", "Panel", "Glass", "Mullion", "Transom", "Bracket", "Accessory", "Fastener", "Bolt", "Screw"}, selected="Horizontal")
override_5 = Python3Script(Obj=data_2, Key=mockdata_2.okey_2, Value=mockdata_2.ovalue_2)  # -> out, Log, MatData; inputs Obj: tree, Key: tree of String, Value: tree of String, UnitId: tree of String; same code as override
list_6 = ValueList({"Vertical", "Horizontal", "Fitting", "Panel", "Glass", "Mullion", "Transom", "Bracket", "Accessory", "Fastener", "Bolt", "Screw"}, selected="Fitting")
list_7 = ValueList({"Vertical", "Horizontal", "Fitting", "Panel", "Glass", "Mullion", "Transom", "Bracket", "Accessory", "Fastener", "Bolt", "Screw"}, selected="Accessory")
list_8 = ValueList({"Unit": "UNIT", "Non Unit": "NON_UNIT"}, selected="Unit")
list_9 = ValueList({"Vertical", "Horizontal", "Fitting", "Panel", "Glass", "Mullion", "Transom", "Bracket", "Accessory", "Fastener", "Bolt", "Screw"}, selected="Fastener")
list_10 = ValueList({"Unit": "UNIT", "Non Unit": "NON_UNIT"}, selected="Unit")
context_builder = Python3Script(Obj=merge_7, Category=list)  # -> out, Log, MatData; inputs Obj: tree, Category: String
# ---------- context_builder: Python ----------
import sys, os, importlib

# Rhino/GH 裡通常能拿到目前 .gh 的路徑
import Grasshopper as gh
ghdoc_path = gh.Instances.ActiveCanvas.Document.FilePath  # 可能是空字串（未存檔）
if not ghdoc_path:
    raise Exception("GH document not saved yet. Save .gh first to use relative module path.")

proj_dir = os.path.dirname(ghdoc_path)
module_dir = os.path.join(proj_dir, "py_modules")

if module_dir not in sys.path:
    sys.path.append(module_dir)

def reload_pkg(prefix: str):
    # reload children first (reverse length order)
    mods = [m for name, m in sys.modules.items() if name == prefix or name.startswith(prefix + ".")]
    mods.sort(key=lambda m: len(m.__name__), reverse=True)
    for m in mods:
        importlib.reload(m)

# 先 import utils（確保從 py_modules 來）
import utils

# (可選) 確認你抓到的是哪個 utils，避免載到別份
# import utils.gh_utils as gu
# print("utils path =", gu.__file__)

# reload utils 及其已載入子模組
reload_pkg("utils")

import ifc_nonUnit_builder
importlib.reload(ifc_nonUnit_builder)

MatData, Log = ifc_nonUnit_builder.build_nonUnit_matdata(Obj, Category, 1, "CONTEXT")
# ---------- end context_builder ----------
context_builder_2 = Python3Script(Obj=merge_4, Category=list_2)  # -> out, Log, MatData; inputs Obj: tree, Category: String; same code as context_builder

# ----
# 正常測試
# unit情況下，Key/Value是否正常運作
panel_10 = Panel("""N01_OverrideTest_1
N01_OverrideTest_2
N01_OverrideTest_3""")
panel_11 = Panel("""N15_OverrideTest_1
N15_OverrideTest_2
N15_OverrideTest_3
N15_OverrideTest_4""")
panel_12 = Panel("""N02_OverrideTest_1
N02_OverrideTest_2""")
data_4 = Data(group_5.MatData)
data_5 = Data(group_3.MatData)
data_6 = Data(cluster_17.obj)
mockdata_4 = MockData(key=panel_10, obj=data_5)  # -> okey_2, ovalue_2
mockdata_5 = MockData(key=panel_11, obj=data_6)  # -> okey_2, ovalue_2
mockdata_6 = MockData(key=panel_12, obj=data_4)  # -> okey_2, ovalue_2

# ----
# 正常測試
# unit情況下，Key/Value是否正常運作
panel_13 = Panel("""N69_OverrideTest_1
N69_OverrideTest_2
N69_OverrideTest_3
N69_OverrideTest_4""")
data_7 = Data(cluster_29.obj)
mockdata_7 = MockData(key=panel_13, obj=data_7)  # -> okey_2, ovalue_2

# ----
# 特殊測試
# 物件僅在其中一個unit有的情況下，
# Key/Value是否會正常運作
panel_14 = Panel("""N20_OverrideTest_1
N20_OverrideTest_2""")
data_8 = Data(cluster_32.obj)
mockdata_8 = MockData(key=panel_14, obj=data_8)  # -> okey_2, ovalue_2

unit_builder_2 = Python3Script(Obj=merge_5, Category=list_6, UnitId=graft_2)  # -> out, Log, MatData; inputs Obj: tree, Category: String, UnitId: tree of String; same code as unit_builder
unit_builder_3 = Python3Script(Obj=merge_6, Category=list_3, UnitId=graft_2)  # -> out, Log, MatData; inputs Obj: tree, Category: String, UnitId: tree of String; same code as unit_builder
unit_builder_4 = Python3Script(Obj=merge_8, Category=list_5, UnitId=graft_2)  # -> out, Log, MatData; inputs Obj: tree, Category: String, UnitId: tree of String; same code as unit_builder
unit_builder_5 = Python3Script(Obj=merge_3, Category=list_4, UnitId=graft_2)  # -> out, Log, MatData; inputs Obj: tree, Category: String, UnitId: tree of String; same code as unit_builder
bulk_builder_2 = Python3Script(Obj=cluster_4.obj, Category=list_7, Scope=list_8, UnitId=graft_2)  # -> out, Log, MatData; inputs Obj: tree, Category: String, Scope: String, UnitId: tree of String; same code as bulk_builder
bulk_builder_3 = Python3Script(Obj=cluster_3.obj, Category=list_9, Scope=list_10, UnitId=graft_2)  # -> out, Log, MatData; inputs Obj: tree, Category: String, Scope: String, UnitId: tree of String; same code as bulk_builder
list_11 = ValueList({"Vertical", "Horizontal", "Fitting", "Panel", "Glass", "Mullion", "Transom", "Bracket", "Accessory", "Fastener", "Bolt", "Screw"}, selected="Fitting")
list_12 = ValueList({"Vertical", "Horizontal", "Fitting", "Panel", "Glass", "Mullion", "Transom", "Bracket", "Accessory", "Fastener", "Bolt", "Screw"}, selected="Horizontal")
merge_9 = Merge(Data1=group_2.MatData, Data2=cluster_36.obj, Data3=cluster_21.obj, Data4=override_2.MatData, Data5=cluster_26.obj)
merge_10 = Merge(Data1=cluster_6.obj, Data2=override_4.MatData, Data3=override_3.MatData)
unit_builder_6 = Python3Script(Obj=cluster_13.obj, Category=list_11, UnitId=graft_2)  # -> out, Log, MatData; inputs Obj: tree, Category: String, UnitId: tree of String; same code as unit_builder
override_6 = Python3Script(Obj=data_3, Key=mockdata_3.okey_2, Value=mockdata_3.ovalue_2)  # -> out, Log, MatData; inputs Obj: tree, Key: tree of String, Value: tree of String, UnitId: tree of String; same code as override
unit_builder_7 = Python3Script(Obj=merge_9, Category=list_12, UnitId=graft_2)  # -> out, Log, MatData; inputs Obj: tree, Category: String, UnitId: tree of String; same code as unit_builder
assembly_2 = Python3Script(MatData=unit_builder_3.MatData, Name="looseTrimAssembly", Role="looseTrimRole")  # -> out, Log, MatDataOut; inputs MatData: tree, Name: tree of String, KeySuffix: String, Key: tree of String, Value: tree of String, UnitId: tree of String; same code as assembly
list_13 = ValueList({"Vertical", "Horizontal", "Fitting", "Panel", "Glass", "Mullion", "Transom", "Bracket", "Accessory", "Fastener", "Bolt", "Screw"}, selected="Panel")
list_14 = ValueList({"Vertical", "Horizontal", "Fitting", "Panel", "Glass", "Mullion", "Transom", "Bracket", "Accessory", "Fastener", "Bolt", "Screw"}, selected="Horizontal")
list_15 = ValueList({"Vertical", "Horizontal", "Fitting", "Panel", "Glass", "Mullion", "Transom", "Bracket", "Accessory", "Fastener", "Bolt", "Screw"}, selected="Horizontal")
list_16 = ValueList({"Vertical", "Horizontal", "Fitting", "Panel", "Glass", "Mullion", "Transom", "Bracket", "Accessory", "Fastener", "Bolt", "Screw"}, selected="Vertical")
list_17 = ValueList({"Vertical", "Horizontal", "Fitting", "Panel", "Glass", "Mullion", "Transom", "Bracket", "Accessory", "Fastener", "Bolt", "Screw"}, selected="Bracket")
list_18 = ValueList({"Vertical", "Horizontal", "Fitting", "Panel", "Glass", "Mullion", "Transom", "Bracket", "Accessory", "Fastener", "Bolt", "Screw"}, selected="Bracket")
list_19 = ValueList({"Unit": "UNIT", "Non Unit": "NON_UNIT"}, selected="Non Unit")
list_20 = ValueList({"Unit": "UNIT", "Non Unit": "NON_UNIT"}, selected="Non Unit")
override_7 = Python3Script(Obj=data_5, Key=mockdata_4.okey_2, Value=mockdata_4.ovalue_2, UnitId=graft_2)  # -> out, Log, MatData; inputs Obj: tree, Key: tree of String, Value: tree of String, UnitId: tree of String; same code as override
item_2 = ListItem(List=flatten(override_7.MatData), Index=0, Wrap=True)
override_8 = Python3Script(Obj=data_6, Key=mockdata_5.okey_2, Value=mockdata_5.ovalue_2, UnitId=graft_2)  # -> out, Log, MatData; inputs Obj: tree, Key: tree of String, Value: tree of String, UnitId: tree of String; same code as override
override_9 = Python3Script(Obj=data_4, Key=mockdata_6.okey_2, Value=mockdata_6.ovalue_2, UnitId=graft_2)  # -> out, Log, MatData; inputs Obj: tree, Key: tree of String, Value: tree of String, UnitId: tree of String; same code as override
list_21 = ValueList({"Vertical", "Horizontal", "Fitting", "Panel", "Glass", "Mullion", "Transom", "Bracket", "Accessory", "Fastener", "Bolt", "Screw"}, selected="Fastener")
override_10 = Python3Script(Obj=data_8, Key=mockdata_8.okey_2, Value=mockdata_8.ovalue_2, UnitId=graft_2)  # -> out, Log, MatData; inputs Obj: tree, Key: tree of String, Value: tree of String, UnitId: tree of String; same code as override
override_11 = Python3Script(Obj=data_7, Key=mockdata_7.okey_2, Value=mockdata_7.ovalue_2, UnitId=graft_2)  # -> out, Log, MatData; inputs Obj: tree, Key: tree of String, Value: tree of String, UnitId: tree of String; same code as override
list_22 = ValueList({"Unit": "UNIT", "Non Unit": "NON_UNIT"}, selected="Non Unit")
merge_11 = Merge(Data1=override_6.MatData, Data2=cluster_38.obj)
nonunit_builder_2 = Python3Script(Obj=merge_10, Category=list_14)  # -> out, Log, MatData; inputs Obj: tree, Category: String; same code as nonunit_builder
nonunit_builder_3 = Python3Script(Obj=override_5.MatData, Category=list_13)  # -> out, Log, MatData; inputs Obj: tree, Category: String; same code as nonunit_builder
nonunit_builder_4 = Python3Script(Obj=merge, Category=list_16)  # -> out, Log, MatData; inputs Obj: tree, Category: String; same code as nonunit_builder
nonunit_builder_5 = Python3Script(Obj=merge_2, Category=list_15)  # -> out, Log, MatData; inputs Obj: tree, Category: String; same code as nonunit_builder
merge_12 = Merge(Data1=assembly_2.MatDataOut, Data2=unit_builder_7.MatData, Data3=unit_builder_6.MatData)
bulk_builder_4 = Python3Script(Obj=cluster_50.obj, Category=list_17, Scope=list_19)  # -> out, Log, MatData; inputs Obj: tree, Category: String, Scope: String, UnitId: tree of String; same code as bulk_builder
bulk_builder_5 = Python3Script(Obj=cluster_51.obj, Category=list_18, Scope=list_20)  # -> out, Log, MatData; inputs Obj: tree, Category: String, Scope: String, UnitId: tree of String; same code as bulk_builder
bulk_builder_6 = Python3Script(Obj=merge_11, Category=list_21, Scope=list_22)  # -> out, Log, MatData; inputs Obj: tree, Category: String, Scope: String, UnitId: tree of String; same code as bulk_builder
merge_13 = Merge(
    Data1=override_7.MatData,
    Data2=override_9.MatData,
    Data3=override_8.MatData,
    Data4=group_4.MatData,
    Data5=group_9.MatData,
    Data6=group_6.MatData,
    Data7=group_7.MatData,
    Data8=group_8.MatData)
panel_15 = Panel("""測試spread_1
測試spread_2""")
panel_16 = Panel("""trimAssembly_OverrideTest_3
trimAssembly_OverrideTest_4""")
assembly_3 = Python3Script(MatData=context_builder_2.MatData, Name="EmbeddedPart_Group", Role="EmbeddedPart")  # -> out, Log, MatDataOut; inputs MatData: tree, Name: tree of String, KeySuffix: String, Key: tree of String, Value: tree of String, UnitId: tree of String; same code as assembly
assembly_4 = Python3Script(
    MatData=context_builder.MatData,
    Name="UnderBeam_Group",
    Role="underBeam",
    Key="underBeam_OverrideTest_1",
    Value="underBeam_test_1")  # -> out, Log, MatDataOut; inputs MatData: tree, Name: tree of String, KeySuffix: String, Key: tree of String, Value: tree of String, UnitId: tree of String; same code as assembly
merge_14 = Merge(
    Data1=cluster_47.obj,
    Data2=cluster_25.obj,
    Data3=cluster_28.obj,
    Data4=override_11.MatData,
    Data5=override_10.MatData,
    Data6=cluster_19.obj,
    Data7=cluster_14.obj)
panel_17 = Panel("""innerBalconyAssembly_OverrideTest_1
innerBalconyAssembly_OverrideTest_2""")
panel_18 = Panel("""innerBalconyLaa_1
innerBalconyLaa_2""")
merge_15 = Merge(Data1=nonunit_builder_4.MatData, Data2=nonunit_builder_5.MatData, Data3=nonunit_builder_3.MatData)
list_23 = ValueList({"Vertical", "Horizontal", "Fitting", "Panel", "Glass", "Mullion", "Transom", "Bracket", "Accessory", "Fastener", "Bolt", "Screw"}, selected="Vertical")
list_24 = ValueList({"Vertical", "Horizontal", "Fitting", "Panel", "Glass", "Mullion", "Transom", "Bracket", "Accessory", "Fastener", "Bolt", "Screw"}, selected="Horizontal")
assembly_5 = Python3Script(MatData=merge_12, Name="trimAssembly", Role="trimRole", Key=panel_16, Value=panel_15)  # -> out, Log, MatDataOut; inputs MatData: tree, Name: tree of String, KeySuffix: String, Key: tree of String, Value: tree of String, UnitId: tree of String; same code as assembly
merge_16 = Merge(Data1=assembly_4.MatDataOut, Data2=assembly_3.MatDataOut)
unit_builder_8 = Python3Script(Obj=merge_13, Category=list_23, UnitId=graft_2)  # -> out, Log, MatData; inputs Obj: tree, Category: String, UnitId: tree of String; same code as unit_builder
unit_builder_9 = Python3Script(Obj=merge_14, Category=list_24, UnitId=graft_2)  # -> out, Log, MatData; inputs Obj: tree, Category: String, UnitId: tree of String; same code as unit_builder
assembly_6 = Python3Script(MatData=merge_15, Name="InnerBalconyAssembly", Role="InnerBalconyRole", Key=panel_17, Value=panel_18)  # -> out, Log, MatDataOut; inputs MatData: tree, Name: tree of String, KeySuffix: String, Key: tree of String, Value: tree of String, UnitId: tree of String; same code as assembly
panel_19 = Panel(merge_15)
trimbranch = TrimBranch(data_tree=assembly_6.MatDataOut, level_input="1")  # -> out, result; inputs data_tree: tree, level_input: Int32; same code as trimbranch
panel_20 = Panel("""frameAssembly_OverrideTest_1
frameAssembly_OverrideTest_2""")
merge_17 = Merge(
    Data1=trimbranch.result,
    Data2=nonunit_builder_2.MatData,
    Data3=bulk_builder_6.MatData,
    Data4=bulk_builder_4.MatData,
    Data5=bulk_builder_5.MatData)
panel_21 = Panel("""balconyAssembly_OverrideTest_1
balconyAssembly_OverrideTest_2""")
panel_22 = Panel("""balconyLaa_1
balconyLaa_2""")
merge_18 = Merge(Data1=unit_builder_8.MatData, Data2=unit_builder_9.MatData, Data3=unit_builder_2.MatData)
mockassemblydata = MockAssemblyData(T=merge_18, key=panel_20, value="測試_")  # -> simplify(key_4), simplify(value_4)
assembly_7 = Python3Script(MatData=merge_17, Name="BalconyAssembly", Role="BalconyRole", Key=panel_21, Value=panel_22)  # -> out, Log, MatDataOut; inputs MatData: tree, Name: tree of String, KeySuffix: String, Key: tree of String, Value: tree of String, UnitId: tree of String; same code as assembly
key = Data(mockassemblydata.key_4)
value = Data(mockassemblydata.value_4)
assembly_8 = Python3Script(MatData=merge_18, Name="frameAssembly", Role="frameRole", Key=key, Value=value)  # -> out, Log, MatDataOut; inputs MatData: tree, Name: tree of String, KeySuffix: String, Key: tree of String, Value: tree of String, UnitId: tree of String; same code as assembly
trimbranch_2 = TrimBranch(data_tree=assembly_7.MatDataOut, level_input="1")  # -> out, result; inputs data_tree: tree, level_input: Int32; same code as trimbranch
series = Series(Start=Slider(0, range=0..10), Step=1, Count=10)  # -> graft(Series)
py3 = Python3Script(MatData=assembly_8.MatDataOut)  # -> out, Log; inputs MatData: tree
# ---------- py3: Python ----------
from utils.gh_utils import to_branch_dict_any, unwrap_gh

bd, paths = to_branch_dict_any(MatData)

lines = []
for p in paths:
    items = bd.get(p, [])
    n_all = len(items)
    n_meta = 0
    cats = {}
    for it in items:
        r = unwrap_gh(it)
        if isinstance(r, dict):
            cat = r.get("category") or ""
            cats[cat] = cats.get(cat, 0) + 1
            if cat == "__ASSEMBLY_META__":
                n_meta += 1
    lines.append(f"{p} len_all={n_all} meta={n_meta} cats={cats}")

Log = "\n".join(lines)
# ---------- end py3 ----------
dup = DuplicateData(Data=series, Number=Slider(3, range=0..10), Order=True)  # -> flatten(Data)
panel_23 = Panel(py3.Log)
merge_19 = Merge(
    Data1=assembly_8.MatDataOut,
    Data2=assembly_5.MatDataOut,
    Data3=unit_builder_4.MatData,
    Data4=unit_builder_5.MatData,
    Data5=bulk_builder_2.MatData,
    Data6=bulk_builder_3.MatData)
tstat = TreeStatistics(Tree=merge_19)  # -> Paths, Length, Count
short = ShortestList(ListA=tstat.Paths, ListB=dup, TrimMode=2)  # -> ListA, ListB
panel_24 = Panel("""BayNo
Level
InstallSequence""")
concat = Concatenate(FragmentA="Bay ", FragmentB=short.ListB)  # -> simplify(graft(Result))
series_2 = Series(Start="1", Step=1, Count=tstat.Count)  # -> simplify(graft(Series))
dup_2 = DuplicateData(Data=Slider(3, range=0..10), Number=tstat.Count, Order=True)  # -> simplify(graft(Data))
installsequence = Data(series_2)
bayno = Data(concat)
level = Data(dup_2)
cluster_52 = Cluster_7(T=merge_19, data=panel_24)
merge_20 = Merge(Data1=bayno, Data2=level, Data3=installsequence)
data_9 = Data(simplify(cluster_52))
panel_25 = Panel("""ContextAssembly_OverrideTest_1
ContextAssembly_OverrideTest_2""")
panel_26 = Panel("""ContextAssembly_test_1
ContextAssembly_test_2""")
panel_27 = Panel("""nonUnitAssembly_OverrideTest_1
nonUnitAssembly_OverrideTest_2""")
panel_28 = Panel("""nonUnit_assembly_test_1
nonUnit_assembly_test_2""")

# ----
# main assembly
assembly_9 = Python3Script(MatData=merge_16, Name="Context_Group", Role="Context_components", Key=panel_25, Value=panel_26)  # -> out, Log, MatDataOut; inputs MatData: tree, Name: tree of String, KeySuffix: String, Key: tree of String, Value: tree of String, UnitId: tree of String; same code as assembly

# ----
# main assembly
assembly_10 = Python3Script(MatData=merge_19, Name=graft_2, Role="unit_components", Key=data_9, Value=merge_20)  # -> out, Log, MatDataOut; inputs MatData: tree, Name: tree of String, KeySuffix: String, Key: tree of String, Value: tree of String, UnitId: tree of String; same code as assembly

# ----
# main assembly
assembly_11 = Python3Script(MatData=trimbranch_2.result, Name="NON_UNIT", Role="nonUnit_components", Key=panel_27, Value=panel_28)  # -> out, Log, MatDataOut; inputs MatData: tree, Name: tree of String, KeySuffix: String, Key: tree of String, Value: tree of String, UnitId: tree of String; same code as assembly

entwine = Entwine(Branch0X=assembly_10.MatDataOut, Branch1X=assembly_11.MatDataOut, Branch2X=assembly_9.MatDataOut, FlattenInputs=False)
py3_2 = Python3Script()  # -> main_path
# ---------- py3_2: Python ----------
import os
gh_doc = ghenv.Component.OnPingDocument()

main_path = os.path.dirname(gh_doc.FilePath)
# ---------- end py3_2 ----------
concat_2 = Concatenate(FragmentA=py3_2, FragmentC="\ifc_test_file\N03F_fixed.ifc")

# ----
# import mode
exporter = Python3Script(MatData=entwine, StoreyName="N02F", StoreyElev=Slider(9, range=0..100), OutPath=concat_2, Run=Toggle(False))  # -> out, OK, Log; inputs MatData: tree, StoreyName: String, StoreyElev: Double, OutPath: String, Run: Boolean
# ---------- exporter: Python ----------
import sys, os, importlib

# Rhino/GH 裡通常能拿到目前 .gh 的路徑
import Grasshopper as gh
ghdoc_path = gh.Instances.ActiveCanvas.Document.FilePath  # 可能是空字串（未存檔）
if not ghdoc_path:
    raise Exception("GH document not saved yet. Save .gh first to use relative module path.")

proj_dir = os.path.dirname(ghdoc_path)
module_dir = os.path.join(proj_dir, "py_modules")

if module_dir not in sys.path:
    sys.path.append(module_dir)

def reload_pkg(prefix: str):
    # reload children first (reverse length order)
    mods = [m for name, m in sys.modules.items() if name == prefix or name.startswith(prefix + ".")]
    mods.sort(key=lambda m: len(m.__name__), reverse=True)
    for m in mods:
        importlib.reload(m)

# 先 import utils（確保從 py_modules 來）
import utils

# (可選) 確認你抓到的是哪個 utils，避免載到別份
# import utils.gh_utils as gu
# print("utils path =", gu.__file__)

# reload utils 及其已載入子模組
reload_pkg("utils")

import ifc_exporter
importlib.reload(ifc_exporter) #development mode

OK, Log, ResolvedOutPath = ifc_exporter.export_ifc_from_matdata(
    Run,
    MatData,
    StoreyName,
    StoreyElev,
    OutPath
)
# ---------- end exporter ----------

panel_29 = Panel(exporter.Log)

# ==== cluster Cluster
mode = ClusterInput()
name = ClusterInput()
data = ClusterInput()
mode_2 = Number(mode)
name_2 = Text(name)
filterdata = FilterData(data=simplify(data), mode=mode_2, filter=name_2)  # -> object_3, bool_2
clean = CleanTree(RemoveNulls=True, RemoveInvalid=True, RemoveEmpty=invert(False), Tree=filterdata.object_3)
lng = ListLength(List=flatten(clean))
rep = ReplaceText(Text=name_2, Find=" ", RecursiveReplace=False)
repeat = RepeatData(Data=rep, Length=lng)
unflatten = UnflattenTree(Tree=repeat, Guide=clean)  # -> graft(Tree)
unflatten_2 = UnflattenTree(Tree=clean, Guide=unflatten)
trimbranch = TrimBranch(tree=unflatten_2, level="1")  # -> result; inputs tree: tree, level: Int32
# ---------- trimbranch: Python ----------
from Grasshopper import DataTree
from Grasshopper.Kernel.Data import GH_Path
from Grasshopper.Kernel import GH_RuntimeMessageLevel

if tree is None or level is None or tree.DataCount==0:
    ghenv.Component.AddRuntimeMessage(
        GH_RuntimeMessageLevel.Warning,
        "data is empty"
    )

def integrate_branches(data_tree, level):
    new_tree = DataTree[object]()
    
    # 遍歷數據樹的每個分支
    for i in range(data_tree.BranchCount):
        path = data_tree.Path(i)  # 取得當前分支的路徑
        items = data_tree.Branch(i)  # 取得當前分支的數據
        
        # 根據指定層級截取路徑
        new_path_indices = [path[j] for j in range(level) if j < path.Length]
        new_path = GH_Path(new_path_indices)
        
        # 將數據添加到新的分支
        for item in items:
            new_tree.Add(item, new_path)
    
    return new_tree

# 輸入參數
# data_tree: 數據樹
# level_input: 整數，表示保留的層級數
result = integrate_branches(tree, level)
# ---------- end trimbranch ----------
trimbranch_2 = TrimBranch(tree=unflatten, level="1")  # -> result; inputs tree: tree, level: Int32; same code as trimbranch
geo = Geometry(trimbranch)
py3 = Python3Script(Geo=geo, Guid=trimbranch_2)  # -> out, Obj; inputs Geo: tree of GeometryBase, Guid: tree
# ---------- py3: Python ----------
from Grasshopper.Kernel.Types import GH_ObjectWrapper
from Grasshopper import DataTree
from Grasshopper.Kernel.Data import GH_Path

Obj = DataTree[object]()

for bi in range(Geo.BranchCount):
    path = Geo.Path(bi)
    geos = list(Geo.Branch(bi))
    guids = list(Guid.Branch(bi))

    if len(geos) != len(guids):
        raise Exception("Geo/Guid count mismatch at path {}".format(path))

    for i in range(len(geos)):
        Obj.Add(GH_ObjectWrapper([geos[i], guids[i]]), path)
# ---------- end py3 ----------
geo_2 = ClusterOutput(geo)
obj = ClusterOutput(py3.Obj)

# ==== cluster Cluster_3
py3 = Python3Script(x="N01", y=ColourSwatch(SwatchColor=RGB(158, 98, 109)))  # -> a; inputs y: Color
# ---------- py3: Python ----------
colorDict = {x:y}

class data:
    pass

d = data()
d.colorDict = colorDict

a = d
# ---------- end py3 ----------
py3_2 = Python3Script(x="N02", y=ColourSwatch(SwatchColor=RGB(158, 98, 109)))  # -> a; inputs y: Color; same code as py3
py3_3 = Python3Script(x="N87", y=ColourSwatch(SwatchColor=RGB(191, 64, 255)))  # -> a; inputs y: Color; same code as py3
py3_4 = Python3Script(x="N85", y=ColourSwatch(SwatchColor=RGB(140, 91, 0)))  # -> a; inputs y: Color; same code as py3
py3_5 = Python3Script(x="N84", y=ColourSwatch(SwatchColor=RGB(140, 91, 0)))  # -> a; inputs y: Color; same code as py3
py3_6 = Python3Script(x="N15", y=ColourSwatch(SwatchColor=RGB(224, 146, 0)))  # -> a; inputs y: Color; same code as py3
py3_7 = Python3Script(x="N64", y=ColourSwatch(SwatchColor=RGB(39, 105, 227)))  # -> a; inputs y: Color; same code as py3
py3_8 = Python3Script(x="N86", y=ColourSwatch(SwatchColor=RGB(49, 107, 214)))  # -> a; inputs y: Color; same code as py3
py3_9 = Python3Script(x="N53", y=ColourSwatch(SwatchColor=RGB(73, 122, 214)))  # -> a; inputs y: Color; same code as py3
py3_10 = Python3Script(x="N69", y=ColourSwatch(SwatchColor=RGB(102, 138, 204)))  # -> a; inputs y: Color; same code as py3
py3_11 = Python3Script(x="N69_down", y=ColourSwatch(SwatchColor=RGB(102, 138, 204)))  # -> a; inputs y: Color; same code as py3
py3_12 = Python3Script(x="S04", y=ColourSwatch(SwatchColor=RGB(0, 225, 255)))  # -> a; inputs y: Color; same code as py3
py3_13 = Python3Script(x="N71", y=ColourSwatch(SwatchColor=RGB(102, 185, 204)))  # -> a; inputs y: Color; same code as py3
py3_14 = Python3Script(x="AL02", y=ColourSwatch(SwatchColor=RGB(166, 161, 161)))  # -> a; inputs y: Color; same code as py3
py3_15 = Python3Script(x="AL02_1", y=ColourSwatch(SwatchColor=RGB(166, 161, 161)))  # -> a; inputs y: Color; same code as py3
py3_16 = Python3Script(x="AL02_2", y=ColourSwatch(SwatchColor=RGB(166, 161, 161)))  # -> a; inputs y: Color; same code as py3
py3_17 = Python3Script(x="角鋁", y=ColourSwatch(SwatchColor=RGB(133, 169, 255)))  # -> a; inputs y: Color; same code as py3
py3_18 = Python3Script(x="角鋁1", y=ColourSwatch(SwatchColor=RGB(133, 169, 255)))  # -> a; inputs y: Color; same code as py3
py3_19 = Python3Script(x="角鋁2", y=ColourSwatch(SwatchColor=RGB(133, 169, 255)))  # -> a; inputs y: Color; same code as py3
py3_20 = Python3Script(x="角鋁3", y=ColourSwatch(SwatchColor=RGB(133, 169, 255)))  # -> a; inputs y: Color; same code as py3
py3_21 = Python3Script(x="N78", y=ColourSwatch(SwatchColor=RGB(87, 207, 155)))  # -> a; inputs y: Color; same code as py3
py3_22 = Python3Script(x="N07", y=ColourSwatch(SwatchColor=RGB(83, 94, 115)))  # -> a; inputs y: Color; same code as py3
py3_23 = Python3Script(x="N09", y=ColourSwatch(SwatchColor=RGB(255, 128, 219)))  # -> a; inputs y: Color; same code as py3
py3_24 = Python3Script(x="N08", y=ColourSwatch(SwatchColor=RGB(101, 103, 235)))  # -> a; inputs y: Color; same code as py3
py3_25 = Python3Script(x="AluBlock", y=ColourSwatch(SwatchColor=RGB(196, 196, 196)))  # -> a; inputs y: Color; same code as py3
py3_26 = Python3Script(x="N65", y=ColourSwatch(SwatchColor=RGB(155, 157, 232)))  # -> a; inputs y: Color; same code as py3
py3_27 = Python3Script(x="S02", y=ColourSwatch(SwatchColor=RGB(128, 255, 191)))  # -> a; inputs y: Color; same code as py3
py3_28 = Python3Script(x="S02_1", y=ColourSwatch(SwatchColor=RGB(128, 255, 191)))  # -> a; inputs y: Color; same code as py3
py3_29 = Python3Script(x="N35", y=ColourSwatch(SwatchColor=RGB(177, 155, 232)))  # -> a; inputs y: Color; same code as py3
py3_30 = Python3Script(x="N32", y=ColourSwatch(SwatchColor=RGB(24, 150, 87)))  # -> a; inputs y: Color; same code as py3
py3_31 = Python3Script(x="N20", y=ColourSwatch(SwatchColor=RGB(79, 199, 255)))  # -> a; inputs y: Color; same code as py3
py3_32 = Python3Script(x="N20_down", y=ColourSwatch(SwatchColor=RGB(79, 199, 255)))  # -> a; inputs y: Color; same code as py3
py3_33 = Python3Script(x="N20_up", y=ColourSwatch(SwatchColor=RGB(79, 199, 255)))  # -> a; inputs y: Color; same code as py3
py3_34 = Python3Script(x="N19", y=ColourSwatch(SwatchColor=RGB(142, 159, 189)))  # -> a; inputs y: Color; same code as py3
py3_35 = Python3Script(x="F10", y=ColourSwatch(SwatchColor=RGB(232, 74, 206)))  # -> a; inputs y: Color; same code as py3
py3_36 = Python3Script(x="N76", y=ColourSwatch(SwatchColor=RGB(0, 128, 21)))  # -> a; inputs y: Color; same code as py3
py3_37 = Python3Script(x="S07", y=ColourSwatch(SwatchColor=RGB(255, 142, 128)))  # -> a; inputs y: Color; same code as py3
py3_38 = Python3Script(x="SSL", y=ColourSwatch(SwatchColor=RGB(255, 185, 87)))  # -> a; inputs y: Color; same code as py3
py3_39 = Python3Script(x="SSL_2", y=ColourSwatch(SwatchColor=RGB(255, 185, 87)))  # -> a; inputs y: Color; same code as py3
py3_40 = Python3Script(x="F10", y=ColourSwatch(SwatchColor=RGB(255, 41, 194)))  # -> a; inputs y: Color; same code as py3
py3_41 = Python3Script(x="F19", y=ColourSwatch(SwatchColor=RGB(87, 235, 255)))  # -> a; inputs y: Color; same code as py3
py3_42 = Python3Script(x="N66", y=ColourSwatch(SwatchColor=RGB(115, 178, 66)))  # -> a; inputs y: Color; same code as py3
py3_43 = Python3Script(x="N67", y=ColourSwatch(SwatchColor=RGB(115, 178, 66)))  # -> a; inputs y: Color; same code as py3
py3_44 = Python3Script(x="N68", y=ColourSwatch(SwatchColor=RGB(115, 178, 66)))  # -> a; inputs y: Color; same code as py3
py3_45 = Python3Script(x="N28", y=ColourSwatch(SwatchColor=RGB(115, 178, 66)))  # -> a; inputs y: Color; same code as py3
py3_46 = Python3Script(x="N77", y=ColourSwatch(SwatchColor=RGB(115, 178, 66)))  # -> a; inputs y: Color; same code as py3
py3_47 = Python3Script(x="N66", y=ColourSwatch(SwatchColor=RGB(115, 178, 66)))  # -> a; inputs y: Color; same code as py3
py3_48 = Python3Script(x="N79a", y=ColourSwatch(SwatchColor=RGB(115, 178, 66)))  # -> a; inputs y: Color; same code as py3
py3_49 = Python3Script(x="N79", y=ColourSwatch(SwatchColor=RGB(115, 178, 66)))  # -> a; inputs y: Color; same code as py3
py3_50 = Python3Script(x="N29", y=ColourSwatch(SwatchColor=RGB(115, 178, 66)))  # -> a; inputs y: Color; same code as py3
py3_51 = Python3Script(x="AL01", y=ColourSwatch(SwatchColor=RGB(117, 117, 117)))  # -> a; inputs y: Color; same code as py3
py3_52 = Python3Script(x="AL01_sm", y=ColourSwatch(SwatchColor=RGB(117, 117, 117)))  # -> a; inputs y: Color; same code as py3
py3_53 = Python3Script(x="N56", y=ColourSwatch(SwatchColor=RGB(0, 255, 0)))  # -> a; inputs y: Color; same code as py3
py3_54 = Python3Script(x="N60", y=ColourSwatch(SwatchColor=RGB(255, 128, 0)))  # -> a; inputs y: Color; same code as py3
py3_55 = Python3Script(x="F20", y=ColourSwatch(SwatchColor=RGB(191, 63, 63)))  # -> a; inputs y: Color; same code as py3
py3_56 = Python3Script(x="N59", y=ColourSwatch(SwatchColor=RGB(0, 128, 0)))  # -> a; inputs y: Color; same code as py3
py3_57 = Python3Script(x="F24", y=ColourSwatch(SwatchColor=RGB(63, 191, 127)))  # -> a; inputs y: Color; same code as py3
py3_58 = Python3Script(x="N58", y=ColourSwatch(SwatchColor=RGB(128, 255, 0)))  # -> a; inputs y: Color; same code as py3
py3_59 = Python3Script(x="F22", y=ColourSwatch(SwatchColor=RGB(252, 83, 83)))  # -> a; inputs y: Color; same code as py3
py3_60 = Python3Script(x="S09", y=ColourSwatch(SwatchColor=RGB(252, 154, 83)))  # -> a; inputs y: Color; same code as py3
py3_61 = Python3Script(x="S06", y=ColourSwatch(SwatchColor=RGB(252, 207, 83)))  # -> a; inputs y: Color; same code as py3
py3_62 = Python3Script(x="N60", y=ColourSwatch(SwatchColor=RGB(255, 128, 0)))  # -> a; inputs y: Color; same code as py3
py3_63 = Python3Script(x="S08", y=ColourSwatch(SwatchColor=RGB(252, 207, 83)))  # -> a; inputs y: Color; same code as py3
py3_64 = Python3Script(x="S01", y=ColourSwatch(SwatchColor=RGB(207, 165, 50)))  # -> a; inputs y: Color; same code as py3
py3_65 = Python3Script(x="AL01_飾條", y=ColourSwatch(SwatchColor=RGB(178, 178, 178)))  # -> a; inputs y: Color; same code as py3
py3_66 = Python3Script(x="F11", y=ColourSwatch(SwatchColor=RGB(191, 63, 63)))  # -> a; inputs y: Color; same code as py3
py3_67 = Python3Script(x="N66up", y=ColourSwatch(SwatchColor=RGB(115, 178, 66)))  # -> a; inputs y: Color; same code as py3
py3_68 = Python3Script(x="N66dn", y=ColourSwatch(SwatchColor=RGB(115, 178, 66)))  # -> a; inputs y: Color; same code as py3
py3_69 = Python3Script(x="L_25x25x3", y=ColourSwatch(SwatchColor=RGB(255, 149, 0)))  # -> a; inputs y: Color; same code as py3
py3_70 = Python3Script(x="N67_bridge", y=ColourSwatch(SwatchColor=RGB(115, 178, 66)))  # -> a; inputs y: Color; same code as py3
py3_71 = Python3Script(x="N68_bridge", y=ColourSwatch(SwatchColor=RGB(115, 178, 66)))  # -> a; inputs y: Color; same code as py3
merge = Merge(
    Data1=py3,
    Data2=py3_2,
    Data3=py3_3,
    Data4=py3_4,
    Data5=py3_5,
    Data6=py3_6,
    Data7=py3_7,
    Data8=py3_8,
    Data9=py3_9,
    Data10=py3_10,
    Data11=py3_11,
    Data12=py3_12,
    Data13=py3_13,
    Data14=py3_14,
    Data15=py3_15,
    Data16=py3_16,
    Data17=py3_17,
    Data18=py3_18,
    Data19=py3_19,
    Data20=py3_20,
    Data21=py3_21,
    Data22=py3_22,
    Data23=py3_23,
    Data24=py3_24,
    Data25=py3_25,
    Data26=py3_26,
    Data27=py3_27,
    Data28=py3_28,
    Data29=py3_29,
    Data30=py3_30,
    Data31=py3_31,
    Data32=py3_32,
    Data33=py3_33,
    Data34=py3_34,
    Data35=py3_35,
    Data36=py3_36,
    Data37=py3_37,
    Data38=py3_38,
    Data39=py3_39,
    Data40=py3_40,
    Data41=py3_41,
    Data42=py3_42,
    Data43=py3_43,
    Data44=py3_44,
    Data45=py3_45,
    Data46=py3_46,
    Data47=py3_47,
    Data48=py3_48,
    Data49=py3_49,
    Data50=py3_50,
    Data51=py3_51,
    Data52=py3_54,
    Data53=py3_55,
    Data54=py3_66,
    Data55=py3_56,
    Data56=py3_57,
    Data57=py3_62,
    Data58=py3_58,
    Data59=py3_53,
    Data60=py3_59,
    Data61=py3_60,
    Data62=py3_63,
    Data63=py3_61,
    Data64=py3_64,
    Data65=py3_52,
    Data66=py3_65,
    Data67=py3_67,
    Data68=py3_68,
    Data69=py3_70,
    Data70=py3_71,
    Data71=py3_69)
py3_72 = Python3Script(x=merge)  # -> a, b; inputs x: list
# ---------- py3_72: Python ----------
import ghpythonlib.treehelpers as th
wholeDict = {}
b = []
for i in x:
    wholeDict.update(i.colorDict)
    for key in i.colorDict.keys():
        b.append([key, i.colorDict[key]])
    

class data:
    pass

d = data()
d.data = wholeDict
a = d

b = th.list_to_tree(b)
# ---------- end py3_72 ----------
layername = ClusterInput()
layers = QueryModelLayers(AutoUpdateState=True)
item = ListItem(List=py3_72.b, Index=0, Wrap=True)  # -> Item, Item1
layername_2 = Text(layername)
idata = ClusterInput()
layer = ModelLayer(Layer=layers)  # -> Layer, Name, Hidden, Locked, DisplayColour, Material, Linetype
split = TextSplit(Text=item.Item1, Separators=",")
panel = Panel("##_Kevin::")
py3_73 = Python3Script(iData=idata, colorData=py3_72.a)  # -> out, dataGeo, graft(dataName), graft(colorList)
# ---------- py3_73: Python ----------
import System.Drawing as sd

dataGeo = iData.geo
dataName = iData.names

colorDict = colorData.data
rgb = [0, 0, 0]  # 黑色
black = sd.Color.FromArgb(rgb[0], rgb[1], rgb[2])

colorList = []
for name in dataName:
    if name in colorDict:
        colorList.append(colorDict[name])
    else:
        print(name)
        colorList.append(black)
# ---------- end py3_73 ----------
item_2 = ListItem(List=split, Index=0, Wrap=True)  # -> Item, Item1, Item2
watchbranch = WatchBranch(alldata=py3_73.dataGeo)  # -> seedata_2, path_2
split_2 = TextSplit(Text=layer.DisplayColour, Separators=",")
concat = Concatenate(FragmentA=layername_2, FragmentB=py3_73.dataName)
item_3 = ListItem(List=split_2, Index=0, Wrap=True)  # -> Item, Item1, Item2
cluster = Cluster_2(object=py3_73.dataGeo)
layer_2 = ModelLayer(Layer=concat, DisplayColour=py3_73.colorList)
panel_2 = Panel(py3_73.out)
panel_3 = Panel(item_3.Item2)
object = ModelObject(Object=cluster, Name=py3_73.dataName, Layer=layer_2)
object_2 = ModelObject(object)
object_3 = ClusterOutput(object_2)

# ==== cluster Cluster_4
B = ClusterInput()
debrep = DeconstructBrep(Brep=B)  # -> Faces, Edges, Vertices
area = Area(Geometry=debrep.Faces)
pdecon = Deconstruct(Point=area)  # -> XComponent, YComponent, ZComponent
sort = SortList(Keys=pdecon.ZComponent, ValuesA=debrep.Faces)  # -> Keys, ValuesA
item = ListItem(List=sort.ValuesA, Index=0, Wrap=True)  # -> Item1, Item
merge = Merge(Data1=item.Item, Data2=item.Item1)
area_2 = Area(Geometry=merge)
item_2 = ListItem(List=area_2, Index=0, Wrap=True)  # -> Item, Item1
xy = XYPlane(Origin=item_2.Item)
project = Project(Geometry=item_2.Item1, Plane=xy)  # -> Geometry, Transform
vec2pt = Vector2Pt(PointA=item_2.Item, PointB=project.Geometry, Unitize=False)  # -> Vector, Length
pl = PlaneNormal(Origin=item_2.Item, ZAxis=vec2pt.Vector)
cp = PlaneClosestPoint(Point=area, Plane=pl)  # -> Point, UVPoint, Distance
yaxistoz = YAxisToZ(P=pl)
sort_2 = SortList(Keys=cp.Distance, ValuesA=debrep.Faces)  # -> Keys, ValuesA
item_3 = ListItem(List=reverse(sort_2.ValuesA), Index=0, Wrap=True)
edges = BrepEdges(Brep=item_3)  # -> Naked, Interior, NonManifold
midpt = CurveMiddle(Curve=edges.Naked)
pdecon_2 = Deconstruct(Point=midpt)  # -> XComponent, YComponent, ZComponent
sort_3 = SortList(Keys=pdecon_2.ZComponent, ValuesA=edges.Naked)  # -> Keys, ValuesA
item_4 = ListItem(List=sort_3.ValuesA, Index=0, Wrap=True)
Z = UnitZ(Factor="-11.3")
move = Move(Geometry=item_4, Motion=Z)  # -> Geometry, Transform
midpt_2 = CurveMiddle(Curve=move.Geometry)
pl_origin = PlaneOrigin(Base=yaxistoz, Origin=midpt_2)
number_slider = Slider(748, range=0..1000)
pln = Plane(pl_origin)
deplane = DeconstructPlane(Plane=pln)  # -> Origin, XAxis, YAxis, ZAxis
plnaxis = PlaneAxis(P=pln, B=35)
neg = Negative(Value=deplane.XAxis)
pln_2 = ClusterOutput(pln)
amp = Amplitude(Vector=neg, Amplitude=number_slider)
amp_2 = Amplitude(Vector=deplane.XAxis, Amplitude=number_slider)
move_2 = Move(Geometry=deplane.Origin, Motion=amp)  # -> Geometry, Transform
move_3 = Move(Geometry=deplane.Origin, Motion=amp_2)  # -> Geometry, Transform
ln = Line(StartPoint=move_3.Geometry, EndPoint=move_2.Geometry)
flip = FlipCurve(Curve=move.Geometry, Guide=ln)  # -> Curve, Flag
crv = Curve(flip.Curve)
crv_2 = ClusterOutput(crv)

# ==== cluster Cluster1
object = ClusterInput()
crv = ClusterInput()
object_2 = ModelObject(object)
crv_2 = Curve(crv)
simplify = SimplifyCurve(Curve=crv_2)  # -> Curve, Simplified
object_3 = ModelObject(Object=object_2)  # -> Object, Layer
split = TextSplit(Text=object_3.Layer, Separators=" :")  # -> simplify(Result)
item = ListItem(List=split, Index=Slider(6, range=0..10), Wrap=True)
shift = ShiftPaths(Data=item, Offset=-1)

# ----
# 這幾樣橫料有機會被判定為直料
# 因此直接提取
panel = Panel("""N20
N20a
N21
N24
---
S02S""")
mindex = MemberIndex(Set=shift, Member=panel)  # -> Index, Count

pshift = ShiftPaths(Data=mindex.Index, Offset=-1)
panel_2 = Panel(pshift)
item_2 = ListItem(List=object_3.Object, Index=pshift, Wrap=False)
cull_i = CullIndex(List=object_3.Object, Indices=pshift, Wrap=False)
pframe = PerpFrame(Curve=reparameterize(simplify.Curve), Parameter=".5")
cluster = Cluster_5(plane=pframe)
pln = Plane(cluster)
plnaxis = PlaneAxis(P=pln, B=35)
bbox = BoundingBox(Content=cull_i, Plane=pln)  # -> Box, Box_2
boxprop = BoxProperties(Box=bbox.Box)  # -> Center, Diagonal, Area, Volume, Degeneracy
cp = PlaneClosestPoint(Point=boxprop.Center, Plane=pln)  # -> Point, UVPoint, Distance
panel_3 = Panel("""-301 TO -5000
-300 TO 300
301 TO 5000""")
item_3 = ListItem(List=panel_3, Index=0, Wrap=True)  # -> Item, Item1, Item2
inc = Includes(Value=cp.Distance, Domain=item_3.Item)  # -> Includes, Deviation
inc_2 = Includes(Value=cp.Distance, Domain=item_3.Item1)  # -> Includes, Deviation
inc_3 = Includes(Value=cp.Distance, Domain=item_3.Item2)  # -> Includes, Deviation
cull = CullPattern(List=cull_i, CullPattern=inc.Includes)  # -> simplify(List)
cull_2 = CullPattern(List=cull_i, CullPattern=inc_2.Includes)  # -> simplify(List)
cull_3 = CullPattern(List=cull_i, CullPattern=inc_3.Includes)  # -> simplify(List)
append_element = AppendElement(Data=simplify(item_2), Index="1")
append_element_2 = AppendElement(Data=cull, Index="0")
append_element_3 = AppendElement(Data=cull_2, Index="1")
append_element_4 = AppendElement(Data=cull_3, Index="2")
merge = Merge(Data1=append_element_2, Data2=append_element_3, Data3=append_element_4, Data4=append_element)
object_4 = ModelObject(simplify(merge))
object_5 = ClusterOutput(object_4)

# ==== cluster MockData
obj = ClusterInput()
key = ClusterInput()
obj_2 = Data(obj)
key_2 = Text(key)
graft = GraftTree(Tree=obj_2, IncludeEmptyLists=True, IncludeNullItems=True)
tstat = TreeStatistics(Tree=graft)  # -> Paths, Length, Count
lng = ListLength(List=key_2)
dup = DuplicateData(Data=key_2, Number=tstat.Count, Order=True)
partition = PartitionList(List=dup, Size=lng)  # -> simplify(Chunks)
lng_2 = ListLength(List=flatten(partition))
series = Series(Start=Slider(0, range=0..1000), Step=1, Count=lng_2)
partition_2 = PartitionList(List=series, Size=lng)  # -> simplify(Chunks)
cluster = Cluster_6(data=partition, T=obj_2)
concat = Concatenate(FragmentA="測試_", FragmentB=partition_2)
cluster_2 = Cluster_6(data=concat, T=obj_2)
okey = Data(cluster)
ovalue = Data(cluster_2)
okey_2 = ClusterOutput(okey)
ovalue_2 = ClusterOutput(ovalue)

# ==== cluster MockAssemblyData
value = ClusterInput()
T = ClusterInput()
key = ClusterInput()
value_2 = Data(value)
tstat = TreeStatistics(Tree=T)  # -> Paths, Length, Count
key_2 = Data(key)
dup = DuplicateData(Data=key_2, Number=tstat.Count, Order=True)
lng = ListLength(List=key_2)
lng_2 = ListLength(List=dup)
series = Series(Start=0, Step=1, Count=lng_2)
partition = PartitionList(List=dup, Size=lng)
partition_2 = PartitionList(List=series, Size=lng)
concat = Concatenate(FragmentA=value_2, FragmentB=partition_2)
value_3 = Data(concat)
key_3 = Data(partition)
value_4 = ClusterOutput(value_3)
key_4 = ClusterOutput(key_3)

# ==== cluster Cluster_7
T = ClusterInput()
data = ClusterInput()
tstat = TreeStatistics(Tree=T)  # -> Paths, Length, Count
data_2 = Data(data)
dup = DuplicateData(Data=data_2, Number=tstat.Count, Order=True)
lng = ListLength(List=data_2)
partition = PartitionList(List=dup, Size=lng)
data_3 = Data(partition)
data_4 = ClusterOutput(data_3)

# ==== cluster Rename
O = ClusterInput()
object = ModelObject(Object=O)  # -> Object, Layer
layer = ModelLayer(Layer=object.Layer)  # -> Layer, Name
object_2 = ModelObject(Object=object.Object, Name=layer.Name)
O_2 = ClusterOutput(object_2)

# ==== cluster FilterData
data = ClusterInput()
mode = ClusterInput()
filter = ClusterInput()
data_2 = ModelObject(data)
mode_2 = Integer(mode)
filter_2 = Data(filter)
object = ModelObject(Object=data_2)  # -> Object, Name, Layer
py3 = Python3Script(x=object.Object)  # -> a
# ---------- py3: Python ----------
if x:
    a = x
else:
    a = 'None'
# ---------- end py3 ----------
py3_2 = Python3Script(x=object.Name)  # -> a; same code as py3
py3_3 = Python3Script(x=object.Layer)  # -> a; same code as py3
matchtext = Python3Script(layerList=py3_3, searchList=filter_2)  # -> out_bool; inputs layerList: list, searchList: list of String
# ---------- matchtext: Python ----------
from ghpythonlib.components import MatchText
from Grasshopper import DataTree
from Grasshopper.Kernel.Data import GH_Path
from Grasshopper.Kernel import GH_RuntimeMessageLevel
from itertools import zip_longest

if layerList is None or searchList is None:
    ghenv.Component.AddRuntimeMessage(
        GH_RuntimeMessageLevel.Warning,
        "data is empty"
    )
else:
    def to_bool_seq(x):
        # 統一轉為「list[bool]」
        # IronPython 的 List 可以直接 list(x)
        if isinstance(x, bool) or x is None:
            return [bool(x)]
        try:
            # 若是 IronPython.Runtime.List、list、tuple 等可迭代
            return [bool(v) for v in list(x)]
        except TypeError:
            # 其他不可迭代的一律包成單一元素
            return [bool(x)]

    nest_bool = []
    for pattern in searchList:
        temp = MatchText(text=layerList, regex=pattern, case=True)
        seq = to_bool_seq(temp)     # 先規範化
        nest_bool.append(seq)

    # 只有一條序列 → 你想要：直接回傳它？還是壓成單一布林？
    # 1) 若要「逐欄結果」就直接複製那條：
    if len(nest_bool) == 1:
        out_bool = list(nest_bool[0])
    else:
        # 多條序列 → 逐欄 OR，長度不齊用 False 補齊
        out_bool = [any(col) for col in zip_longest(*nest_bool, fillvalue=False)]

    # 檢查
    # print(nest_bool)
    # print(out_bool)
# ---------- end matchtext ----------
matchtext_2 = Python3Script(layerList=py3_2, searchList=filter_2)  # -> out_bool; inputs layerList: list, searchList: list of String; same code as matchtext
matchtext_3 = Python3Script(layerList=py3, searchList=filter_2)  # -> out_bool; inputs layerList: list, searchList: list of String; same code as matchtext
tmatch = MatchText(Text=data_2, RegEx=filter_2, Case=True)
or = GateOr(A=tmatch, D=matchtext_3, B=matchtext_2, C=matchtext)
filter_3 = StreamFilter(Gate=mode_2, Stream0=or, Stream1=tmatch, Stream2=matchtext_3, Stream3=matchtext_2, Stream4=matchtext)
dispatch = Dispatch(List=data_2, DispatchPattern=filter_3)  # -> ListA, ListB
object_2 = ModelObject(dispatch.ListA)
bool = Boolean(filter_3)
bool_2 = ClusterOutput(bool)
object_3 = ClusterOutput(object_2)

# ==== cluster WatchBranch
alldata = ClusterInput()
index = ClusterInput()
alldata_2 = Data(alldata)
index_2 = Number(index)
item = ListItem(List=flatten(index_2), Index="0", Wrap=True)
null = NullItem(Item=item)  # -> NullFlags, InvalidFlags, Description
filter = StreamFilter(Gate=null.NullFlags, Stream0=index_2, Stream1="0")
tstat = TreeStatistics(Tree=alldata_2)  # -> Paths, Length, Count
item_2 = ListItem(List=tstat.Paths, Index=filter, Wrap=True)
branch = TreeBranch(Tree=alldata_2, Path=item_2, MaintainPaths=True)
seedata = Data(branch)
path = Data(item_2)
seedata_2 = ClusterOutput(seedata)
path_2 = ClusterOutput(path)

# ==== cluster Cluster_2
object = ClusterInput()
object_2 = ModelObject(simplify(graft(object)))
null = NullItem(Item=object_2)  # -> NullFlags, InvalidFlags, Description
dispatch = Dispatch(List=object_2, DispatchPattern=null.InvalidFlags)  # -> ListA, ListB
shift = ShiftPaths(Data=dispatch.ListB, Offset=-1)
geo = Geometry(dispatch.ListA)
debrep = DeconstructBrep(Brep=geo)  # -> simplify(Faces), Edges, Vertices
null_2 = NullItem(Item=debrep.Faces)  # -> NullFlags, InvalidFlags, Description
dispatch_2 = Dispatch(List=debrep.Faces, DispatchPattern=null_2.InvalidFlags)  # -> ListA, ListB
edges = BrepEdges(Brep=dispatch_2.ListA)  # -> Naked, Interior, NonManifold
clean = CleanTree(RemoveNulls=True, RemoveInvalid=True, RemoveEmpty=invert(False), Tree=edges.Naked)
join = JoinCurves(Curves=clean, Preserve=False)
patch = Patch(Curves=join, Spans=20, Flexibility=1, Trim=True)
trimbranch = TrimBranch(data_tree=patch, level_input="1")  # -> out, result; inputs data_tree: tree, level_input: Int32
# ---------- trimbranch: Python ----------
from Grasshopper import DataTree
from Grasshopper.Kernel.Data import GH_Path
from Grasshopper.Kernel import GH_RuntimeMessageLevel

if data_tree is None or level_input is None:
    ghenv.Component.AddRuntimeMessage(
        GH_RuntimeMessageLevel.Warning,
        "data is empty"
    )

def integrate_branches(data_tree, level):
    new_tree = DataTree[object]()
    
    # 遍歷數據樹的每個分支
    for i in range(data_tree.BranchCount):
        path = data_tree.Path(i)  # 取得當前分支的路徑
        items = data_tree.Branch(i)  # 取得當前分支的數據
        
        # 根據指定層級截取路徑
        new_path_indices = [path[j] for j in range(level) if j < path.Length]
        new_path = GH_Path(new_path_indices)
        
        # 將數據添加到新的分支
        for item in items:
            new_tree.Add(item, new_path)
    
    return new_tree

# 輸入參數
# data_tree: 數據樹
# level_input: 整數，表示保留的層級數
result = integrate_branches(data_tree, level_input)
# ---------- end trimbranch ----------
shift_2 = ShiftPaths(Data=dispatch_2.ListB, Offset=-1)
merge = Merge(Data1=shift_2, Data2=trimbranch.result)
join_2 = BrepJoin(Breps=merge)  # -> Breps, Closed
merge_2 = Merge(Data1=shift, Data2=join_2.Breps)
R = ClusterOutput(merge_2)

# ==== cluster YAxisToZ
P = ClusterInput()
Z = UnitZ(Factor=1)
align = AlignPlane(Plane=P, Direction=Z)  # -> Plane, Angle
prot = RotatePlane(Plane=align.Plane, Angle=degrees("270"))
P_2 = ClusterOutput(prot)

# ==== cluster PlaneAxis: show plane X Y Z axis.
P = ClusterInput()
B = ClusterInput()
deplane = DeconstructPlane(Plane=graft(P))  # -> Origin, XAxis, YAxis, ZAxis
multiplication = Multiplication(A=[deplane.XAxis, deplane.YAxis, deplane.ZAxis], B=B)
vdisex = VectorDisplayEx(
    Point=deplane.Origin,
    Vector=multiplication,
    Colour=[ColourSwatch(SwatchColor=RGB(235, 52, 52)), ColourSwatch(SwatchColor=RGB(90, 207, 48)), ColourSwatch(SwatchColor=RGB(54, 126, 227))],
    Width=2)

# ==== cluster Cluster_5
plane = ClusterInput()
plane_2 = Plane(plane)
panel = Panel("""0
90
180
270""")
rotate = Rotate(Geometry=plane_2, Angle=degrees(panel), Plane=plane_2)  # -> Geometry, Transform
point = Point("0,10,0")
orient = Orient(Geometry=point, Source=PlaneXY(0, 0, 0), Target=rotate.Geometry)  # -> Geometry, Transform
deconstruct = Deconstruct(Point=orient.Geometry)  # -> XComponent, YComponent, ZComponent
sort_list = SortList(Keys=deconstruct.ZComponent, ValuesValuesA=rotate.Geometry)  # -> Keys, ValuesValuesA
list_item = ListItem(List=reverse(sort_list.ValuesValuesA), Index=0, Wrap=True)
plane_3 = Plane(list_item)
plane_4 = ClusterOutput(plane_3)

# ==== cluster Cluster_6
data = ClusterInput()
T = ClusterInput()
data_2 = Data(data)
graft = GraftTree(Tree=T, IncludeEmptyLists=True, IncludeNullItems=True)
tstat = TreeStatistics(Tree=data_2)  # -> Paths, Length, Count
tstat_2 = TreeStatistics(Tree=graft)  # -> Paths, Length, Count
replace = ReplacePaths(Data=data_2, Search=tstat.Paths, Replace=tstat_2.Paths)
data_3 = Data(replace)
data_4 = ClusterOutput(data_3)
