# Grasshopper definition openshell_test_dbml_v2.gh (Grasshopper 1.0.8)

n02f = ModelObject([<model object referenced from the Rhino model> x3])
n02f_2 = ModelObject([<model object referenced from the Rhino model> x15])
object = ModelObject([<model object referenced from the Rhino model> x3])
object_2 = ModelObject([<model object referenced from the Rhino model> x12])
cluster = Cluster_3(layername="##_Kevin::")  # disabled
item = ListItem(List=object_2, Index=0, Wrap=True)
unit_builder = Python3Script()  # -> out, Log, MatData; inputs Obj: tree, Category: String, UnitId: tree of String
# ---------- unit_builder: Python ----------
import sys, os, importlib

# Rhino/GH 裡通常能拿到目前 .gh 的路徑
import Grasshopper as gh
ghdoc_path = gh.Instances.ActiveCanvas.Document.FilePath  # 可能是空字串（未存檔）
if not ghdoc_path:
    raise Exception("GH document not saved yet. Save .gh first to use relative module path.")

proj_dir = os.path.dirname(ghdoc_path)
module_dir = os.path.join(proj_dir, "py_modules")

if module_dir not in sys.path:
    sys.path.append(module_dir)

def reload_pkg(prefix: str):
    # reload children first (reverse length order)
    mods = [m for name, m in sys.modules.items() if name == prefix or name.startswith(prefix + ".")]
    mods.sort(key=lambda m: len(m.__name__), reverse=True)
    for m in mods:
        importlib.reload(m)

# 先 import utils（確保從 py_modules 來）
import utils

# (可選) 確認你抓到的是哪個 utils，避免載到別份
# import utils.gh_utils as gu
# print("utils path =", gu.__file__)

# reload utils 及其已載入子模組
reload_pkg("utils")

# reload builder（讓它重新綁定新的 utils）
import ifc_unit_builder_fixed
importlib.reload(ifc_unit_builder_fixed)

MatData, Log = ifc_unit_builder_fixed.build_matdata(Obj, Category, UnitId)
# ---------- end unit_builder ----------
assembly = Python3Script()  # -> out, MatData; inputs MatData: list, Name: String, KeySuffix: String
# ---------- assembly: Python ----------
import sys, os, importlib

# Rhino/GH 裡通常能拿到目前 .gh 的路徑
import Grasshopper as gh
ghdoc_path = gh.Instances.ActiveCanvas.Document.FilePath  # 可能是空字串（未存檔）
if not ghdoc_path:
    raise Exception("GH document not saved yet. Save .gh first to use relative module path.")

proj_dir = os.path.dirname(ghdoc_path)
module_dir = os.path.join(proj_dir, "py_modules")

if module_dir not in sys.path:
    sys.path.append(module_dir)

def reload_pkg(prefix: str):
    # reload children first (reverse length order)
    mods = [m for name, m in sys.modules.items() if name == prefix or name.startswith(prefix + ".")]
    mods.sort(key=lambda m: len(m.__name__), reverse=True)
    for m in mods:
        importlib.reload(m)

# 先 import utils（確保從 py_modules 來）
import utils

# (可選) 確認你抓到的是哪個 utils，避免載到別份
# import utils.gh_utils as gu
# print("utils path =", gu.__file__)

# reload utils 及其已載入子模組
reload_pkg("utils")


import ifc_assembly_fixed
importlib.reload(ifc_assembly_fixed)

MatDataOut, Log = ifc_assembly_fixed.annotate_subassembly(MatData, Name, KeySuffix, Role)
# ---------- end assembly ----------
nonunit_builder = Python3Script()  # -> out, Log, MatData; inputs Obj: tree, Category: String
# ---------- nonunit_builder: Python ----------
import sys, os, importlib

# Rhino/GH 裡通常能拿到目前 .gh 的路徑
import Grasshopper as gh
ghdoc_path = gh.Instances.ActiveCanvas.Document.FilePath  # 可能是空字串（未存檔）
if not ghdoc_path:
    raise Exception("GH document not saved yet. Save .gh first to use relative module path.")

proj_dir = os.path.dirname(ghdoc_path)
module_dir = os.path.join(proj_dir, "py_modules")

if module_dir not in sys.path:
    sys.path.append(module_dir)

def reload_pkg(prefix: str):
    # reload children first (reverse length order)
    mods = [m for name, m in sys.modules.items() if name == prefix or name.startswith(prefix + ".")]
    mods.sort(key=lambda m: len(m.__name__), reverse=True)
    for m in mods:
        importlib.reload(m)

# 先 import utils（確保從 py_modules 來）
import utils

# (可選) 確認你抓到的是哪個 utils，避免載到別份
# import utils.gh_utils as gu
# print("utils path =", gu.__file__)

# reload utils 及其已載入子模組
reload_pkg("utils")

import ifc_nonUnit_builder_fixed
importlib.reload(ifc_nonUnit_builder_fixed)

MatData, Log = ifc_nonUnit_builder_fixed.build_nonUnit_matdata(Obj, Category)
# ---------- end nonunit_builder ----------
object_3 = ModelObject(object_2)
c_script = CSharpScript(Run=Button(), Template=nonunit_builder.out)  # -> out, Log; inputs Run: Boolean, Template: tree
# ---------- c_script: C# ----------
// Grasshopper Script Instance
#region Usings
using System;
using System.Linq;
using System.Collections;
using System.Collections.Generic;
using System.Drawing;

using Rhino;
using Rhino.Geometry;

using Grasshopper;
using Grasshopper.Kernel;
using Grasshopper.Kernel.Data;
using Grasshopper.Kernel.Types;
#endregion


public class Script_Instance : GH_ScriptInstance
{
  private void RunScript(bool Run, DataTree<object> Template, ref object Log)
  {
    if (!Run)
    {
      Log = "Run = false";
      return;
    }

    GH_Document doc = GrasshopperDocument;
    if (doc == null)
    {
      Log = "No GH_Document";
      return;
    }

    // ---------------------------
    // Phase 1: 回溯 Template（只讀）
    // ---------------------------
    if (Component.Params.Input.Count < 2)
    {
      Log = "Template input missing";
      return;
    }

    var templateInput = Component.Params.Input[1];
    if (templateInput.Sources.Count == 0)
    {
      Log = "Template input has no source wire";
      return;
    }

    IGH_Param src = templateInput.Sources[0];
    IGH_DocumentObject topObj =
      src.Attributes?.GetTopLevel?.DocObject ??
      src.Attributes?.Parent?.DocObject;

    IGH_Component templateComp = topObj as IGH_Component;
    if (templateComp == null)
    {
      Log = "Upstream object is not an IGH_Component";
      return;
    }

    string targetName = templateComp.NickName;
    Guid templateComponentGuid = templateComp.ComponentGuid;
    Guid templateInstanceGuid = templateComp.InstanceGuid;

    if (string.IsNullOrWhiteSpace(targetName))
    {
      Log = "Template NickName is empty";
      return;
    }

    List<Guid> oldIds = doc.Objects
      .OfType<IGH_Component>()
      .Where(c => c.InstanceGuid != templateInstanceGuid)
      .Where(c => c.NickName == targetName)
      .Select(c => c.InstanceGuid)
      .ToList();

    if (oldIds.Count == 0)
    {
      Log = "No components to replace";
      return;
    }

    // ---------------------------
    // Phase 2: 延後修改（安全）
    // ---------------------------
    doc.ScheduleSolution(1, d =>
    {
      ReplaceComponents(d, templateComponentGuid, templateInstanceGuid, oldIds);
    });

    Log = "Scheduled replace: " + oldIds.Count;
  }

  // ============================================================
  // Replace + Rewire + Keep Position
  // ============================================================
  private void ReplaceComponents(
    GH_Document doc,
    Guid templateComponentGuid,
    Guid templateInstanceGuid,
    List<Guid> oldInstanceIds
  )
  {
    var proxy = Instances.ComponentServer.ObjectProxies
      .FirstOrDefault(p => p.Guid == templateComponentGuid);
    if (proxy == null) return;

    var templateObj = doc.FindObject(templateInstanceGuid, false) as IGH_Component;
    if (templateObj == null) return;

    doc.UndoUtil.RecordEvent("Replace components");

    string Key(IGH_Param p)
    {
      return string.IsNullOrWhiteSpace(p.NickName) ? p.Name : p.NickName;
    }

    foreach (var id in oldInstanceIds)
    {
      IGH_Component oldObj = doc.FindObject(id, false) as IGH_Component;
      if (oldObj == null) continue;

      // -------- 0) 記錄舊位置（Pivot）--------
      // 你要的：替換後還在原位
      PointF oldPivot = PointF.Empty;
      try
      {
        if (oldObj.Attributes == null) oldObj.CreateAttributes();
        oldPivot = oldObj.Attributes.Pivot;
      }
      catch { }

      // -------- 1) 記錄舊連線 --------
      var oldInWires = oldObj.Params.Input
        .ToDictionary(p => Key(p), p => p.Sources.ToList());

      var oldOutWires = oldObj.Params.Output
        .ToDictionary(p => Key(p), p => p.Recipients.ToList());

      // -------- 2) 建立新元件 --------
      IGH_Component newC = proxy.CreateInstance() as IGH_Component;
      if (newC == null) continue;

      newC.CreateAttributes();

      // 先放到舊位置（等下 Clone 會蓋掉，所以還要再設一次）
      newC.Attributes.Pivot = oldPivot;

      // NickName 維持（用於你後續同名管理）
      newC.NickName = oldObj.NickName;

      doc.AddObject(newC, false);

      // -------- 3) 複製 Template 狀態（含 GhPython script / IO）--------
      CloneComponentState(templateObj, newC);

      // 🔥 重要：Clone 可能把 Pivot 蓋成 template 的位置
      // 所以一定要在 Clone 之後再把 Pivot 設回來
      if (newC.Attributes == null) newC.CreateAttributes();
      newC.Attributes.Pivot = oldPivot;
      newC.Attributes.ExpireLayout(); // 讓 GH 重新算 bounds

      // -------- 4) 建立新 IO 對照表 --------
      var newInMap = newC.Params.Input
        .GroupBy(Key)
        .ToDictionary(g => g.Key, g => g.First());

      var newOutMap = newC.Params.Output
        .GroupBy(Key)
        .ToDictionary(g => g.Key, g => g.First());

      // -------- 5) INPUT：來源 → 新 input --------
      foreach (var kv in oldInWires)
      {
        if (!newInMap.TryGetValue(kv.Key, out IGH_Param newIn)) continue;

        foreach (var s in kv.Value)
          newIn.AddSource(s);
      }

      // -------- 6) OUTPUT：新 output → 舊 recipients --------
      foreach (var kv in oldOutWires)
      {
        if (!newOutMap.TryGetValue(kv.Key, out IGH_Param newOut)) continue;

        foreach (var r in kv.Value)
          r.AddSource(newOut);
      }

      // -------- 7) 刪除舊元件 --------
      doc.RemoveObject(oldObj, false);
    }
  }

  // ============================================================
  // Clone component instance state via GH_Archive
  // (works across GH versions; includes GhPython script)
  // ============================================================
  private bool CloneComponentState(IGH_Component source, IGH_Component target)
  {
    if (source == null || target == null) return false;

    var archive = new GH_Archive();
    archive.AppendObject(source, "Component");
    return archive.ExtractObject(target, "Component");
  }
}
# ---------- end c_script ----------
explode = ExplodeObject(Object=object_3, Recursive=False)
block_definition = ModelBlockDefinition(BlockDefinition=object_3)  # -> BlockDefinition, Name
graft = GraftTree(Tree=block_definition.Name, IncludeEmptyLists=True, IncludeNullItems=True)  # -> simplify(Tree)
block_definition_2 = ModelBlockDefinition(BlockDefinition=graft)  # -> BlockDefinition, Name
split = TextSplit(Text=block_definition_2.Name, Separators="_")
graft_2 = GraftTree(Tree=block_definition.Name, IncludeEmptyLists=True, IncludeNullItems=True)  # -> simplify(Tree)
item_2 = ListItem(List=reverse(split), Index=0, Wrap=True)
panel = Panel(graft_2)
txt = Text(simplify(item_2))
object_4 = ModelObject([<model object referenced from the Rhino model> x1191])
py3 = Python3Script()  # -> main_path
# ---------- py3: Python ----------
import os
gh_doc = ghenv.Component.OnPingDocument()

main_path = os.path.dirname(gh_doc.FilePath)
# ---------- end py3 ----------
cluster_2 = Cluster(data=object_4, name="N66")  # -> geo_2, obj
cluster_3 = Cluster(data=object_4, name="N68")  # -> geo_2, obj
cluster_4 = Cluster(data=object_4, name="N53")  # -> geo_2, obj
cluster_5 = Cluster(data=object_4, name="N02")  # -> geo_2, obj
cluster_6 = Cluster(data=object_4, name="角鋁2")  # -> geo_2, obj
cluster_7 = Cluster(data=object_4, name="N67")  # -> geo_2, obj
cluster_8 = Cluster(data=object_4, name="N69")  # -> geo_2, obj
cluster_9 = Cluster(data=object_4, name="AL01")  # -> geo_2, obj
cluster_10 = Cluster_8(unitname=block_definition.Name, object=explode, dirpath=py3)  # -> horizontalgeo_2, horizontalobj_2, verticalgeo_2, verticalobj_2, fittinggeo_2, fittingobj_2
cluster_11 = Cluster(data=explode, name="N67 ")  # -> geo_2, obj
cluster_12 = Cluster(data=explode, name="N29")  # -> geo_2, obj
cluster_13 = Cluster(data=explode, name="N68 ")  # -> geo_2, obj
cluster_14 = Cluster(data=explode, name="AL01")  # -> geo_2, obj
cluster_15 = Cluster(data=explode, name="N66")  # -> geo_2, obj
cluster_16 = Cluster(data=explode, name="N28")  # -> geo_2, obj
cluster_17 = Cluster(data=explode, name="N20a")  # -> geo_2, obj
cluster_18 = Cluster(data=explode, name="N21")  # -> geo_2, obj
cluster_19 = Cluster(data=explode, name="N71")  # -> geo_2, obj
cluster_20 = Cluster(data=explode, name="AL02")  # -> geo_2, obj
cluster_21 = Cluster(data=explode, name="N65")  # -> geo_2, obj
cluster_22 = Cluster(data=explode, name="N08")  # -> geo_2, obj
cluster_23 = Cluster(data=explode, name="N19")  # -> geo_2, obj
cluster_24 = Cluster(data=explode, name="N69")  # -> geo_2, obj
cluster_25 = Cluster(data=explode, name="N20 ")  # -> geo_2, obj
cluster_26 = Cluster(data=explode, name="N07")  # -> geo_2, obj
merge = Merge(Data1=cluster_5.obj, Data2=cluster_4.obj)
merge_2 = Merge(Data1=cluster_8.obj, Data2=cluster_6.obj)
merge_3 = Merge(Data1=cluster_2.obj, Data2=cluster_7.obj, Data3=cluster_3.obj)
merge_4 = Merge(Data1=cluster_17.obj, Data2=cluster_18.obj)
merge_5 = Merge(Data1=cluster_14.obj, Data2=cluster_20.obj)
merge_6 = Merge(Data1=cluster_15.obj, Data2=cluster_16.obj, Data3=cluster_11.obj, Data4=cluster_13.obj, Data5=cluster_12.obj)
merge_7 = Merge(
    Data1=cluster_26.obj,
    Data2=cluster_22.obj,
    Data3=cluster_23.obj,
    Data4=cluster_24.obj,
    Data5=cluster_25.obj,
    Data6=cluster_21.obj,
    Data7=cluster_19.obj)
horizontalgeo = ModelObject(cluster_10.horizontalgeo_2)
horizontalobj = Data(cluster_10.horizontalobj_2)
fittinggeo = ModelObject(cluster_10.fittinggeo_2)
list = ValueList({"Vertical", "Horizontal", "Fitting", "Panel"}, selected="Panel")
list_2 = ValueList({"Vertical", "Horizontal", "Fitting", "Panel", "Glass", "Mullion", "Transom", "Bracket", "Accessory", "Fastener", "Bolt", "Screw", "Fitting"}, selected="Horizontal")
list_3 = ValueList({"Vertical", "Horizontal", "Fitting", "Panel", "Glass", "Mullion", "Transom", "Bracket", "Accessory", "Fastener", "Bolt", "Screw", "Fitting"}, selected="Horizontal")
list_4 = ValueList({"Vertical", "Horizontal", "Fitting", "Panel", "Glass", "Mullion", "Transom", "Bracket", "Accessory", "Fastener", "Bolt", "Screw", "Fitting"}, selected="Vertical")
verticalgeo = ModelObject(cluster_10.verticalgeo_2)
verticalobj = Data(cluster_10.verticalobj_2)
list_5 = ValueList({"Vertical", "Horizontal", "Fitting", "Panel", "Glass", "Mullion", "Transom", "Bracket", "Accessory", "Fastener", "Bolt", "Screw", "Fitting"}, selected="Vertical")
list_6 = ValueList({"Vertical", "Horizontal", "Fitting", "Panel", "Glass", "Mullion", "Transom", "Bracket", "Accessory", "Fastener", "Bolt", "Screw", "Fitting"}, selected="Panel")
nonunit_builder_2 = Python3Script(Obj=merge_3, Category=list_2)  # -> out, Log, MatData; inputs Obj: tree, Category: String; same code as nonunit_builder
list_7 = ValueList({"Vertical", "Horizontal", "Fitting", "Panel", "Glass", "Mullion", "Transom", "Bracket", "Accessory", "Fastener", "Bolt", "Screw", "Fitting"}, selected="Horizontal")
nonunit_builder_3 = Python3Script(Obj=cluster_9.obj, Category=list)  # -> out, Log, MatData; inputs Obj: tree, Category: String; same code as nonunit_builder
list_8 = ValueList({"Vertical", "Horizontal", "Fitting", "Panel", "Glass", "Mullion", "Transom", "Bracket", "Accessory", "Fastener", "Bolt", "Screw", "Fitting"}, selected="Horizontal")
list_9 = ValueList({"Vertical", "Horizontal", "Fitting", "Panel", "Glass", "Mullion", "Transom", "Bracket", "Accessory", "Fastener", "Bolt", "Screw", "Fitting"}, selected="Fitting")
list_10 = ValueList({"Vertical", "Horizontal", "Fitting", "Panel", "Glass", "Mullion", "Transom", "Bracket", "Accessory", "Fastener", "Bolt", "Screw", "Fitting"}, selected="Horizontal")
nonunit_builder_4 = Python3Script(Obj=merge, Category=list_4)  # -> out, Log, MatData; inputs Obj: tree, Category: String; same code as nonunit_builder
nonunit_builder_5 = Python3Script(Obj=merge_2, Category=list_3)  # -> out, Log, MatData; inputs Obj: tree, Category: String; same code as nonunit_builder
fittingobj = Data(cluster_10.fittingobj_2)
unit_builder_2 = Python3Script(Obj=verticalobj, Category=list_5, UnitId=graft_2)  # -> out, Log, MatData; inputs Obj: tree, Category: String, UnitId: tree of String; same code as unit_builder
unit_builder_3 = Python3Script(Obj=merge_7, Category=list_8, UnitId=graft_2)  # -> out, Log, MatData; inputs Obj: tree, Category: String, UnitId: tree of String; same code as unit_builder
unit_builder_4 = Python3Script(Obj=fittingobj, Category=list_9, UnitId=graft_2)  # -> out, Log, MatData; inputs Obj: tree, Category: String, UnitId: tree of String; same code as unit_builder
unit_builder_5 = Python3Script(Obj=merge_5, Category=list_6, UnitId=graft_2)  # -> out, Log, MatData; inputs Obj: tree, Category: String, UnitId: tree of String; same code as unit_builder
unit_builder_6 = Python3Script(Obj=merge_6, Category=list_10, UnitId=graft_2)  # -> out, Log, MatData; inputs Obj: tree, Category: String, UnitId: tree of String; same code as unit_builder
unit_builder_7 = Python3Script(Obj=merge_4, Category=list_7, UnitId=graft_2)  # -> out, Log, MatData; inputs Obj: tree, Category: String, UnitId: tree of String; same code as unit_builder
assembly_2 = Python3Script(MatData=flatten(unit_builder_5.MatData), Name="looseTrimAssembly", Role="looseTrimRole")  # -> out, MatData; inputs MatData: list, Name: String, KeySuffix: String; same code as assembly
merge_8 = Merge(Data1=nonunit_builder_4.MatData, Data2=nonunit_builder_5.MatData, Data3=nonunit_builder_3.MatData)
py3_2 = Python3Script(x=unit_builder_2.MatData)  # -> out, a
# ---------- py3_2: Python ----------
a = x
# ---------- end py3_2 ----------
merge_9 = Merge(Data1=assembly_2.MatData, Data2=unit_builder_6.MatData)
assembly_3 = Python3Script(MatData=flatten(merge_8), Name="InnerBalconyAssembly", Role="InnerBalconyRole")  # -> out, MatData; inputs MatData: list, Name: String, KeySuffix: String; same code as assembly
merge_10 = Merge(Data1=unit_builder_2.MatData, Data2=unit_builder_3.MatData, Data3=unit_builder_4.MatData)
assembly_4 = Python3Script(MatData=flatten(merge_9), Name="trimAssembly", Role="trimRole")  # -> out, MatData; inputs MatData: list, Name: String, KeySuffix: String; same code as assembly
merge_11 = Merge(Data1=assembly_3.MatData, Data2=nonunit_builder_2.MatData)
assembly_5 = Python3Script(MatData=flatten(merge_10), Name="frameAssembly", Role="frameRole")  # -> out, MatData; inputs MatData: list, Name: String, KeySuffix: String; same code as assembly
assembly_6 = Python3Script(MatData=flatten(merge_11), Name="BalconyAssembly", Role="BalconyRole")  # -> out, MatData; inputs MatData: list, Name: String, KeySuffix: String; same code as assembly
py3_3 = Python3Script()  # -> main_path; same code as py3
merge_12 = Merge(Data1=assembly_5.MatData, Data2=assembly_4.MatData, Data3=unit_builder_7.MatData, Data5=assembly_6.MatData)
concat = Concatenate(FragmentA=py3_3, FragmentC="\ifc_test_file\N03F_fixed.ifc")

# ----
# import mode
exporter = Python3Script(
    MatData=flatten(merge_12),
    UnitIdTree=graft_2,
    BayNoTree=txt,
    StoreyName="N02F",
    StoreyElev=Slider(9, range=0..100),
    OutPath=concat,
    Run=Toggle(False))  # -> out, OK, Log; inputs MatData: list, UnitIdTree: tree of String, BayNoTree: tree of String, StoreyName: String, StoreyElev: Double, OutPath: String, Run: Boolean
# ---------- exporter: Python ----------
import sys, os, importlib

# Rhino/GH 裡通常能拿到目前 .gh 的路徑
import Grasshopper as gh
ghdoc_path = gh.Instances.ActiveCanvas.Document.FilePath  # 可能是空字串（未存檔）
if not ghdoc_path:
    raise Exception("GH document not saved yet. Save .gh first to use relative module path.")

proj_dir = os.path.dirname(ghdoc_path)
module_dir = os.path.join(proj_dir, "py_modules")

if module_dir not in sys.path:
    sys.path.append(module_dir)

def reload_pkg(prefix: str):
    # reload children first (reverse length order)
    mods = [m for name, m in sys.modules.items() if name == prefix or name.startswith(prefix + ".")]
    mods.sort(key=lambda m: len(m.__name__), reverse=True)
    for m in mods:
        importlib.reload(m)

# 先 import utils（確保從 py_modules 來）
import utils

# (可選) 確認你抓到的是哪個 utils，避免載到別份
# import utils.gh_utils as gu
# print("utils path =", gu.__file__)

# reload utils 及其已載入子模組
reload_pkg("utils")

import ifc_exporter_fixed
importlib.reload(ifc_exporter_fixed) #development mode

OK, Log, ResolvedOutPath = ifc_exporter_fixed.export_ifc_from_matdata(
    Run,
    MatData,
    StoreyName,
    StoreyElev,
    OutPath
)
# ---------- end exporter ----------

panel_2 = Panel(exporter.Log)

# ==== cluster Cluster
name = ClusterInput()
data = ClusterInput()
name_2 = Text(name)
filterdata = FilterData(data=simplify(data), mode=0, filter=name_2)  # -> object_3, bool_2
clean = CleanTree(RemoveNulls=True, RemoveInvalid=True, RemoveEmpty=invert(False), Tree=filterdata.object_3)
lng = ListLength(List=flatten(clean))
rep = ReplaceText(Text=name_2, Find=" ", RecursiveReplace=False)
guid = CreateGUID(NumberOfGuids=lng, Format="Hyphens")
repeat = RepeatData(Data=rep, Length=lng)
unflatten = UnflattenTree(Tree=repeat, Guide=clean)  # -> graft(Tree)
unflatten_2 = UnflattenTree(Tree=guid, Guide=clean)  # -> graft(Tree)
merge = Merge(Data1=unflatten, Data2=unflatten_2)
join = TextJoin(Text=merge, Join="_")
unflatten_3 = UnflattenTree(Tree=clean, Guide=join)
trimbranch = TrimBranch(tree=unflatten_3, level="1")  # -> result; inputs tree: tree, level: Int32
# ---------- trimbranch: Python ----------
from Grasshopper import DataTree
from Grasshopper.Kernel.Data import GH_Path
from Grasshopper.Kernel import GH_RuntimeMessageLevel

if tree is None or level is None or tree.DataCount==0:
    ghenv.Component.AddRuntimeMessage(
        GH_RuntimeMessageLevel.Warning,
        "data is empty"
    )

def integrate_branches(data_tree, level):
    new_tree = DataTree[object]()
    
    # 遍歷數據樹的每個分支
    for i in range(data_tree.BranchCount):
        path = data_tree.Path(i)  # 取得當前分支的路徑
        items = data_tree.Branch(i)  # 取得當前分支的數據
        
        # 根據指定層級截取路徑
        new_path_indices = [path[j] for j in range(level) if j < path.Length]
        new_path = GH_Path(new_path_indices)
        
        # 將數據添加到新的分支
        for item in items:
            new_tree.Add(item, new_path)
    
    return new_tree

# 輸入參數
# data_tree: 數據樹
# level_input: 整數，表示保留的層級數
result = integrate_branches(tree, level)
# ---------- end trimbranch ----------
trimbranch_2 = TrimBranch(tree=join, level="1")  # -> result; inputs tree: tree, level: Int32; same code as trimbranch
geo = Geometry(trimbranch)
py3 = Python3Script(Geo=geo, Guid=trimbranch_2)  # -> out, Obj; inputs Geo: tree of GeometryBase, Guid: tree
# ---------- py3: Python ----------
from Grasshopper.Kernel.Types import GH_ObjectWrapper
from Grasshopper import DataTree
from Grasshopper.Kernel.Data import GH_Path

Obj = DataTree[object]()

for bi in range(Geo.BranchCount):
    path = Geo.Path(bi)
    geos = list(Geo.Branch(bi))
    guids = list(Guid.Branch(bi))

    if len(geos) != len(guids):
        raise Exception("Geo/Guid count mismatch at path {}".format(path))

    for i in range(len(geos)):
        Obj.Add(GH_ObjectWrapper([geos[i], guids[i]]), path)
# ---------- end py3 ----------
geo_2 = ClusterOutput(geo)
obj = ClusterOutput(py3.Obj)

# ==== cluster Cluster_3
py3 = Python3Script(x="N01", y=ColourSwatch(SwatchColor=RGB(158, 98, 109)))  # -> a; inputs y: Color
# ---------- py3: Python ----------
colorDict = {x:y}

class data:
    pass

d = data()
d.colorDict = colorDict

a = d
# ---------- end py3 ----------
py3_2 = Python3Script(x="N02", y=ColourSwatch(SwatchColor=RGB(158, 98, 109)))  # -> a; inputs y: Color; same code as py3
py3_3 = Python3Script(x="N87", y=ColourSwatch(SwatchColor=RGB(191, 64, 255)))  # -> a; inputs y: Color; same code as py3
py3_4 = Python3Script(x="N85", y=ColourSwatch(SwatchColor=RGB(140, 91, 0)))  # -> a; inputs y: Color; same code as py3
py3_5 = Python3Script(x="N84", y=ColourSwatch(SwatchColor=RGB(140, 91, 0)))  # -> a; inputs y: Color; same code as py3
py3_6 = Python3Script(x="N15", y=ColourSwatch(SwatchColor=RGB(224, 146, 0)))  # -> a; inputs y: Color; same code as py3
py3_7 = Python3Script(x="N64", y=ColourSwatch(SwatchColor=RGB(39, 105, 227)))  # -> a; inputs y: Color; same code as py3
py3_8 = Python3Script(x="N86", y=ColourSwatch(SwatchColor=RGB(49, 107, 214)))  # -> a; inputs y: Color; same code as py3
py3_9 = Python3Script(x="N53", y=ColourSwatch(SwatchColor=RGB(73, 122, 214)))  # -> a; inputs y: Color; same code as py3
py3_10 = Python3Script(x="N69", y=ColourSwatch(SwatchColor=RGB(102, 138, 204)))  # -> a; inputs y: Color; same code as py3
py3_11 = Python3Script(x="N69_down", y=ColourSwatch(SwatchColor=RGB(102, 138, 204)))  # -> a; inputs y: Color; same code as py3
py3_12 = Python3Script(x="S04", y=ColourSwatch(SwatchColor=RGB(0, 225, 255)))  # -> a; inputs y: Color; same code as py3
py3_13 = Python3Script(x="N71", y=ColourSwatch(SwatchColor=RGB(102, 185, 204)))  # -> a; inputs y: Color; same code as py3
py3_14 = Python3Script(x="AL02", y=ColourSwatch(SwatchColor=RGB(166, 161, 161)))  # -> a; inputs y: Color; same code as py3
py3_15 = Python3Script(x="AL02_1", y=ColourSwatch(SwatchColor=RGB(166, 161, 161)))  # -> a; inputs y: Color; same code as py3
py3_16 = Python3Script(x="AL02_2", y=ColourSwatch(SwatchColor=RGB(166, 161, 161)))  # -> a; inputs y: Color; same code as py3
py3_17 = Python3Script(x="角鋁", y=ColourSwatch(SwatchColor=RGB(133, 169, 255)))  # -> a; inputs y: Color; same code as py3
py3_18 = Python3Script(x="角鋁1", y=ColourSwatch(SwatchColor=RGB(133, 169, 255)))  # -> a; inputs y: Color; same code as py3
py3_19 = Python3Script(x="角鋁2", y=ColourSwatch(SwatchColor=RGB(133, 169, 255)))  # -> a; inputs y: Color; same code as py3
py3_20 = Python3Script(x="角鋁3", y=ColourSwatch(SwatchColor=RGB(133, 169, 255)))  # -> a; inputs y: Color; same code as py3
py3_21 = Python3Script(x="N78", y=ColourSwatch(SwatchColor=RGB(87, 207, 155)))  # -> a; inputs y: Color; same code as py3
py3_22 = Python3Script(x="N07", y=ColourSwatch(SwatchColor=RGB(83, 94, 115)))  # -> a; inputs y: Color; same code as py3
py3_23 = Python3Script(x="N09", y=ColourSwatch(SwatchColor=RGB(255, 128, 219)))  # -> a; inputs y: Color; same code as py3
py3_24 = Python3Script(x="N08", y=ColourSwatch(SwatchColor=RGB(101, 103, 235)))  # -> a; inputs y: Color; same code as py3
py3_25 = Python3Script(x="AluBlock", y=ColourSwatch(SwatchColor=RGB(196, 196, 196)))  # -> a; inputs y: Color; same code as py3
py3_26 = Python3Script(x="N65", y=ColourSwatch(SwatchColor=RGB(155, 157, 232)))  # -> a; inputs y: Color; same code as py3
py3_27 = Python3Script(x="S02", y=ColourSwatch(SwatchColor=RGB(128, 255, 191)))  # -> a; inputs y: Color; same code as py3
py3_28 = Python3Script(x="S02_1", y=ColourSwatch(SwatchColor=RGB(128, 255, 191)))  # -> a; inputs y: Color; same code as py3
py3_29 = Python3Script(x="N35", y=ColourSwatch(SwatchColor=RGB(177, 155, 232)))  # -> a; inputs y: Color; same code as py3
py3_30 = Python3Script(x="N32", y=ColourSwatch(SwatchColor=RGB(24, 150, 87)))  # -> a; inputs y: Color; same code as py3
py3_31 = Python3Script(x="N20", y=ColourSwatch(SwatchColor=RGB(79, 199, 255)))  # -> a; inputs y: Color; same code as py3
py3_32 = Python3Script(x="N20_down", y=ColourSwatch(SwatchColor=RGB(79, 199, 255)))  # -> a; inputs y: Color; same code as py3
py3_33 = Python3Script(x="N20_up", y=ColourSwatch(SwatchColor=RGB(79, 199, 255)))  # -> a; inputs y: Color; same code as py3
py3_34 = Python3Script(x="N19", y=ColourSwatch(SwatchColor=RGB(142, 159, 189)))  # -> a; inputs y: Color; same code as py3
py3_35 = Python3Script(x="F10", y=ColourSwatch(SwatchColor=RGB(232, 74, 206)))  # -> a; inputs y: Color; same code as py3
py3_36 = Python3Script(x="N76", y=ColourSwatch(SwatchColor=RGB(0, 128, 21)))  # -> a; inputs y: Color; same code as py3
py3_37 = Python3Script(x="S07", y=ColourSwatch(SwatchColor=RGB(255, 142, 128)))  # -> a; inputs y: Color; same code as py3
py3_38 = Python3Script(x="SSL", y=ColourSwatch(SwatchColor=RGB(255, 185, 87)))  # -> a; inputs y: Color; same code as py3
py3_39 = Python3Script(x="SSL_2", y=ColourSwatch(SwatchColor=RGB(255, 185, 87)))  # -> a; inputs y: Color; same code as py3
py3_40 = Python3Script(x="F10", y=ColourSwatch(SwatchColor=RGB(255, 41, 194)))  # -> a; inputs y: Color; same code as py3
py3_41 = Python3Script(x="F19", y=ColourSwatch(SwatchColor=RGB(87, 235, 255)))  # -> a; inputs y: Color; same code as py3
py3_42 = Python3Script(x="N66", y=ColourSwatch(SwatchColor=RGB(115, 178, 66)))  # -> a; inputs y: Color; same code as py3
py3_43 = Python3Script(x="N67", y=ColourSwatch(SwatchColor=RGB(115, 178, 66)))  # -> a; inputs y: Color; same code as py3
py3_44 = Python3Script(x="N68", y=ColourSwatch(SwatchColor=RGB(115, 178, 66)))  # -> a; inputs y: Color; same code as py3
py3_45 = Python3Script(x="N28", y=ColourSwatch(SwatchColor=RGB(115, 178, 66)))  # -> a; inputs y: Color; same code as py3
py3_46 = Python3Script(x="N77", y=ColourSwatch(SwatchColor=RGB(115, 178, 66)))  # -> a; inputs y: Color; same code as py3
py3_47 = Python3Script(x="N66", y=ColourSwatch(SwatchColor=RGB(115, 178, 66)))  # -> a; inputs y: Color; same code as py3
py3_48 = Python3Script(x="N79a", y=ColourSwatch(SwatchColor=RGB(115, 178, 66)))  # -> a; inputs y: Color; same code as py3
py3_49 = Python3Script(x="N79", y=ColourSwatch(SwatchColor=RGB(115, 178, 66)))  # -> a; inputs y: Color; same code as py3
py3_50 = Python3Script(x="N29", y=ColourSwatch(SwatchColor=RGB(115, 178, 66)))  # -> a; inputs y: Color; same code as py3
py3_51 = Python3Script(x="AL01", y=ColourSwatch(SwatchColor=RGB(117, 117, 117)))  # -> a; inputs y: Color; same code as py3
py3_52 = Python3Script(x="AL01_sm", y=ColourSwatch(SwatchColor=RGB(117, 117, 117)))  # -> a; inputs y: Color; same code as py3
py3_53 = Python3Script(x="N56", y=ColourSwatch(SwatchColor=RGB(0, 255, 0)))  # -> a; inputs y: Color; same code as py3
py3_54 = Python3Script(x="N60", y=ColourSwatch(SwatchColor=RGB(255, 128, 0)))  # -> a; inputs y: Color; same code as py3
py3_55 = Python3Script(x="F20", y=ColourSwatch(SwatchColor=RGB(191, 63, 63)))  # -> a; inputs y: Color; same code as py3
py3_56 = Python3Script(x="N59", y=ColourSwatch(SwatchColor=RGB(0, 128, 0)))  # -> a; inputs y: Color; same code as py3
py3_57 = Python3Script(x="F24", y=ColourSwatch(SwatchColor=RGB(63, 191, 127)))  # -> a; inputs y: Color; same code as py3
py3_58 = Python3Script(x="N58", y=ColourSwatch(SwatchColor=RGB(128, 255, 0)))  # -> a; inputs y: Color; same code as py3
py3_59 = Python3Script(x="F22", y=ColourSwatch(SwatchColor=RGB(252, 83, 83)))  # -> a; inputs y: Color; same code as py3
py3_60 = Python3Script(x="S09", y=ColourSwatch(SwatchColor=RGB(252, 154, 83)))  # -> a; inputs y: Color; same code as py3
py3_61 = Python3Script(x="S06", y=ColourSwatch(SwatchColor=RGB(252, 207, 83)))  # -> a; inputs y: Color; same code as py3
py3_62 = Python3Script(x="N60", y=ColourSwatch(SwatchColor=RGB(255, 128, 0)))  # -> a; inputs y: Color; same code as py3
py3_63 = Python3Script(x="S08", y=ColourSwatch(SwatchColor=RGB(252, 207, 83)))  # -> a; inputs y: Color; same code as py3
py3_64 = Python3Script(x="S01", y=ColourSwatch(SwatchColor=RGB(207, 165, 50)))  # -> a; inputs y: Color; same code as py3
py3_65 = Python3Script(x="AL01_飾條", y=ColourSwatch(SwatchColor=RGB(178, 178, 178)))  # -> a; inputs y: Color; same code as py3
py3_66 = Python3Script(x="F11", y=ColourSwatch(SwatchColor=RGB(191, 63, 63)))  # -> a; inputs y: Color; same code as py3
py3_67 = Python3Script(x="N66up", y=ColourSwatch(SwatchColor=RGB(115, 178, 66)))  # -> a; inputs y: Color; same code as py3
py3_68 = Python3Script(x="N66dn", y=ColourSwatch(SwatchColor=RGB(115, 178, 66)))  # -> a; inputs y: Color; same code as py3
py3_69 = Python3Script(x="L_25x25x3", y=ColourSwatch(SwatchColor=RGB(255, 149, 0)))  # -> a; inputs y: Color; same code as py3
py3_70 = Python3Script(x="N67_bridge", y=ColourSwatch(SwatchColor=RGB(115, 178, 66)))  # -> a; inputs y: Color; same code as py3
py3_71 = Python3Script(x="N68_bridge", y=ColourSwatch(SwatchColor=RGB(115, 178, 66)))  # -> a; inputs y: Color; same code as py3
merge = Merge(
    Data1=py3,
    Data2=py3_2,
    Data3=py3_3,
    Data4=py3_4,
    Data5=py3_5,
    Data6=py3_6,
    Data7=py3_7,
    Data8=py3_8,
    Data9=py3_9,
    Data10=py3_10,
    Data11=py3_11,
    Data12=py3_12,
    Data13=py3_13,
    Data14=py3_14,
    Data15=py3_15,
    Data16=py3_16,
    Data17=py3_17,
    Data18=py3_18,
    Data19=py3_19,
    Data20=py3_20,
    Data21=py3_21,
    Data22=py3_22,
    Data23=py3_23,
    Data24=py3_24,
    Data25=py3_25,
    Data26=py3_26,
    Data27=py3_27,
    Data28=py3_28,
    Data29=py3_29,
    Data30=py3_30,
    Data31=py3_31,
    Data32=py3_32,
    Data33=py3_33,
    Data34=py3_34,
    Data35=py3_35,
    Data36=py3_36,
    Data37=py3_37,
    Data38=py3_38,
    Data39=py3_39,
    Data40=py3_40,
    Data41=py3_41,
    Data42=py3_42,
    Data43=py3_43,
    Data44=py3_44,
    Data45=py3_45,
    Data46=py3_46,
    Data47=py3_47,
    Data48=py3_48,
    Data49=py3_49,
    Data50=py3_50,
    Data51=py3_51,
    Data52=py3_54,
    Data53=py3_55,
    Data54=py3_66,
    Data55=py3_56,
    Data56=py3_57,
    Data57=py3_62,
    Data58=py3_58,
    Data59=py3_53,
    Data60=py3_59,
    Data61=py3_60,
    Data62=py3_63,
    Data63=py3_61,
    Data64=py3_64,
    Data65=py3_52,
    Data66=py3_65,
    Data67=py3_67,
    Data68=py3_68,
    Data69=py3_70,
    Data70=py3_71,
    Data71=py3_69)
py3_72 = Python3Script(x=merge)  # -> a, b; inputs x: list
# ---------- py3_72: Python ----------
import ghpythonlib.treehelpers as th
wholeDict = {}
b = []
for i in x:
    wholeDict.update(i.colorDict)
    for key in i.colorDict.keys():
        b.append([key, i.colorDict[key]])
    

class data:
    pass

d = data()
d.data = wholeDict
a = d

b = th.list_to_tree(b)
# ---------- end py3_72 ----------
layername = ClusterInput()
item = ListItem(List=py3_72.b, Index=0, Wrap=True)  # -> Item, Item1
layername_2 = Text(layername)
idata = ClusterInput()
split = TextSplit(Text=item.Item1, Separators=",")
panel = Panel("##_Kevin::")
py3_73 = Python3Script(iData=idata, colorData=py3_72.a)  # -> out, dataGeo, graft(dataName), graft(colorList)
# ---------- py3_73: Python ----------
import System.Drawing as sd

dataGeo = iData.geo
dataName = iData.names

colorDict = colorData.data
rgb = [0, 0, 0]  # 黑色
black = sd.Color.FromArgb(rgb[0], rgb[1], rgb[2])

colorList = []
for name in dataName:
    if name in colorDict:
        colorList.append(colorDict[name])
    else:
        print(name)
        colorList.append(black)
# ---------- end py3_73 ----------
item_2 = ListItem(List=split, Index=0, Wrap=True)  # -> Item, Item1, Item2
watchbranch = WatchBranch(alldata=py3_73.dataGeo)  # -> seedata_2, path_2
panel_2 = Panel(item_2.Item2)
concat = Concatenate(FragmentA=layername_2, FragmentB=py3_73.dataName)
cluster = Cluster_2(object=py3_73.dataGeo)
layer = ModelLayer(Layer=concat, DisplayColour=py3_73.colorList)
panel_3 = Panel(py3_73.out)
object = ModelObject(Object=cluster, Name=py3_73.dataName, Layer=layer)
object_2 = ModelObject(object)
object_3 = ClusterOutput(object_2)

# ==== cluster Cluster_8
object = ClusterInput()
dirpath = ClusterInput()
dirpath_2 = Text(dirpath)
object_2 = ModelObject(object)
filterdata = FilterData(data=simplify(object_2), mode=0, filter="N65")  # -> object_3, bool_2
cluster = Cluster_4(B=filterdata.object_3)  # -> pln_2, crv_2
pln = Plane(cluster.pln_2)
cluster1 = Cluster1(crv=cluster.crv_2, object=object_2)
cluster_2 = Cluster_6(object=cluster1, B="0")
cluster_3 = Cluster_6(object=cluster1, B="2")
cluster_4 = Cluster_6(object=cluster1, B="1")
merge = Merge(Data1=cluster_2, Data2=cluster_3)
object_3 = ModelObject(merge)
bbox = BoundingBox(Content=object_3, Plane=PlaneXY(0, 0, 0))  # -> Box, Box_2
debox = DeconstructBox(Box=bbox.Box)  # -> Plane, X, Y, Z
num = Number(debox.Z)
smaller = SmallerThan(FirstNumber=num, SecondNumber=Slider(1500, range=1..5000))  # -> SmallerThan, OrEqualTo
unitname = ClusterInput()
unitname_2 = Text(graft(unitname))
dispatch = Dispatch(List=object_3, DispatchPattern=smaller.SmallerThan)  # -> ListA, ListB
panel = Panel(unitname_2)
trimbranch = TrimBranch(tree=cluster_4, level="1")  # -> result; inputs tree: tree, level: Int32; same code as trimbranch
trimbranch_2 = TrimBranch(tree=dispatch.ListB, level="1")  # -> result; inputs tree: tree, level: Int32; same code as trimbranch
trimbranch_3 = TrimBranch(tree=dispatch.ListA, level="1")  # -> result; inputs tree: tree, level: Int32; same code as trimbranch
horizontal = ModelObject(trimbranch)
fitting = ModelObject(trimbranch_3)
vertical = ModelObject(trimbranch_2)
lng = ListLength(List=horizontal)
lng_2 = ListLength(List=vertical)
lng_3 = ListLength(List=fitting)
merge_2 = Merge(Data1=horizontal, Data2=vertical, Data3=fitting)
merge_3 = Merge(Data1=lng, Data2=lng_2, Data3=lng_3)
bbox_2 = BoundingBox(Content=merge_2, Plane=PlaneXY(0, 0, 0))  # -> Box, Box_2
object_4 = ModelObject(Object=merge_2)  # -> Object, Name
geo = Geometry(merge_2)
area = Area(Geometry=bbox_2.Box)
py3 = Python3Script(Geometry=geo, Name=object_4.Name, Points=area, UnitName=unitname_2, dirPath=dirpath_2, Update=Button())  # -> out, Guid; inputs Geometry: tree of GeometryBase, Name: tree of String, Points: tree of Point3d, UnitName: tree of String, dirPath: String, Update: Boolean
# ---------- py3: Python ----------
"""Rhino 8 / Grasshopper Python (CPython3)
Persist stable GUIDs to a JSON file in a user-specified folder.

Inputs (GH):
- Geometry (tree): GeometryBase (extrusion geometry)
- Name     (tree): str (e.g. N01, N02...)
- Points   (tree): Point3d (center point; used to disambiguate same-name parts)
- UnitName (tree): str (unit identifier per branch/item)
- dirPath  (item): str (target folder where guid_file.json will be created)
- Update   (item): bool (Boolean Button recommended; when True clears all stored GUIDs)

Output (GH):
- Guid (tree): str (same tree structure as Geometry)
"""

import os
import json
import time
import uuid

import Grasshopper as gh
from Grasshopper import DataTree
from Grasshopper.Kernel.Data import GH_Path


# -------------------------
# Config
# -------------------------
JSON_FILENAME = "guid_file.json"
POINT_DECIMALS = 3       # rounding for point-key stability (e.g. 3 -> 0.001 units)
LOCK_TIMEOUT_S = 0.4
LOCK_POLL_S = 0.02


# -------------------------
# Helpers
# -------------------------
def _tree_to_branches(t):
    """Return dict[GH_Path] -> list(items) for GH trees; fallback to single-item branch."""
    d = {}
    if t is None:
        return d
    try:
        for p in list(t.Paths):
            d[p] = list(t.Branch(p))
        return d
    except Exception:
        d[GH_Path(0)] = [t]
        return d

def _safe_get(lst, i, default=None):
    try:
        return lst[i]
    except Exception:
        return default

def _norm_str(s):
    return (s or "").strip()

def _pt_key(pt):
    """Stable fixed-decimal string key for Point3d."""
    try:
        x = round(float(pt.X), POINT_DECIMALS)
        y = round(float(pt.Y), POINT_DECIMALS)
        z = round(float(pt.Z), POINT_DECIMALS)
        fmt = "{:0." + str(POINT_DECIMALS) + "f}"
        return ",".join([fmt.format(x), fmt.format(y), fmt.format(z)])
    except Exception:
        # If pt missing or weird type
        fmt = "{:0." + str(POINT_DECIMALS) + "f}"
        return ",".join([fmt.format(0.0), fmt.format(0.0), fmt.format(0.0)])

def _acquire_lock(lock_path, timeout_s):
    t0 = time.time()
    while True:
        try:
            fd = os.open(lock_path, os.O_CREAT | os.O_EXCL | os.O_WRONLY)
            os.close(fd)
            return True
        except Exception:
            if (time.time() - t0) >= timeout_s:
                return False
            time.sleep(LOCK_POLL_S)

def _release_lock(lock_path):
    try:
        if os.path.exists(lock_path):
            os.remove(lock_path)
    except Exception:
        pass

def _load_db(json_path):
    if not os.path.exists(json_path):
        return {}
    try:
        with open(json_path, "r", encoding="utf-8") as f:
            obj = json.load(f)
        return obj if isinstance(obj, dict) else {}
    except Exception:
        # If file is corrupted/partial, don't crash GH — start clean
        return {}

def _atomic_write_json(json_path, data):
    folder = os.path.dirname(json_path)
    if folder and not os.path.exists(folder):
        os.makedirs(folder, exist_ok=True)

    tmp = json_path + ".tmp"
    with open(tmp, "w", encoding="utf-8") as f:
        json.dump(data, f, ensure_ascii=False, indent=2, sort_keys=True)

    # Atomic replace on same drive
    os.replace(tmp, json_path)


# -------------------------
# Main
# -------------------------
Guid = DataTree[object]()

base_dir = (dirPath or "").strip() if "dirPath" in globals() else ""
if not base_dir:
    ghenv.Component.AddRuntimeMessage(
        gh.Kernel.GH_RuntimeMessageLevel.Error,
        "dirPath is empty. Provide a folder path to store guid_file.json."
    )
else:
    # Create folder if missing
    try:
        os.makedirs(base_dir, exist_ok=True)
    except Exception as e:
        ghenv.Component.AddRuntimeMessage(
            gh.Kernel.GH_RuntimeMessageLevel.Error,
            "Cannot create/access dirPath folder: {}".format(e)
        )
        base_dir = ""

if base_dir:
    json_path = os.path.join(base_dir, JSON_FILENAME)
    lock_path = os.path.join(base_dir, JSON_FILENAME + ".lock")

    geo_br  = _tree_to_branches(Geometry)
    name_br = _tree_to_branches(Name)
    pt_br   = _tree_to_branches(Points)
    unit_br = _tree_to_branches(UnitName)

    got_lock = _acquire_lock(lock_path, LOCK_TIMEOUT_S)
    db = _load_db(json_path)

    # Update is intended as a BUTTON: when True on this solve, clear all stored GUIDs
    if bool(Update):
        db = {}
        # optional: delete file too (keeps things extra clean)
        try:
            if os.path.exists(json_path):
                os.remove(json_path)
        except Exception:
            pass

    # Schema: db[unit_name][part_name][point_key] = guid_str
    if not isinstance(db, dict):
        db = {}

    for path, geos in geo_br.items():
        names = name_br.get(path, [])
        pts   = pt_br.get(path, [])
        units = unit_br.get(path, [])

        for i in range(len(geos)):
            # Prefer per-item; fallback to first item of the branch if you provided one unit per branch
            unit_name = _norm_str(_safe_get(units, i, _safe_get(units, 0, "")))
            part_name = _norm_str(_safe_get(names, i, ""))
            pt        = _safe_get(pts, i, None)
            pkey      = _pt_key(pt)

            unit_dict = db.get(unit_name)
            if not isinstance(unit_dict, dict):
                unit_dict = {}
                db[unit_name] = unit_dict

            name_dict = unit_dict.get(part_name)
            if not isinstance(name_dict, dict):
                name_dict = {}
                unit_dict[part_name] = name_dict

            existing = name_dict.get(pkey)

            if isinstance(existing, str) and existing:
                guid_str = existing
            else:
                guid_str = str(uuid.uuid4())
                name_dict[pkey] = guid_str

            Guid.Add(guid_str, path)

    # Save back
    try:
        _atomic_write_json(json_path, db)
    except Exception as e:
        ghenv.Component.AddRuntimeMessage(
            gh.Kernel.GH_RuntimeMessageLevel.Error,
            "Failed writing guid_file.json: {}".format(e)
        )

    if got_lock:
        _release_lock(lock_path)
# ---------- end py3 ----------
partition = PartitionList(List=py3.Guid, Size=merge_3)
cluster_5 = Cluster_7(txt=partition, S="0")
cluster_6 = Cluster_7(txt=partition, S="1")
cluster_7 = Cluster_7(txt=partition, S="2")
horizontalguid = Text(simplify(cluster_5))
horizontalgeo = ModelObject(horizontal)
verticalguid = Text(simplify(cluster_6))
fittingguid = Text(simplify(cluster_7))
verticalgeo = ModelObject(vertical)
fittinggeo = ModelObject(fitting)
object_5 = ModelObject(Object=verticalgeo)  # -> Object, Name
object_6 = ModelObject(Object=fittinggeo)  # -> Object, Name
object_7 = ModelObject(Object=horizontalgeo)  # -> Object, Name
merge_4 = Merge(Data1=graft(object_5.Name), Data2=graft(verticalguid))
merge_5 = Merge(Data1=graft(object_6.Name), Data2=graft(fittingguid))
merge_6 = Merge(Data1=graft(object_7.Name), Data2=graft(horizontalguid))
geo_2 = Geometry(horizontalgeo)
geo_3 = Geometry(verticalgeo)
geo_4 = Geometry(fittinggeo)
join = TextJoin(Text=merge_4, Join="_")
join_2 = TextJoin(Text=merge_5, Join="_")
join_3 = TextJoin(Text=merge_6, Join="_")
trimbranch_4 = TrimBranch(tree=join, level="1")  # -> result; inputs tree: tree, level: Int32; same code as trimbranch
trimbranch_5 = TrimBranch(tree=join_2, level="1")  # -> result; inputs tree: tree, level: Int32; same code as trimbranch
trimbranch_6 = TrimBranch(tree=join_3, level="1")  # -> result; inputs tree: tree, level: Int32; same code as trimbranch
py3_2 = Python3Script(Geo=geo_2, Guid=trimbranch_6)  # -> out, Obj; inputs Geo: tree of GeometryBase, Guid: tree; same code as py3
py3_3 = Python3Script(Geo=geo_3, Guid=trimbranch_4)  # -> out, Obj; inputs Geo: tree of GeometryBase, Guid: tree; same code as py3
py3_4 = Python3Script(Geo=geo_4, Guid=trimbranch_5)  # -> out, Obj; inputs Geo: tree of GeometryBase, Guid: tree; same code as py3
horizontalobj = Data(py3_2.Obj)
verticalobj = Data(py3_3.Obj)
fittingobj = Data(py3_4.Obj)
verticalgeo_2 = ClusterOutput(verticalgeo)
fittinggeo_2 = ClusterOutput(fittinggeo)
fittingobj_2 = ClusterOutput(fittingobj)
horizontalgeo_2 = ClusterOutput(horizontalgeo)
verticalobj_2 = ClusterOutput(verticalobj)
horizontalobj_2 = ClusterOutput(horizontalobj)

# ==== cluster FilterData
data = ClusterInput()
mode = ClusterInput()
filter = ClusterInput()
data_2 = ModelObject(data)
mode_2 = Integer(mode)
filter_2 = Data(filter)
object = ModelObject(Object=data_2)  # -> Object, Name, Layer
py3 = Python3Script(x=object.Object)  # -> a
# ---------- py3: Python ----------
if x:
    a = x
else:
    a = 'None'
# ---------- end py3 ----------
py3_2 = Python3Script(x=object.Name)  # -> a; same code as py3
py3_3 = Python3Script(x=object.Layer)  # -> a; same code as py3
matchtext = Python3Script(layerList=py3_3, searchList=filter_2)  # -> out_bool; inputs layerList: list, searchList: list of String
# ---------- matchtext: Python ----------
from ghpythonlib.components import MatchText
from Grasshopper import DataTree
from Grasshopper.Kernel.Data import GH_Path
from Grasshopper.Kernel import GH_RuntimeMessageLevel
from itertools import zip_longest

if layerList is None or searchList is None:
    ghenv.Component.AddRuntimeMessage(
        GH_RuntimeMessageLevel.Warning,
        "data is empty"
    )
else:
    def to_bool_seq(x):
        # 統一轉為「list[bool]」
        # IronPython 的 List 可以直接 list(x)
        if isinstance(x, bool) or x is None:
            return [bool(x)]
        try:
            # 若是 IronPython.Runtime.List、list、tuple 等可迭代
            return [bool(v) for v in list(x)]
        except TypeError:
            # 其他不可迭代的一律包成單一元素
            return [bool(x)]

    nest_bool = []
    for pattern in searchList:
        temp = MatchText(text=layerList, regex=pattern, case=True)
        seq = to_bool_seq(temp)     # 先規範化
        nest_bool.append(seq)

    # 只有一條序列 → 你想要：直接回傳它？還是壓成單一布林？
    # 1) 若要「逐欄結果」就直接複製那條：
    if len(nest_bool) == 1:
        out_bool = list(nest_bool[0])
    else:
        # 多條序列 → 逐欄 OR，長度不齊用 False 補齊
        out_bool = [any(col) for col in zip_longest(*nest_bool, fillvalue=False)]

    # 檢查
    # print(nest_bool)
    # print(out_bool)
# ---------- end matchtext ----------
matchtext_2 = Python3Script(layerList=py3_2, searchList=filter_2)  # -> out_bool; inputs layerList: list, searchList: list of String; same code as matchtext
matchtext_3 = Python3Script(layerList=py3, searchList=filter_2)  # -> out_bool; inputs layerList: list, searchList: list of String; same code as matchtext
tmatch = MatchText(Text=data_2, RegEx=filter_2, Case=True)
or = GateOr(A=tmatch, D=matchtext_3, B=matchtext_2, C=matchtext)
filter_3 = StreamFilter(Gate=mode_2, Stream0=or, Stream1=tmatch, Stream2=matchtext_3, Stream3=matchtext_2, Stream4=matchtext)
dispatch = Dispatch(List=data_2, DispatchPattern=filter_3)  # -> ListA, ListB
object_2 = ModelObject(dispatch.ListA)
bool = Boolean(filter_3)
bool_2 = ClusterOutput(bool)
object_3 = ClusterOutput(object_2)

# ==== cluster WatchBranch
alldata = ClusterInput()
index = ClusterInput()
alldata_2 = Data(alldata)
index_2 = Number(index)
item = ListItem(List=flatten(index_2), Index="0", Wrap=True)
null = NullItem(Item=item)  # -> NullFlags, InvalidFlags, Description
filter = StreamFilter(Gate=null.NullFlags, Stream0=index_2, Stream1="0")
tstat = TreeStatistics(Tree=alldata_2)  # -> Paths, Length, Count
item_2 = ListItem(List=tstat.Paths, Index=filter, Wrap=True)
branch = TreeBranch(Tree=alldata_2, Path=item_2, MaintainPaths=True)
seedata = Data(branch)
path = Data(item_2)
seedata_2 = ClusterOutput(seedata)
path_2 = ClusterOutput(path)

# ==== cluster Cluster_2
object = ClusterInput()
object_2 = ModelObject(simplify(graft(object)))
null = NullItem(Item=object_2)  # -> NullFlags, InvalidFlags, Description
dispatch = Dispatch(List=object_2, DispatchPattern=null.InvalidFlags)  # -> ListA, ListB
shift = ShiftPaths(Data=dispatch.ListB, Offset=-1)
geo = Geometry(dispatch.ListA)
debrep = DeconstructBrep(Brep=geo)  # -> simplify(Faces), Edges, Vertices
null_2 = NullItem(Item=debrep.Faces)  # -> NullFlags, InvalidFlags, Description
dispatch_2 = Dispatch(List=debrep.Faces, DispatchPattern=null_2.InvalidFlags)  # -> ListA, ListB
edges = BrepEdges(Brep=dispatch_2.ListA)  # -> Naked, Interior, NonManifold
clean = CleanTree(RemoveNulls=True, RemoveInvalid=True, RemoveEmpty=invert(False), Tree=edges.Naked)
join = JoinCurves(Curves=clean, Preserve=False)
patch = Patch(Curves=join, Spans=20, Flexibility=1, Trim=True)
trimbranch = TrimBranch(data_tree=patch, level_input="1")  # -> out, result; inputs data_tree: tree, level_input: Int32
# ---------- trimbranch: Python ----------
from Grasshopper import DataTree
from Grasshopper.Kernel.Data import GH_Path
from Grasshopper.Kernel import GH_RuntimeMessageLevel

if data_tree is None or level_input is None:
    ghenv.Component.AddRuntimeMessage(
        GH_RuntimeMessageLevel.Warning,
        "data is empty"
    )

def integrate_branches(data_tree, level):
    new_tree = DataTree[object]()
    
    # 遍歷數據樹的每個分支
    for i in range(data_tree.BranchCount):
        path = data_tree.Path(i)  # 取得當前分支的路徑
        items = data_tree.Branch(i)  # 取得當前分支的數據
        
        # 根據指定層級截取路徑
        new_path_indices = [path[j] for j in range(level) if j < path.Length]
        new_path = GH_Path(new_path_indices)
        
        # 將數據添加到新的分支
        for item in items:
            new_tree.Add(item, new_path)
    
    return new_tree

# 輸入參數
# data_tree: 數據樹
# level_input: 整數，表示保留的層級數
result = integrate_branches(data_tree, level_input)
# ---------- end trimbranch ----------
shift_2 = ShiftPaths(Data=dispatch_2.ListB, Offset=-1)
merge = Merge(Data1=shift_2, Data2=trimbranch.result)
join_2 = BrepJoin(Breps=merge)  # -> Breps, Closed
merge_2 = Merge(Data1=shift, Data2=join_2.Breps)
R = ClusterOutput(merge_2)

# ==== cluster Cluster_4
B = ClusterInput()
debrep = DeconstructBrep(Brep=B)  # -> Faces, Edges, Vertices
area = Area(Geometry=debrep.Faces)
pdecon = Deconstruct(Point=area)  # -> XComponent, YComponent, ZComponent
sort = SortList(Keys=pdecon.ZComponent, ValuesA=debrep.Faces)  # -> Keys, ValuesA
item = ListItem(List=sort.ValuesA, Index=0, Wrap=True)  # -> Item1, Item
merge = Merge(Data1=item.Item, Data2=item.Item1)
area_2 = Area(Geometry=merge)
item_2 = ListItem(List=area_2, Index=0, Wrap=True)  # -> Item, Item1
xy = XYPlane(Origin=item_2.Item)
project = Project(Geometry=item_2.Item1, Plane=xy)  # -> Geometry, Transform
vec2pt = Vector2Pt(PointA=item_2.Item, PointB=project.Geometry, Unitize=False)  # -> Vector, Length
pl = PlaneNormal(Origin=item_2.Item, ZAxis=vec2pt.Vector)
cp = PlaneClosestPoint(Point=area, Plane=pl)  # -> Point, UVPoint, Distance
yaxistoz = YAxisToZ(P=pl)
sort_2 = SortList(Keys=cp.Distance, ValuesA=debrep.Faces)  # -> Keys, ValuesA
item_3 = ListItem(List=reverse(sort_2.ValuesA), Index=0, Wrap=True)
edges = BrepEdges(Brep=item_3)  # -> Naked, Interior, NonManifold
midpt = CurveMiddle(Curve=edges.Naked)
pdecon_2 = Deconstruct(Point=midpt)  # -> XComponent, YComponent, ZComponent
sort_3 = SortList(Keys=pdecon_2.ZComponent, ValuesA=edges.Naked)  # -> Keys, ValuesA
item_4 = ListItem(List=sort_3.ValuesA, Index=0, Wrap=True)
Z = UnitZ(Factor="-11.3")
move = Move(Geometry=item_4, Motion=Z)  # -> Geometry, Transform
midpt_2 = CurveMiddle(Curve=move.Geometry)
pl_origin = PlaneOrigin(Base=yaxistoz, Origin=midpt_2)
number_slider = Slider(748, range=0..1000)
pln = Plane(pl_origin)
deplane = DeconstructPlane(Plane=pln)  # -> Origin, XAxis, YAxis, ZAxis
plnaxis = PlaneAxis(P=pln, B=35)
neg = Negative(Value=deplane.XAxis)
pln_2 = ClusterOutput(pln)
amp = Amplitude(Vector=neg, Amplitude=number_slider)
amp_2 = Amplitude(Vector=deplane.XAxis, Amplitude=number_slider)
move_2 = Move(Geometry=deplane.Origin, Motion=amp)  # -> Geometry, Transform
move_3 = Move(Geometry=deplane.Origin, Motion=amp_2)  # -> Geometry, Transform
ln = Line(StartPoint=move_3.Geometry, EndPoint=move_2.Geometry)
flip = FlipCurve(Curve=move.Geometry, Guide=ln)  # -> Curve, Flag
crv = Curve(flip.Curve)
crv_2 = ClusterOutput(crv)

# ==== cluster Cluster1
object = ClusterInput()
crv = ClusterInput()
object_2 = ModelObject(object)
crv_2 = Curve(crv)
simplify = SimplifyCurve(Curve=crv_2)  # -> Curve, Simplified
object_3 = ModelObject(Object=object_2)  # -> Object, Layer
split = TextSplit(Text=object_3.Layer, Separators=" :")  # -> simplify(Result)
item = ListItem(List=split, Index=Slider(6, range=0..10), Wrap=True)
shift = ShiftPaths(Data=item, Offset=-1)

# ----
# 這幾樣橫料有機會被判定為直料
# 因此直接提取
panel = Panel("""N20
N20a
N21
N24
---
S02S""")
mindex = MemberIndex(Set=shift, Member=panel)  # -> Index, Count

pshift = ShiftPaths(Data=mindex.Index, Offset=-1)
panel_2 = Panel(pshift)
item_2 = ListItem(List=object_3.Object, Index=pshift, Wrap=False)
cull_i = CullIndex(List=object_3.Object, Indices=pshift, Wrap=False)
pframe = PerpFrame(Curve=reparameterize(simplify.Curve), Parameter=".5")
cluster = Cluster_5(plane=pframe)
pln = Plane(cluster)
plnaxis = PlaneAxis(P=pln, B=35)
bbox = BoundingBox(Content=cull_i, Plane=pln)  # -> Box, Box_2
boxprop = BoxProperties(Box=bbox.Box)  # -> Center, Diagonal, Area, Volume, Degeneracy
cp = PlaneClosestPoint(Point=boxprop.Center, Plane=pln)  # -> Point, UVPoint, Distance
panel_3 = Panel("""-301 TO -5000
-300 TO 300
301 TO 5000""")
item_3 = ListItem(List=panel_3, Index=0, Wrap=True)  # -> Item, Item1, Item2
inc = Includes(Value=cp.Distance, Domain=item_3.Item)  # -> Includes, Deviation
inc_2 = Includes(Value=cp.Distance, Domain=item_3.Item1)  # -> Includes, Deviation
inc_3 = Includes(Value=cp.Distance, Domain=item_3.Item2)  # -> Includes, Deviation
cull = CullPattern(List=cull_i, CullPattern=inc.Includes)  # -> simplify(List)
cull_2 = CullPattern(List=cull_i, CullPattern=inc_2.Includes)  # -> simplify(List)
cull_3 = CullPattern(List=cull_i, CullPattern=inc_3.Includes)  # -> simplify(List)
append_element = AppendElement(Data=simplify(item_2), Index="1")
append_element_2 = AppendElement(Data=cull, Index="0")
append_element_3 = AppendElement(Data=cull_2, Index="1")
append_element_4 = AppendElement(Data=cull_3, Index="2")
merge = Merge(Data1=append_element_2, Data2=append_element_3, Data3=append_element_4, Data4=append_element)
object_4 = ModelObject(simplify(merge))
object_5 = ClusterOutput(object_4)

# ==== cluster Cluster_6
object = ClusterInput()
object_2 = ModelObject(object)
tstat = TreeStatistics(Tree=object_2)  # -> Paths, Length, Count
dpath = DeconstructPath(Branch=tstat.Paths)
item = ListItem(List=dpath, Index=0, Wrap=True)  # -> Item, Item1
B = ClusterInput()
equals = Equality(FirstNumber=item.Item1, SecondNumber=B)  # -> Equality, Inequality
dispatch = Dispatch(List=tstat.Paths, DispatchPattern=flatten(equals.Equality))  # -> ListA, ListB
branch = TreeBranch(Tree=object_2, Path=dispatch.ListA, MaintainPaths=True)
object_3 = ModelObject(branch)
object_4 = ClusterOutput(object_3)

# ==== cluster Cluster_7
txt = ClusterInput()
txt_2 = Text(txt)
tstat = TreeStatistics(Tree=txt_2)  # -> Paths, Length, Count
division = Division(A=tstat.Count, B=3)
S = ClusterInput()
series = Series(Start=S, Step="3", Count=division)
item = ListItem(List=tstat.Paths, Index=series, Wrap=True)
branch = TreeBranch(Tree=txt_2, Path=item, MaintainPaths=True)
B = ClusterOutput(branch)

# ==== cluster YAxisToZ
P = ClusterInput()
Z = UnitZ(Factor=1)
align = AlignPlane(Plane=P, Direction=Z)  # -> Plane, Angle
prot = RotatePlane(Plane=align.Plane, Angle=degrees("270"))
P_2 = ClusterOutput(prot)

# ==== cluster PlaneAxis: show plane X Y Z axis.
P = ClusterInput()
B = ClusterInput()
deplane = DeconstructPlane(Plane=graft(P))  # -> Origin, XAxis, YAxis, ZAxis
multiplication = Multiplication(A=[deplane.XAxis, deplane.YAxis, deplane.ZAxis], B=B)
vdisex = VectorDisplayEx(
    Point=deplane.Origin,
    Vector=multiplication,
    Colour=[ColourSwatch(SwatchColor=RGB(235, 52, 52)), ColourSwatch(SwatchColor=RGB(90, 207, 48)), ColourSwatch(SwatchColor=RGB(54, 126, 227))],
    Width=2)

# ==== cluster Cluster_5
plane = ClusterInput()
plane_2 = Plane(plane)
panel = Panel("""0
90
180
270""")
rotate = Rotate(Geometry=plane_2, Angle=degrees(panel), Plane=plane_2)  # -> Geometry, Transform
point = Point("0,10,0")
orient = Orient(Geometry=point, Source=PlaneXY(0, 0, 0), Target=rotate.Geometry)  # -> Geometry, Transform
deconstruct = Deconstruct(Point=orient.Geometry)  # -> XComponent, YComponent, ZComponent
sort_list = SortList(Keys=deconstruct.ZComponent, ValuesValuesA=rotate.Geometry)  # -> Keys, ValuesValuesA
list_item = ListItem(List=reverse(sort_list.ValuesValuesA), Index=0, Wrap=True)
plane_3 = Plane(list_item)
plane_4 = ClusterOutput(plane_3)
