# Grasshopper definition openshell_test_dbml.gh (Grasshopper 1.0.8)

n02f = ModelObject([<model object referenced from the Rhino model> x3])
n02f_2 = ModelObject([<model object referenced from the Rhino model> x15])
object = ModelObject([<model object referenced from the Rhino model> x7])
object_2 = ModelObject([<model object referenced from the Rhino model> x12])
object_3 = ModelObject(object_2)
block_definition = ModelBlockDefinition(BlockDefinition=object_3)  # -> BlockDefinition, Name
graft = GraftTree(Tree=block_definition.Name, IncludeEmptyLists=True, IncludeNullItems=True)  # -> simplify(Tree)
block_definition_2 = ModelBlockDefinition(BlockDefinition=graft)  # -> BlockDefinition, Name
split = TextSplit(Text=block_definition_2.Name, Separators="_")
graft_2 = GraftTree(Tree=block_definition.Name, IncludeEmptyLists=True, IncludeNullItems=True)  # -> simplify(Tree)
item = ListItem(List=reverse(split), Index=0, Wrap=True)
panel = Panel(graft_2)
txt = Text(simplify(item))
explode = ExplodeObject(Object=object_3, Recursive=False)
object_4 = ModelObject([<model object referenced from the Rhino model> x778])
cluster = Cluster(data=object_4, name="AL01")  # -> geo_2, obj
cluster_2 = Cluster(data=object_4, name="N68")  # -> geo_2, obj
cluster_3 = Cluster(data=object_4, name="N67")  # -> geo_2, obj
cluster_4 = Cluster(data=explode, name="N64")  # -> geo_2, obj
cluster_5 = Cluster(data=explode, name="N71")  # -> geo_2, obj
cluster_6 = Cluster(data=explode, name="N01")  # -> geo_2, obj
cluster_7 = Cluster(data=explode, name="N02")  # -> geo_2, obj
cluster_8 = Cluster(data=explode, name="N15")  # -> geo_2, obj
cluster_9 = Cluster(data=explode, name="N14")  # -> geo_2, obj
cluster_10 = Cluster(data=explode, name="N65")  # -> geo_2, obj
cluster_11 = Cluster(data=explode, name="N10")  # -> geo_2, obj
cluster_12 = Cluster(data=explode, name="N67 ")  # -> geo_2, obj
cluster_13 = Cluster(data=explode, name="N11")  # -> geo_2, obj
cluster_14 = Cluster(data=explode, name="N12")  # -> geo_2, obj
cluster_15 = Cluster(data=explode, name="N13")  # -> geo_2, obj
cluster_16 = Cluster(data=explode, name="N08")  # -> geo_2, obj
cluster_17 = Cluster(data=explode, name="N29")  # -> geo_2, obj
cluster_18 = Cluster(data=explode, name="N19")  # -> geo_2, obj
cluster_19 = Cluster(data=explode, name="N69")  # -> geo_2, obj
cluster_20 = Cluster(data=explode, name="N68 ")  # -> geo_2, obj
cluster_21 = Cluster(data=explode, name="N20 ")  # -> geo_2, obj
cluster_22 = Cluster(data=explode, name="AL01")  # -> geo_2, obj
cluster_23 = Cluster(data=explode, name="N66")  # -> geo_2, obj
cluster_24 = Cluster(data=explode, name="N28")  # -> geo_2, obj
cluster_25 = Cluster(data=explode, name="N20a")  # -> geo_2, obj
cluster_26 = Cluster(data=explode, name="N21")  # -> geo_2, obj
cluster_27 = Cluster(data=explode, name="AL02")  # -> geo_2, obj
cluster_28 = Cluster(data=explode, name="N61 ")  # -> geo_2, obj
cluster_29 = Cluster(data=explode, name="N32 ")  # -> geo_2, obj
cluster_30 = Cluster(data=explode, name="N32B")  # -> geo_2, obj
cluster_31 = Cluster(data=explode, name="N07")  # -> geo_2, obj
merge = Merge(Data1=cluster_3.obj, Data2=cluster_2.obj)
merge_2 = Merge(Data1=cluster_4.obj)
merge_3 = Merge(Data1=cluster_25.obj, Data2=cluster_26.obj)
merge_4 = Merge(Data1=cluster_28.obj, Data2=cluster_29.obj, Data3=cluster_30.obj)
merge_5 = Merge(Data1=cluster_22.obj, Data2=cluster_27.obj)
merge_6 = Merge(Data1=cluster_23.obj, Data2=cluster_24.obj, Data3=cluster_12.obj, Data4=cluster_20.obj, Data5=cluster_17.obj)
merge_7 = Merge(
    Data1=cluster_6.obj,
    Data2=cluster_7.obj,
    Data3=cluster_8.obj,
    Data4=cluster_11.obj,
    Data5=cluster_13.obj,
    Data6=cluster_14.obj,
    Data7=cluster_15.obj,
    Data8=cluster_9.obj)
merge_8 = Merge(
    Data1=cluster_31.obj,
    Data2=cluster_16.obj,
    Data3=cluster_18.obj,
    Data4=cluster_19.obj,
    Data5=cluster_21.obj,
    Data6=cluster_10.obj,
    Data7=cluster_5.obj)
list = ValueList({"Balcony", "Trim", "Fixed"}, selected="Trim")
list_2 = ValueList({"Balcony", "Trim", "Fixed"}, selected="Balcony")
list_3 = ValueList({"Vertical", "Horizontal", "Loose"}, selected="Horizontal")
list_4 = ValueList({"Vertical", "Horizontal", "Loose"}, selected="Vertical")
py3 = Python3Script(Obj=merge, Category=list, BulkContainerId="TRIMLAAA")  # -> out, Log, MatData; inputs Obj: tree, Category: String, BulkContainerId: String
# ---------- py3: Python ----------
import sys, os, importlib

# Rhino/GH 裡通常能拿到目前 .gh 的路徑
import Grasshopper as gh
ghdoc_path = gh.Instances.ActiveCanvas.Document.FilePath  # 可能是空字串（未存檔）
if not ghdoc_path:
    raise Exception("GH document not saved yet. Save .gh first to use relative module path.")

proj_dir = os.path.dirname(ghdoc_path)
module_dir = os.path.join(proj_dir, "py_modules")

if module_dir not in sys.path:
    sys.path.append(module_dir)

import ifc_bulk_builder_fixed
importlib.reload(ifc_bulk_builder_fixed)

MatData, Log = ifc_bulk_builder_fixed.build_bulk_matdata(Obj, Category, BulkContainerId)
# ---------- end py3 ----------
list_5 = ValueList({"Vertical", "Horizontal", "Loose"}, selected="Loose")
py3_2 = Python3Script(Obj=cluster.obj, Category=list_2, BulkContainerId="BALCONY")  # -> out, Log, MatData; inputs Obj: tree, Category: String, BulkContainerId: String; same code as py3
list_6 = ValueList({"Vertical", "Horizontal", "Loose"}, selected="Horizontal")
list_7 = ValueList({"Vertical", "Horizontal", "Loose"}, selected="Horizontal")
list_8 = ValueList({"Vertical", "Horizontal", "Loose"}, selected="Vertical")
list_9 = ValueList({"Vertical", "Horizontal", "Loose"}, selected="Loose")
py3_3 = Python3Script(Obj=merge_7, Category=list_8, UnitId=graft_2)  # -> out, Log, MatData; inputs Obj: tree, Category: String, UnitId: tree of String
# ---------- py3_3: Python ----------
import sys, os, importlib

# Rhino/GH 裡通常能拿到目前 .gh 的路徑
import Grasshopper as gh
ghdoc_path = gh.Instances.ActiveCanvas.Document.FilePath  # 可能是空字串（未存檔）
if not ghdoc_path:
    raise Exception("GH document not saved yet. Save .gh first to use relative module path.")

proj_dir = os.path.dirname(ghdoc_path)
module_dir = os.path.join(proj_dir, "py_modules")

if module_dir not in sys.path:
    sys.path.append(module_dir)

import ifc_builder_fixed
importlib.reload(ifc_builder_fixed)

MatData, Log = ifc_builder_fixed.build_matdata(Obj, Category, UnitId)
# ---------- end py3_3 ----------
py3_4 = Python3Script(Obj=merge_8, Category=list_7, UnitId=graft_2)  # -> out, Log, MatData; inputs Obj: tree, Category: String, UnitId: tree of String; same code as py3_3
py3_5 = Python3Script(Obj=merge_4, Category=list_9, UnitId=graft_2)  # -> out, Log, MatData; inputs Obj: tree, Category: String, UnitId: tree of String; same code as py3_3
py3_6 = Python3Script(Obj=merge_5, Category=list_5, UnitId=graft_2)  # -> out, Log, MatData; inputs Obj: tree, Category: String, UnitId: tree of String; same code as py3_3
py3_7 = Python3Script(Obj=merge_6, Category=list_6, UnitId=graft_2)  # -> out, Log, MatData; inputs Obj: tree, Category: String, UnitId: tree of String; same code as py3_3
py3_8 = Python3Script(Obj=merge_3, Category=list_3, UnitId=graft_2)  # -> out, Log, MatData; inputs Obj: tree, Category: String, UnitId: tree of String; same code as py3_3
py3_9 = Python3Script(Obj=merge_2, Category=list_4, UnitId=graft_2)  # -> out, Log, MatData; inputs Obj: tree, Category: String, UnitId: tree of String; same code as py3_3
py3_10 = Python3Script(MatData=flatten(py3.MatData), Name="BulkTrimAssembly", Role="BulkTrimRole")  # -> out, MatData; inputs MatData: list, Name: String
# ---------- py3_10: Python ----------
import sys, os, importlib
import Grasshopper as gh

ghdoc_path = gh.Instances.ActiveCanvas.Document.FilePath
if not ghdoc_path:
    raise Exception("GH document not saved yet. Save .gh first to use relative module path.")

proj_dir = os.path.dirname(ghdoc_path)
module_dir = os.path.join(proj_dir, "py_modules")
if module_dir not in sys.path:
    sys.path.append(module_dir)

import ifc_assembly_fixed
importlib.reload(ifc_assembly_fixed)

MatDataOut, Log = ifc_assembly_fixed.annotate_subassembly(MatData, Name, None, Role)
# ---------- end py3_10 ----------
py3_11 = Python3Script(MatData=flatten(py3_6.MatData), Name="looseTrimAssembly", Role="looseTrimRole")  # -> out, MatData; inputs MatData: list, Name: String; same code as py3_10
merge_9 = Merge(Data1=py3_11.MatData, Data2=py3_7.MatData)
merge_10 = Merge(Data1=py3_10.MatData, Data2=py3_2.MatData)
merge_11 = Merge(Data1=py3_3.MatData, Data2=py3_4.MatData, Data3=py3_5.MatData)
py3_12 = Python3Script(MatData=flatten(merge_9), Name="trimAssembly", Role="trimRole")  # -> out, MatData; inputs MatData: list, Name: String; same code as py3_10
py3_13 = Python3Script(MatData=flatten(merge_11), Name="frameAssembly", Role="frameRole")  # -> out, MatData; inputs MatData: list, Name: String; same code as py3_10
py3_14 = Python3Script()  # -> main_path
# ---------- py3_14: Python ----------
import os
gh_doc = ghenv.Component.OnPingDocument()

main_path = os.path.dirname(gh_doc.FilePath)
# ---------- end py3_14 ----------
path = FilePath("D:\Kevin\GH\ifc_test\")
merge_12 = Merge(Data1=py3_13.MatData, Data2=py3_12.MatData, Data3=py3_8.MatData, Data4=py3_9.MatData, Data5=merge_10)
concat = Concatenate(FragmentA=py3_14, FragmentC="\ifc_test_file\N03F_fixed.ifc")

# ----
# import mode
py3_15 = Python3Script(
    MatData=flatten(merge_12),
    UnitIdTree=graft_2,
    BayNoTree=txt,
    StoreyName="N02F",
    StoreyElev=Slider(9, range=0..100),
    OutPath=concat,
    Run=Toggle(False))  # -> out, OK, Log; inputs MatData: list, UnitIdTree: tree of String, BayNoTree: tree of String, StoreyName: String, StoreyElev: Double, OutPath: String, Run: Boolean
# ---------- py3_15: Python ----------
import sys, os, importlib

# Rhino/GH 裡通常能拿到目前 .gh 的路徑
import Grasshopper as gh
ghdoc_path = gh.Instances.ActiveCanvas.Document.FilePath  # 可能是空字串（未存檔）
if not ghdoc_path:
    raise Exception("GH document not saved yet. Save .gh first to use relative module path.")

proj_dir = os.path.dirname(ghdoc_path)
module_dir = os.path.join(proj_dir, "py_modules")

if module_dir not in sys.path:
    sys.path.append(module_dir)

import ifc_exporter_fixed
importlib.reload(ifc_exporter_fixed) #development mode

OK, Log, ResolvedOutPath = ifc_exporter_fixed.export_ifc_from_matdata(
    Run,
    MatData,
    StoreyName,
    StoreyElev,
    OutPath
)
# ---------- end py3_15 ----------

panel_2 = Panel(py3_15.Log)

# ==== cluster Cluster
name = ClusterInput()
data = ClusterInput()
name_2 = Text(name)
filterdata = FilterData(data=simplify(data), mode=0, filter=name_2)  # -> object_3, bool_2
clean = CleanTree(RemoveNulls=True, RemoveInvalid=True, RemoveEmpty=invert(False), Tree=filterdata.object_3)
lng = ListLength(List=flatten(clean))
rep = ReplaceText(Text=name_2, Find=" ", RecursiveReplace=False)
guid = CreateGUID(NumberOfGuids=lng, Format="Hyphens")
repeat = RepeatData(Data=rep, Length=lng)
unflatten = UnflattenTree(Tree=repeat, Guide=clean)  # -> graft(Tree)
unflatten_2 = UnflattenTree(Tree=guid, Guide=clean)  # -> graft(Tree)
merge = Merge(Data1=unflatten, Data2=unflatten_2)
join = TextJoin(Text=merge, Join="_")
unflatten_3 = UnflattenTree(Tree=clean, Guide=join)
trimbranch = TrimBranch(tree=unflatten_3, level="1")  # -> result; inputs tree: tree, level: Int32
# ---------- trimbranch: Python ----------
from Grasshopper import DataTree
from Grasshopper.Kernel.Data import GH_Path
from Grasshopper.Kernel import GH_RuntimeMessageLevel

if tree is None or level is None or tree.DataCount==0:
    ghenv.Component.AddRuntimeMessage(
        GH_RuntimeMessageLevel.Warning,
        "data is empty"
    )

def integrate_branches(data_tree, level):
    new_tree = DataTree[object]()
    
    # 遍歷數據樹的每個分支
    for i in range(data_tree.BranchCount):
        path = data_tree.Path(i)  # 取得當前分支的路徑
        items = data_tree.Branch(i)  # 取得當前分支的數據
        
        # 根據指定層級截取路徑
        new_path_indices = [path[j] for j in range(level) if j < path.Length]
        new_path = GH_Path(new_path_indices)
        
        # 將數據添加到新的分支
        for item in items:
            new_tree.Add(item, new_path)
    
    return new_tree

# 輸入參數
# data_tree: 數據樹
# level_input: 整數，表示保留的層級數
result = integrate_branches(tree, level)
# ---------- end trimbranch ----------
trimbranch_2 = TrimBranch(tree=join, level="1")  # -> result; inputs tree: tree, level: Int32; same code as trimbranch
geo = Geometry(trimbranch)
py3 = Python3Script(Geo=geo, Guid=trimbranch_2)  # -> out, Obj; inputs Geo: tree of GeometryBase, Guid: tree
# ---------- py3: Python ----------
from Grasshopper.Kernel.Types import GH_ObjectWrapper
from Grasshopper import DataTree
from Grasshopper.Kernel.Data import GH_Path

def to_geometry(x):
    if isinstance(x, GH_ObjectWrapper):
        x = x.Value
    if hasattr(x, "Geometry"):
        g = x.Geometry
        if isinstance(g, GH_ObjectWrapper):
            g = g.Value
        return g
    return x

Obj = DataTree[object]()

for bi in range(Geo.BranchCount):
    path = Geo.Path(bi)
    geos = list(Geo.Branch(bi))
    guids = list(Guid.Branch(bi))

    if len(geos) != len(guids):
        raise Exception("Geo/Guid count mismatch at path {}".format(path))

    for i in range(len(geos)):
        Obj.Add(GH_ObjectWrapper([to_geometry(geos[i]), guids[i]]), path)
# ---------- end py3 ----------
geo_2 = ClusterOutput(geo)
obj = ClusterOutput(py3.Obj)

# ==== cluster FilterData
data = ClusterInput()
mode = ClusterInput()
filter = ClusterInput()
data_2 = ModelObject(data)
mode_2 = Integer(mode)
filter_2 = Data(filter)
object = ModelObject(Object=data_2)  # -> Object, Name, Layer
py3 = Python3Script(x=object.Object)  # -> a
# ---------- py3: Python ----------
if x:
    a = x
else:
    a = 'None'
# ---------- end py3 ----------
py3_2 = Python3Script(x=object.Name)  # -> a; same code as py3
py3_3 = Python3Script(x=object.Layer)  # -> a; same code as py3
matchtext = Python3Script(layerList=py3_3, searchList=filter_2)  # -> out_bool; inputs layerList: list, searchList: list of String
# ---------- matchtext: Python ----------
from ghpythonlib.components import MatchText
from Grasshopper import DataTree
from Grasshopper.Kernel.Data import GH_Path
from Grasshopper.Kernel import GH_RuntimeMessageLevel
from itertools import zip_longest

if layerList is None or searchList is None:
    ghenv.Component.AddRuntimeMessage(
        GH_RuntimeMessageLevel.Warning,
        "data is empty"
    )
else:
    def to_bool_seq(x):
        # 統一轉為「list[bool]」
        # IronPython 的 List 可以直接 list(x)
        if isinstance(x, bool) or x is None:
            return [bool(x)]
        try:
            # 若是 IronPython.Runtime.List、list、tuple 等可迭代
            return [bool(v) for v in list(x)]
        except TypeError:
            # 其他不可迭代的一律包成單一元素
            return [bool(x)]

    nest_bool = []
    for pattern in searchList:
        temp = MatchText(text=layerList, regex=pattern, case=True)
        seq = to_bool_seq(temp)     # 先規範化
        nest_bool.append(seq)

    # 只有一條序列 → 你想要：直接回傳它？還是壓成單一布林？
    # 1) 若要「逐欄結果」就直接複製那條：
    if len(nest_bool) == 1:
        out_bool = list(nest_bool[0])
    else:
        # 多條序列 → 逐欄 OR，長度不齊用 False 補齊
        out_bool = [any(col) for col in zip_longest(*nest_bool, fillvalue=False)]

    # 檢查
    # print(nest_bool)
    # print(out_bool)
# ---------- end matchtext ----------
matchtext_2 = Python3Script(layerList=py3_2, searchList=filter_2)  # -> out_bool; inputs layerList: list, searchList: list of String; same code as matchtext
matchtext_3 = Python3Script(layerList=py3, searchList=filter_2)  # -> out_bool; inputs layerList: list, searchList: list of String; same code as matchtext
tmatch = MatchText(Text=data_2, RegEx=filter_2, Case=True)
or = GateOr(A=tmatch, D=matchtext_3, B=matchtext_2, C=matchtext)
filter_3 = StreamFilter(Gate=mode_2, Stream0=or, Stream1=tmatch, Stream2=matchtext_3, Stream3=matchtext_2, Stream4=matchtext)
dispatch = Dispatch(List=data_2, DispatchPattern=filter_3)  # -> ListA, ListB
object_2 = ModelObject(dispatch.ListA)
bool = Boolean(filter_3)
bool_2 = ClusterOutput(bool)
object_3 = ClusterOutput(object_2)
