# Grasshopper definition openshell_test_v4.gh (Grasshopper 1.0.8)

# ----
# This is the way I synchronize the state of all components.
# Connect one of the outputs from the component that needs
#  to be synchronized to the template of the
# “Sync Component.”
# Then press the Run button to instantly update the inputs,
# outputs, and code of all components with the same name
# across the Grasshopper canvas.
assembly = Python3Script()  # -> out, Log, MatDataOut; inputs MatData: tree, Name: tree of String, KeySuffix: String, Key: tree of String, Value: tree of String, QtoName: tree of String, QtoKey: tree of String, QtoValue: tree of String, UnitId: tree of String
# ---------- assembly: Python ----------
import sys, os, importlib

# Rhino/GH 裡通常能拿到目前 .gh 的路徑
import Grasshopper as gh
ghdoc_path = gh.Instances.ActiveCanvas.Document.FilePath  # 可能是空字串（未存檔）
if not ghdoc_path:
    raise Exception("GH document not saved yet. Save .gh first to use relative module path.")

proj_dir = os.path.dirname(ghdoc_path)
module_dir = os.path.join(proj_dir, "py_modules")

if module_dir not in sys.path:
    sys.path.append(module_dir)

def reload_pkg(prefix: str):
    # reload children first (reverse length order)
    mods = [m for name, m in sys.modules.items() if name == prefix or name.startswith(prefix + ".")]
    mods.sort(key=lambda m: len(m.__name__), reverse=True)
    for m in mods:
        importlib.reload(m)

# 先 import utils（確保從 py_modules 來）
import utils

# (可選) 確認你抓到的是哪個 utils，避免載到別份
# import utils.gh_utils as gu
# print("utils path =", gu.__file__)

# reload utils 及其已載入子模組
reload_pkg("utils")


import ifc_assembly
importlib.reload(ifc_assembly)

MatDataOut, Log = ifc_assembly.annotate_subassembly(MatData, Name, KeySuffix, Role, Key, Value,QtoKey, QtoValue, QtoName, UnitId)
# ---------- end assembly ----------
unit_builder = Python3Script()  # -> out, Log, MatData; inputs Obj: tree, Category: String, UnitId: tree of String
# ---------- unit_builder: Python ----------
import sys, os, importlib

# Rhino/GH 裡通常能拿到目前 .gh 的路徑
import Grasshopper as gh
ghdoc_path = gh.Instances.ActiveCanvas.Document.FilePath  # 可能是空字串（未存檔）
if not ghdoc_path:
    raise Exception("GH document not saved yet. Save .gh first to use relative module path.")

proj_dir = os.path.dirname(ghdoc_path)
module_dir = os.path.join(proj_dir, "py_modules")

if module_dir not in sys.path:
    sys.path.append(module_dir)

def reload_pkg(prefix: str):
    # reload children first (reverse length order)
    mods = [m for name, m in sys.modules.items() if name == prefix or name.startswith(prefix + ".")]
    mods.sort(key=lambda m: len(m.__name__), reverse=True)
    for m in mods:
        importlib.reload(m)

# 先 import utils（確保從 py_modules 來）
import utils

# (可選) 確認你抓到的是哪個 utils，避免載到別份
# import utils.gh_utils as gu
# print("utils path =", gu.__file__)

# reload utils 及其已載入子模組
reload_pkg("utils")

# reload builder（讓它重新綁定新的 utils）
import ifc_unit_builder
importlib.reload(ifc_unit_builder)

MatData, Log = ifc_unit_builder.build_matdata(Obj, Category, UnitId)
# ---------- end unit_builder ----------
nonunit_builder = Python3Script()  # -> out, Log, MatData; inputs Obj: tree, Category: String
# ---------- nonunit_builder: Python ----------
import sys, os, importlib

# Rhino/GH 裡通常能拿到目前 .gh 的路徑
import Grasshopper as gh
ghdoc_path = gh.Instances.ActiveCanvas.Document.FilePath  # 可能是空字串（未存檔）
if not ghdoc_path:
    raise Exception("GH document not saved yet. Save .gh first to use relative module path.")

proj_dir = os.path.dirname(ghdoc_path)
module_dir = os.path.join(proj_dir, "py_modules")

if module_dir not in sys.path:
    sys.path.append(module_dir)

def reload_pkg(prefix: str):
    # reload children first (reverse length order)
    mods = [m for name, m in sys.modules.items() if name == prefix or name.startswith(prefix + ".")]
    mods.sort(key=lambda m: len(m.__name__), reverse=True)
    for m in mods:
        importlib.reload(m)

# 先 import utils（確保從 py_modules 來）
import utils

# (可選) 確認你抓到的是哪個 utils，避免載到別份
# import utils.gh_utils as gu
# print("utils path =", gu.__file__)

# reload utils 及其已載入子模組
reload_pkg("utils")

import ifc_nonUnit_builder
importlib.reload(ifc_nonUnit_builder)

MatData, Log = ifc_nonUnit_builder.build_nonUnit_matdata(Obj, Category)
# ---------- end nonunit_builder ----------
bulk_builder = Python3Script()  # -> out, Log, MatData; inputs Obj: tree, Category: String, Scope: String, UnitId: tree of String
# ---------- bulk_builder: Python ----------
import sys, os, importlib

# Rhino/GH 裡通常能拿到目前 .gh 的路徑
import Grasshopper as gh
ghdoc_path = gh.Instances.ActiveCanvas.Document.FilePath  # 可能是空字串（未存檔）
if not ghdoc_path:
    raise Exception("GH document not saved yet. Save .gh first to use relative module path.")

proj_dir = os.path.dirname(ghdoc_path)
module_dir = os.path.join(proj_dir, "py_modules")

if module_dir not in sys.path:
    sys.path.append(module_dir)

def reload_pkg(prefix: str):
    # reload children first (reverse length order)
    mods = [m for name, m in sys.modules.items() if name == prefix or name.startswith(prefix + ".")]
    mods.sort(key=lambda m: len(m.__name__), reverse=True)
    for m in mods:
        importlib.reload(m)

# 先 import utils（確保從 py_modules 來）
import utils

# (可選) 確認你抓到的是哪個 utils，避免載到別份
# import utils.gh_utils as gu
# print("utils path =", gu.__file__)

# reload utils 及其已載入子模組
reload_pkg("utils")

# reload builder（讓它重新綁定新的 utils）
import ifc_bulk_builder
importlib.reload(ifc_bulk_builder)

MatData, Log = ifc_bulk_builder.build_bulk_matdata(Obj, Category, Scope, UnitId)
# ---------- end bulk_builder ----------
group = Python3Script()  # -> out, Log, MatData; inputs Obj: tree, Names: tree of String
# ---------- group: Python ----------
import sys, os, importlib

# Rhino/GH 裡通常能拿到目前 .gh 的路徑
import Grasshopper as gh
ghdoc_path = gh.Instances.ActiveCanvas.Document.FilePath  # 可能是空字串（未存檔）
if not ghdoc_path:
    raise Exception("GH document not saved yet. Save .gh first to use relative module path.")

proj_dir = os.path.dirname(ghdoc_path)
module_dir = os.path.join(proj_dir, "py_modules")

if module_dir not in sys.path:
    sys.path.append(module_dir)

def reload_pkg(prefix: str):
    # reload children first (reverse length order)
    mods = [m for name, m in sys.modules.items() if name == prefix or name.startswith(prefix + ".")]
    mods.sort(key=lambda m: len(m.__name__), reverse=True)
    for m in mods:
        importlib.reload(m)

# 先 import utils（確保從 py_modules 來）
import utils

# (可選) 確認你抓到的是哪個 utils，避免載到別份
# import utils.gh_utils as gu
# print("utils path =", gu.__file__)

# reload utils 及其已載入子模組
reload_pkg("utils")

# reload builder（讓它重新綁定新的 utils）
import ifc_group
importlib.reload(ifc_group)

MatData, Log = ifc_group.annotate_group(Obj, Names)
# ---------- end group ----------
override = Python3Script()  # -> out, Log, MatData; inputs Obj: tree, Key: tree of String, Value: tree of String, UnitId: tree of String
# ---------- override: Python ----------
import sys, os, importlib

# Rhino/GH 裡通常能拿到目前 .gh 的路徑
import Grasshopper as gh
ghdoc_path = gh.Instances.ActiveCanvas.Document.FilePath  # 可能是空字串（未存檔）
if not ghdoc_path:
    raise Exception("GH document not saved yet. Save .gh first to use relative module path.")

proj_dir = os.path.dirname(ghdoc_path)
module_dir = os.path.join(proj_dir, "py_modules")

if module_dir not in sys.path:
    sys.path.append(module_dir)

def reload_pkg(prefix: str):
    # reload children first (reverse length order)
    mods = [m for name, m in sys.modules.items() if name == prefix or name.startswith(prefix + ".")]
    mods.sort(key=lambda m: len(m.__name__), reverse=True)
    for m in mods:
        importlib.reload(m)

# 先 import utils（確保從 py_modules 來）
import utils

# (可選) 確認你抓到的是哪個 utils，避免載到別份
# import utils.gh_utils as gu
# print("utils path =", gu.__file__)

# reload utils 及其已載入子模組
reload_pkg("utils")

import ifc_override
importlib.reload(ifc_override)

MatData, Log = ifc_override.override_obj_tree(Obj, Key, Value, UnitId)
# ---------- end override ----------
sync_component = CSharpScript(Run=Button())  # -> out, Log; inputs Run: Boolean, Template: tree
# ---------- sync_component: C# ----------
// Grasshopper Script Instance
#region Usings
using System;
using System.Linq;
using System.Collections;
using System.Collections.Generic;
using System.Drawing;

using Rhino;
using Rhino.Geometry;

using Grasshopper;
using Grasshopper.Kernel;
using Grasshopper.Kernel.Data;
using Grasshopper.Kernel.Types;
#endregion


public class Script_Instance : GH_ScriptInstance
{
  private void RunScript(bool Run, DataTree<object> Template, ref object Log)
  {
    if (!Run)
    {
      Log = "Run = false";
      return;
    }

    GH_Document doc = GrasshopperDocument;
    if (doc == null)
    {
      Log = "No GH_Document";
      return;
    }

    // ---------------------------
    // Phase 1: 回溯 Template（只讀）
    // ---------------------------
    if (Component.Params.Input.Count < 2)
    {
      Log = "Template input missing";
      return;
    }

    var templateInput = Component.Params.Input[1];
    if (templateInput.Sources.Count == 0)
    {
      Log = "Template input has no source wire";
      return;
    }

    IGH_Param src = templateInput.Sources[0];
    IGH_DocumentObject topObj =
      src.Attributes?.GetTopLevel?.DocObject ??
      src.Attributes?.Parent?.DocObject;

    IGH_Component templateComp = topObj as IGH_Component;
    if (templateComp == null)
    {
      Log = "Upstream object is not an IGH_Component";
      return;
    }

    string targetName = templateComp.NickName;
    Guid templateComponentGuid = templateComp.ComponentGuid;
    Guid templateInstanceGuid = templateComp.InstanceGuid;

    if (string.IsNullOrWhiteSpace(targetName))
    {
      Log = "Template NickName is empty";
      return;
    }

    List<Guid> oldIds = doc.Objects
      .OfType<IGH_Component>()
      .Where(c => c.InstanceGuid != templateInstanceGuid)
      .Where(c => c.NickName == targetName)
      .Select(c => c.InstanceGuid)
      .ToList();

    if (oldIds.Count == 0)
    {
      Log = "No components to replace";
      return;
    }

    // ---------------------------
    // Phase 2: 延後修改（安全）
    // ---------------------------
    doc.ScheduleSolution(1, d =>
    {
      ReplaceComponents(d, templateComponentGuid, templateInstanceGuid, oldIds);
    });

    Log = "Scheduled replace: " + oldIds.Count;
  }

  // ============================================================
  // Replace + Rewire + Keep Position
  // ============================================================
  private void ReplaceComponents(
    GH_Document doc,
    Guid templateComponentGuid,
    Guid templateInstanceGuid,
    List<Guid> oldInstanceIds
  )
  {
    var proxy = Instances.ComponentServer.ObjectProxies
      .FirstOrDefault(p => p.Guid == templateComponentGuid);
    if (proxy == null) return;

    var templateObj = doc.FindObject(templateInstanceGuid, false) as IGH_Component;
    if (templateObj == null) return;

    doc.UndoUtil.RecordEvent("Replace components");

    string Key(IGH_Param p)
    {
      return string.IsNullOrWhiteSpace(p.NickName) ? p.Name : p.NickName;
    }

    foreach (var id in oldInstanceIds)
    {
      IGH_Component oldObj = doc.FindObject(id, false) as IGH_Component;
      if (oldObj == null) continue;

      // -------- 0) 記錄舊位置（Pivot）--------
      // 你要的：替換後還在原位
      PointF oldPivot = PointF.Empty;
      try
      {
        if (oldObj.Attributes == null) oldObj.CreateAttributes();
        oldPivot = oldObj.Attributes.Pivot;
      }
      catch { }

      // -------- 1) 記錄舊連線 --------
      var oldInWires = oldObj.Params.Input
        .ToDictionary(p => Key(p), p => p.Sources.ToList());

      var oldOutWires = oldObj.Params.Output
        .ToDictionary(p => Key(p), p => p.Recipients.ToList());

      // -------- 2) 建立新元件 --------
      IGH_Component newC = proxy.CreateInstance() as IGH_Component;
      if (newC == null) continue;

      newC.CreateAttributes();

      // 先放到舊位置（等下 Clone 會蓋掉，所以還要再設一次）
      newC.Attributes.Pivot = oldPivot;

      // NickName 維持（用於你後續同名管理）
      newC.NickName = oldObj.NickName;

      doc.AddObject(newC, false);

      // -------- 3) 複製 Template 狀態（含 GhPython script / IO）--------
      CloneComponentState(templateObj, newC);

      // 🔥 重要：Clone 可能把 Pivot 蓋成 template 的位置
      // 所以一定要在 Clone 之後再把 Pivot 設回來
      if (newC.Attributes == null) newC.CreateAttributes();
      newC.Attributes.Pivot = oldPivot;
      newC.Attributes.ExpireLayout(); // 讓 GH 重新算 bounds

      // -------- 4) 建立新 IO 對照表 --------
      var newInMap = newC.Params.Input
        .GroupBy(Key)
        .ToDictionary(g => g.Key, g => g.First());

      var newOutMap = newC.Params.Output
        .GroupBy(Key)
        .ToDictionary(g => g.Key, g => g.First());

      // -------- 5) INPUT：來源 → 新 input --------
      foreach (var kv in oldInWires)
      {
        if (!newInMap.TryGetValue(kv.Key, out IGH_Param newIn)) continue;

        foreach (var s in kv.Value)
          newIn.AddSource(s);
      }

      // -------- 6) OUTPUT：新 output → 舊 recipients --------
      foreach (var kv in oldOutWires)
      {
        if (!newOutMap.TryGetValue(kv.Key, out IGH_Param newOut)) continue;

        foreach (var r in kv.Value)
          r.AddSource(newOut);
      }

      // -------- 7) 刪除舊元件 --------
      doc.RemoveObject(oldObj, false);
    }
  }

  // ============================================================
  // Clone component instance state via GH_Archive
  // (works across GH versions; includes GhPython script)
  // ============================================================
  private bool CloneComponentState(IGH_Component source, IGH_Component target)
  {
    if (source == null || target == null) return false;

    var archive = new GH_Archive();
    archive.AppendObject(source, "Component");
    return archive.ExtractObject(target, "Component");
  }
}
# ---------- end sync_component ----------

allgroup = Python3Script()  # -> out, Log, MatData; inputs Obj: tree, Name: tree of String, Key: tree of String, Value: tree of String, QtoName: tree of String, QtoKey: tree of String, QtoValue: tree of String
# ---------- allgroup: Python ----------
import sys, os, importlib

# Rhino/GH 裡通常能拿到目前 .gh 的路徑
import Grasshopper as gh
ghdoc_path = gh.Instances.ActiveCanvas.Document.FilePath  # 可能是空字串（未存檔）
if not ghdoc_path:
    raise Exception("GH document not saved yet. Save .gh first to use relative module path.")

proj_dir = os.path.dirname(ghdoc_path)
module_dir = os.path.join(proj_dir, "py_modules")

if module_dir not in sys.path:
    sys.path.append(module_dir)

def reload_pkg(prefix: str):
    # reload children first (reverse length order)
    mods = [m for name, m in sys.modules.items() if name == prefix or name.startswith(prefix + ".")]
    mods.sort(key=lambda m: len(m.__name__), reverse=True)
    for m in mods:
        importlib.reload(m)

# 先 import utils（確保從 py_modules 來）
import utils

# (可選) 確認你抓到的是哪個 utils，避免載到別份
# import utils.gh_utils as gu
# print("utils path =", gu.__file__)

# reload utils 及其已載入子模組
reload_pkg("utils")

# reload builder（讓它重新綁定新的 utils）
import ifc_allGroup
importlib.reload(ifc_allGroup)

MatData, Log = ifc_allGroup.annotate_all_group(Obj, Name, Key, Value, QtoName, QtoKey, QtoValue)
# ---------- end allgroup ----------
qto = Python3Script()  # -> out, Log, MatData; inputs Obj: tree, Key: tree of String, Value: tree of String
# ---------- qto: Python ----------
import sys, os, importlib

# Rhino/GH 裡通常能拿到目前 .gh 的路徑
import Grasshopper as gh
ghdoc_path = gh.Instances.ActiveCanvas.Document.FilePath  # 可能是空字串（未存檔）
if not ghdoc_path:
    raise Exception("GH document not saved yet. Save .gh first to use relative module path.")

proj_dir = os.path.dirname(ghdoc_path)
module_dir = os.path.join(proj_dir, "py_modules")

if module_dir not in sys.path:
    sys.path.append(module_dir)

def reload_pkg(prefix: str):
    # reload children first (reverse length order)
    mods = [m for name, m in sys.modules.items() if name == prefix or name.startswith(prefix + ".")]
    mods.sort(key=lambda m: len(m.__name__), reverse=True)
    for m in mods:
        importlib.reload(m)

# 先 import utils（確保從 py_modules 來）
import utils

# (可選) 確認你抓到的是哪個 utils，避免載到別份
# import utils.gh_utils as gu
# print("utils path =", gu.__file__)

# reload utils 及其已載入子模組
reload_pkg("utils")

# reload builder（讓它重新綁定新的 utils）
import ifc_qto
importlib.reload(ifc_qto)

MatData, Log = ifc_qto.annotate_qto(Obj, Key, Value)
# ---------- end qto ----------
cluster = Cluster_3(layername="##_Kevin::")
object = ModelObject([<model object referenced from the Rhino model> x14])
txt = Text(object)
split = TextSplit(Text=txt, Separators=":")
item = ListItem(List=split, Index="1", Wrap=True)
split_2 = TextSplit(Text=item, Separators="_")
item_2 = ListItem(List=reverse(split_2), Index=0, Wrap=True)
num = Number(flatten(item_2))
sort = SortList(Keys=num, ValuesA=object)  # -> Keys, ValuesA

# ----
# Unit Blocks
object_2 = ModelObject(sort.ValuesA)

explode = ExplodeObject(Object=object_2, Recursive=False)
block_definition = ModelBlockDefinition(BlockDefinition=object_2)  # -> BlockDefinition, Name
graft = GraftTree(Tree=block_definition.Name, IncludeEmptyLists=True, IncludeNullItems=True)  # -> simplify(Tree)
block_definition_2 = ModelBlockDefinition(BlockDefinition=graft)  # -> BlockDefinition, Name
split_3 = TextSplit(Text=block_definition_2.Name, Separators="_")
rename = Rename(O=explode)
item_3 = ListItem(List=reverse(split_3), Index=0, Wrap=True)
txt_2 = Text(simplify(item_3))

# ----
# NonUnit Part (Balcony)
object_3 = ModelObject([<model object referenced from the Rhino model> x664])

graft_2 = GraftTree(Tree=block_definition.Name, IncludeEmptyLists=True, IncludeNullItems=True)  # -> simplify(Tree)

# ----
# NonUnit Part (Under Beam)
object_4 = ModelObject([<model object referenced from the Rhino model> x305])

# ----
# NonUnit Part (Embedded Pile)
object_5 = ModelObject([<model object referenced from the Rhino model> x92])

# ----
# Column
object_6 = ModelObject([<model object referenced from the Rhino model> x18])

# ----
# Beam
object_7 = ModelObject([<model object referenced from the Rhino model> x129])

# ----
# Slab
object_8 = ModelObject([<model object referenced from the Rhino model> x2])

# ----
# Balcony Inner Parts
panel = Panel("S02_upperBal")
cluster_2 = Cluster(data=object_3, mode="4", name="N71")  # -> geo_2, obj
cluster_3 = Cluster(data=object_3, mode=0, name="N35")  # -> geo_2, obj
cluster_4 = Cluster(data=object_3, mode=0, name="N65")  # -> geo_2, obj
cluster_5 = Cluster(data=object_3, mode=0, name=panel)  # -> geo_2, obj
cluster_6 = Cluster(data=object_3, mode=0, name="S02_downBal")  # -> geo_2, obj
cluster_7 = Cluster(data=object_3, mode=0, name="N53")  # -> geo_2, obj
cluster_8 = Cluster(data=object_3, mode=0, name="N07")  # -> geo_2, obj
cluster_9 = Cluster(data=object_3, mode=0, name="N01")  # -> geo_2, obj
cluster_10 = Cluster(data=object_3, mode=0, name="N87")  # -> geo_2, obj
cluster_11 = Cluster(data=object_3, mode=0, name="N32")  # -> geo_2, obj
cluster_12 = Cluster(data=object_3, mode=0, name="N02")  # -> geo_2, obj
cluster_13 = Cluster(data=object_3, mode=0, name="N69")  # -> geo_2, obj

# ----
# Balcony Ceiling
panel_2 = Panel("S02_ceiling")
cluster_14 = Cluster(data=object_3, mode=0, name=panel_2)  # -> geo_2, obj
cluster_15 = Cluster(data=object_3, mode=0, name="N79 ")  # -> geo_2, obj
cluster_16 = Cluster(data=object_3, mode=0, name="F19")  # -> geo_2, obj
cluster_17 = Cluster(data=object_3, mode=0, name="N79a")  # -> geo_2, obj
cluster_18 = Cluster(data=object_3, mode=0, name="N09")  # -> geo_2, obj
cluster_19 = Cluster(data=object_3, mode=0, name="N78")  # -> geo_2, obj
cluster_20 = Cluster(data=object_3, mode=0, name="角鋁 ")  # -> geo_2, obj
cluster_21 = Cluster(data=object_3, mode=0, name="N76")  # -> geo_2, obj
cluster_22 = Cluster(data=object_3, mode=0, name="F10")  # -> geo_2, obj
cluster_23 = Cluster(data=object_3, mode=0, name="AL01_ceiling")  # -> geo_2, obj

# ----
# Fastener
panel_3 = Panel(" L01")
cluster_24 = Cluster(data=rename, mode=0, name=panel_3)  # -> geo_2, obj

# ----
# Second Stage Extrusion
panel_4 = Panel("N20 ")
cluster_25 = Cluster(data=rename, mode=0, name=panel_4)  # -> geo_2, obj
cluster_26 = Cluster(data=rename, mode=0, name="N20a")  # -> geo_2, obj
cluster_27 = Cluster(data=rename, mode=0, name="N21")  # -> geo_2, obj
cluster_28 = Cluster(data=rename, mode=0, name="N65")  # -> geo_2, obj
cluster_29 = Cluster(data=rename, mode=0, name="N86")  # -> geo_2, obj
cluster_30 = Cluster(data=rename, mode=0, name="S02")  # -> geo_2, obj
cluster_31 = Cluster(data=rename, mode=0, name="N71")  # -> geo_2, obj
cluster_32 = Cluster(data=rename, mode=0, name="N64")  # -> geo_2, obj

# ----
# Balcony Trim Panel
panel_5 = Panel("N66")
cluster_33 = Cluster(data=object_3, mode=0, name=panel_5)  # -> geo_2, obj
cluster_34 = Cluster(data=object_3, mode=0, name="SSL")  # -> geo_2, obj
cluster_35 = Cluster(data=object_3, mode=0, name="N28")  # -> geo_2, obj
cluster_36 = Cluster(data=object_3, mode=0, name="S07")  # -> geo_2, obj
cluster_37 = Cluster(data=object_3, mode=0, name="N68")  # -> geo_2, obj
cluster_38 = Cluster(data=object_3, mode=0, name="N77")  # -> geo_2, obj
cluster_39 = Cluster(data=object_3, mode=0, name="N67")  # -> geo_2, obj

# ----
# Balcony Soffit Parts
panel_6 = Panel("N58")
cluster_40 = Cluster(data=object_3, mode=0, name="S02_soffit")  # -> geo_2, obj
cluster_41 = Cluster(data=object_3, mode=0, name=panel_6)  # -> geo_2, obj
cluster_42 = Cluster(data=object_3, mode=0, name="N59")  # -> geo_2, obj
cluster_43 = Cluster(data=object_3, mode=0, name="N56")  # -> geo_2, obj
cluster_44 = Cluster(data=object_3, mode=0, name="F20")  # -> geo_2, obj
cluster_45 = Cluster(data=object_3, mode=0, name="N60_verti")  # -> geo_2, obj
cluster_46 = Cluster(data=object_3, mode=0, name="AL01_down")  # -> geo_2, obj
cluster_47 = Cluster(data=object_3, mode=0, name="N60_hori")  # -> geo_2, obj

# ----
# vertical main extrusion
panel_7 = Panel("N01")
cluster_48 = Cluster(data=rename, mode=0, name=panel_7)  # -> geo_2, obj
cluster_49 = Cluster(data=rename, mode=0, name="N02")  # -> geo_2, obj

# ----
# Accessory Parts
panel_8 = Panel("N61B")
cluster_50 = Cluster(data=rename, mode=0, name=panel_8)  # -> geo_2, obj
cluster_51 = Cluster(data=rename, mode=0, name="N61 ")  # -> geo_2, obj
cluster_52 = Cluster(data=rename, mode=0, name="N42L")  # -> geo_2, obj
cluster_53 = Cluster(data=rename, mode=0, name="N42R")  # -> geo_2, obj
cluster_54 = Cluster(data=rename, mode=0, name="N42 ")  # -> geo_2, obj

# ----
# Butterfly-fin Part
panel_9 = Panel("N85")
cluster_55 = Cluster(data=rename, mode=0, name=panel_9)  # -> geo_2, obj
cluster_56 = Cluster(data=rename, mode=0, name="N84")  # -> geo_2, obj
cluster_57 = Cluster(data=rename, mode=0, name="N15")  # -> geo_2, obj
cluster_58 = Cluster(data=rename, mode=0, name="N14")  # -> geo_2, obj
cluster_59 = Cluster(data=rename, mode=0, name="N10")  # -> geo_2, obj
cluster_60 = Cluster(data=rename, mode=0, name="N11")  # -> geo_2, obj
cluster_61 = Cluster(data=rename, mode=0, name="N12")  # -> geo_2, obj
cluster_62 = Cluster(data=rename, mode=0, name="N13")  # -> geo_2, obj

# ----
# Unit Fitting Parts
panel_10 = Panel("N32 ")
cluster_63 = Cluster(data=rename, mode=0, name=panel_10)  # -> geo_2, obj
cluster_64 = Cluster(data=rename, mode=0, name="N32B")  # -> geo_2, obj

# ----
# Trim Panel
panel_11 = Panel("N67 ")
cluster_65 = Cluster(data=rename, mode=0, name=panel_11)  # -> geo_2, obj
cluster_66 = Cluster(data=rename, mode=0, name="N29")  # -> geo_2, obj
cluster_67 = Cluster(data=rename, mode=0, name="N68 ")  # -> geo_2, obj
cluster_68 = Cluster(data=rename, mode=0, name="AL01")  # -> geo_2, obj
cluster_69 = Cluster(data=rename, mode=0, name="N66")  # -> geo_2, obj
cluster_70 = Cluster(data=rename, mode=0, name="N28")  # -> geo_2, obj
cluster_71 = Cluster(data=rename, mode=0, name="AL02")  # -> geo_2, obj
cluster_72 = Cluster(data=rename, mode=0, name="SSL_2")  # -> geo_2, obj
cluster_73 = Cluster(data=rename, mode=0, name="N30")  # -> geo_2, obj

# ----
# horizontal main extrusion
panel_12 = Panel("N19")
cluster_74 = Cluster(data=rename, mode=0, name="N08")  # -> geo_2, obj
cluster_75 = Cluster(data=rename, mode=0, name="N07")  # -> geo_2, obj
cluster_76 = Cluster(data=rename, mode=0, name=panel_12)  # -> geo_2, obj
cluster_77 = Cluster(data=rename, mode=0, name="N69")  # -> geo_2, obj
cluster_78 = Cluster(data=rename, mode=0, name="N35")  # -> geo_2, obj

# ----
# Balcony Bulk
panel_13 = Panel("S04")
cluster_79 = Cluster(data=object_3, mode=0, name=panel_13)  # -> geo_2, obj
cluster_80 = Cluster(data=object_3, mode=0, name="角鋁3")  # -> geo_2, obj
cluster_81 = Cluster(data=object_3, mode=0, name="角鋁2")  # -> geo_2, obj

# ----
# Balcony Pile Parts
panel_14 = Panel("F22")
cluster_82 = Cluster(data=object_3, mode=0, name=panel_14)  # -> geo_2, obj
cluster_83 = Cluster(data=object_3, mode=0, name="S09")  # -> geo_2, obj

panel_15 = Panel("""4F
5F""")
cluster_84 = Cluster(data=object_4, mode=0, name="F13")  # -> geo_2, obj
cluster_85 = Cluster(data=object_4, mode=0, name="F12")  # -> geo_2, obj
cluster_86 = Cluster(data=object_4, mode=0, name="N41")  # -> geo_2, obj
cluster_87 = Cluster(data=object_4, mode=0, name="F15")  # -> geo_2, obj
cluster_88 = Cluster(data=object_4, mode=0, name="F14")  # -> geo_2, obj
cluster_89 = Cluster(data=object_4, mode=0, name="N43")  # -> geo_2, obj
cluster_90 = Cluster(data=object_4, mode=0, name="F25")  # -> geo_2, obj
cluster_91 = Cluster(data=object_4, mode=0, name="F17")  # -> geo_2, obj
cluster_92 = Cluster(data=object_4, mode=0, name="F10")  # -> geo_2, obj
cluster_93 = Cluster(data=object_4, mode=0, name="F03")  # -> geo_2, obj
cluster_94 = Cluster(data=object_6, mode=0, name="COLS")  # -> geo_2, obj
cluster_95 = Cluster(data=object_4, mode=0, name="F02")  # -> geo_2, obj
cluster_96 = Cluster(data=object_4, mode=0, name="F11")  # -> geo_2, obj
cluster_97 = Cluster(data=object_5, mode=0, name="F08")  # -> geo_2, obj
cluster_98 = Cluster(data=object_5, mode=0, name="F13")  # -> geo_2, obj
cluster_99 = Cluster(data=object_5, mode=0, name="N43")  # -> geo_2, obj
cluster_100 = Cluster(data=object_5, mode=0, name="N41")  # -> geo_2, obj
cluster_101 = Cluster(data=object_7, mode=0, name="BEAM")  # -> geo_2, obj
cluster_102 = Cluster(data=object_8, mode=0, name=panel_15)  # -> geo_2, obj
merge = Merge(Data1=cluster_9.obj, Data2=cluster_12.obj, Data3=cluster_10.obj, Data4=cluster_7.obj)
merge_2 = Merge(Data1=cluster_13.obj, Data2=cluster_8.obj, Data3=cluster_2.obj, Data4=cluster_3.obj, Data5=cluster_4.obj)
merge_3 = Merge(Data1=cluster_5.obj, Data2=cluster_6.obj)
item_4 = ListItem(List=cluster_93.geo_2, Index=0, Wrap=True)

# ----
# Normal test:
# Check if the Key/Value works correctly in the non-unit case.
panel_16 = Panel("""AL01_OverrideTest_1
AL01_OverrideTest_2
AL01_OverrideTest_3""")
data = Data(cluster_23.obj)
mockdata = MockData(key=panel_16, obj=data)  # -> okey_2, ovalue_2

# ----
# Normal test:
# Check if the Key/Value works correctly in the non-unit case.
panel_17 = Panel("""N68_OverrideTest_1
N68_OverrideTest_2""")
data_2 = Data(cluster_37.obj)
mockdata_2 = MockData(key=panel_17, obj=data_2)  # -> okey_2, ovalue_2

# ----
# Normal test:
# Check if the Key/Value works correctly in the non-unit case.
panel_18 = Panel("""角鋁2_OverrideTest_1
角鋁2_OverrideTest_2""")
data_3 = Data(cluster_81.obj)
mockdata_3 = MockData(key=panel_18, obj=data_3)  # -> okey_2, ovalue_2

merge_4 = Merge(Data1=cluster_43.obj, Data2=cluster_41.obj, Data3=cluster_47.obj)
merge_5 = Merge(Data1=cluster_63.obj, Data2=cluster_64.obj)
merge_6 = Merge(Data1=cluster_98.obj, Data2=cluster_100.obj, Data3=cluster_99.obj, Data4=cluster_97.obj)
merge_7 = Merge(Data1=cluster_51.obj, Data2=cluster_50.obj, Data3=cluster_52.obj, Data4=cluster_53.obj, Data5=cluster_54.obj)

# ----
# Shared test:
# Check if the Key/Value is applied to all objects in the non-unit case.
panel_19 = Panel("""N67_CommonData_1
N67_CommonData_2""")
panel_20 = Panel("""N67_OverrideTest_1
N67_OverrideTest_2""")

merge_8 = Merge(Data1=cluster_46.obj, Data2=cluster_40.obj)
list = ValueList({"Vertical", "Horizontal", "Fitting", "Panel", "Glass", "Mullion", "Transom", "Bracket", "Accessory", "Fastener", "Bolt", "Screw"}, selected="Fastener")
list_2 = ValueList({"Unit": "UNIT", "Non Unit": "NON_UNIT"}, selected="Unit")
merge_9 = Merge(Data1=cluster_15.obj, Data2=cluster_17.obj, Data3=cluster_16.obj, Data4=cluster_18.obj)

# ----
# Normal test:
# Check if the Key/Value works correctly in the unit case.
panel_21 = Panel("""N20_OverrideTest_1
N20_OverrideTest_2""")
data_4 = Data(cluster_25.obj)
mockdata_4 = MockData(key=panel_21, obj=data_4)  # -> okey_2, ovalue_2
override_2 = Python3Script(Obj=data_4, Key=mockdata_4.okey_2, Value=mockdata_4.ovalue_2, UnitId=graft_2)  # -> out, Log, MatData; inputs Obj: tree, Key: tree of String, Value: tree of String, UnitId: tree of String; same code as override

group_2 = Python3Script(Obj=cluster_69.obj, Names="N66_Group")  # -> out, Log, MatData; inputs Obj: tree, Names: tree of String; same code as group
merge_10 = Merge(
    Data1=cluster_87.obj,
    Data2=cluster_85.obj,
    Data3=cluster_84.obj,
    Data4=cluster_86.obj,
    Data5=cluster_89.obj,
    Data6=cluster_95.obj,
    Data7=cluster_91.obj,
    Data8=cluster_90.obj,
    Data9=cluster_96.obj,
    Data10=cluster_93.obj,
    Data11=cluster_88.obj)
list_3 = ValueList({"Vertical", "Horizontal", "Fitting", "Panel", "Glass", "Mullion", "Transom", "Bracket", "Accessory", "Fastener", "Bolt", "Screw"}, selected="Bracket")
list_4 = ValueList({"Unit": "UNIT", "Non Unit": "NON_UNIT"}, selected="Non Unit")
group_3 = Python3Script(Obj=cluster_59.obj, Names="Butterfly-fin_Group")  # -> out, Log, MatData; inputs Obj: tree, Names: tree of String; same code as group
group_4 = Python3Script(Obj=cluster_61.obj, Names="Butterfly-fin_Group")  # -> out, Log, MatData; inputs Obj: tree, Names: tree of String; same code as group
group_5 = Python3Script(Obj=cluster_62.obj, Names="Butterfly-fin_Group")  # -> out, Log, MatData; inputs Obj: tree, Names: tree of String; same code as group
group_6 = Python3Script(Obj=cluster_58.obj, Names="Butterfly-fin_Group")  # -> out, Log, MatData; inputs Obj: tree, Names: tree of String; same code as group
group_7 = Python3Script(Obj=cluster_56.obj, Names="Butterfly-fin_Group")  # -> out, Log, MatData; inputs Obj: tree, Names: tree of String; same code as group
group_8 = Python3Script(Obj=cluster_55.obj, Names="Butterfly-fin_Group")  # -> out, Log, MatData; inputs Obj: tree, Names: tree of String; same code as group
list_5 = ValueList({"Vertical", "Horizontal", "Fitting", "Panel", "Glass", "Mullion", "Transom", "Bracket", "Accessory", "Fastener", "Bolt", "Screw", "Beam", "Column", "Slab", "Wall", "Footing", "Pile"}, selected="Pile")
list_6 = ValueList({"Vertical", "Horizontal", "Fitting", "Panel", "Glass", "Mullion", "Transom", "Bracket", "Accessory", "Fastener", "Bolt", "Screw", "Beam", "Column", "Slab", "Wall", "Footing", "Pile"}, selected="Accessory")
list_7 = ValueList({"Vertical", "Horizontal", "Fitting", "Panel", "Glass", "Mullion", "Transom", "Bracket", "Accessory", "Fastener", "Bolt", "Screw", "Beam", "Column", "Slab", "Wall", "Footing", "Pile"}, selected="Horizontal")
list_8 = ValueList({"Vertical", "Horizontal", "Fitting", "Panel", "Glass", "Mullion", "Transom", "Bracket", "Accessory", "Fastener", "Bolt", "Screw", "Beam", "Column", "Slab", "Wall", "Footing", "Pile"}, selected="Panel")
group_9 = Python3Script(Obj=cluster_60.obj, Names="Butterfly-fin_Group")  # -> out, Log, MatData; inputs Obj: tree, Names: tree of String; same code as group
list_9 = ValueList({"Vertical", "Horizontal", "Fitting", "Panel", "Glass", "Mullion", "Transom", "Bracket", "Accessory", "Fastener", "Bolt", "Screw", "Beam", "Column", "Slab", "Wall", "Footing", "Pile"}, selected="Fitting")
list_10 = ValueList({"Vertical", "Horizontal", "Fitting", "Panel", "Glass", "Mullion", "Transom", "Bracket", "Accessory", "Fastener", "Bolt", "Screw", "Beam", "Column", "Slab", "Wall", "Footing", "Pile"}, selected="Vertical")
bulk_builder_2 = Python3Script(Obj=cluster_24.obj, Category=list, Scope=list_2, UnitId=graft_2)  # -> out, Log, MatData; inputs Obj: tree, Category: String, Scope: String, UnitId: tree of String; same code as bulk_builder
cluster_103 = Cluster_6(D="L:N07", B=cluster_75.geo_2)  # -> D_2, result
cluster_104 = Cluster_6(D="L:N01", B=cluster_48.geo_2)  # -> D_2, result
cluster_105 = Cluster_6(D="L:N01", B=cluster_49.geo_2)  # -> D_2, result
override_3 = Python3Script(Obj=cluster_39.obj, Key=panel_20, Value=panel_19)  # -> out, Log, MatData; inputs Obj: tree, Key: tree of String, Value: tree of String, UnitId: tree of String; same code as override
list_11 = ValueList({"Vertical", "Horizontal", "Fitting", "Panel", "Glass", "Mullion", "Transom", "Bracket", "Accessory", "Fastener", "Bolt", "Screw", "Beam", "Column", "Slab", "Wall", "Footing", "Pile"}, selected="Fitting")
list_12 = ValueList({"Vertical", "Horizontal", "Fitting", "Panel", "Glass", "Mullion", "Transom", "Bracket", "Accessory", "Fastener", "Bolt", "Screw", "Beam", "Column", "Slab", "Wall", "Footing", "Pile"}, selected="Pile")
list_13 = ValueList({"Vertical", "Horizontal", "Fitting", "Panel", "Glass", "Mullion", "Transom", "Bracket", "Accessory", "Fastener", "Bolt", "Screw", "Beam", "Column", "Slab", "Wall", "Footing", "Pile"}, selected="Column")
list_14 = ValueList({"Vertical", "Horizontal", "Fitting", "Panel", "Glass", "Mullion", "Transom", "Bracket", "Accessory", "Fastener", "Bolt", "Screw", "Beam", "Column", "Slab", "Wall", "Footing", "Pile"}, selected="Beam")
nonunit_builder_2 = Python3Script(Obj=cluster_83.obj, Category=list_5)  # -> out, Log, MatData; inputs Obj: tree, Category: String; same code as nonunit_builder
nonunit_builder_3 = Python3Script(Obj=cluster_42.obj, Category=list_6)  # -> out, Log, MatData; inputs Obj: tree, Category: String; same code as nonunit_builder
nonunit_builder_4 = Python3Script(Obj=merge_4, Category=list_7)  # -> out, Log, MatData; inputs Obj: tree, Category: String; same code as nonunit_builder
nonunit_builder_5 = Python3Script(Obj=merge_8, Category=list_8)  # -> out, Log, MatData; inputs Obj: tree, Category: String; same code as nonunit_builder
list_15 = ValueList({"Vertical", "Horizontal", "Fitting", "Panel", "Glass", "Mullion", "Transom", "Bracket", "Accessory", "Fastener", "Bolt", "Screw", "Beam", "Column", "Slab", "Wall", "Footing", "Pile"}, selected="Slab")
nonunit_builder_6 = Python3Script(Obj=cluster_44.obj, Category=list_9)  # -> out, Log, MatData; inputs Obj: tree, Category: String; same code as nonunit_builder
nonunit_builder_7 = Python3Script(Obj=cluster_45.obj, Category=list_10)  # -> out, Log, MatData; inputs Obj: tree, Category: String; same code as nonunit_builder
bulk_builder_3 = Python3Script(Obj=cluster_82.obj, Category=list_3, Scope=list_4)  # -> out, Log, MatData; inputs Obj: tree, Category: String, Scope: String, UnitId: tree of String; same code as bulk_builder
qto_2 = Python3Script(Obj=cluster_48.obj, Key=simplify(cluster_104.D_2), Value=simplify(cluster_104.result))  # -> out, Log, MatData; inputs Obj: tree, Key: tree of String, Value: tree of String; same code as qto
qto_3 = Python3Script(Obj=cluster_75.obj, Key=simplify(cluster_103.D_2), Value=simplify(cluster_103.result))  # -> out, Log, MatData; inputs Obj: tree, Key: tree of String, Value: tree of String; same code as qto
qto_4 = Python3Script(Obj=cluster_49.obj, Key=simplify(cluster_105.D_2), Value=simplify(cluster_105.result))  # -> out, Log, MatData; inputs Obj: tree, Key: tree of String, Value: tree of String; same code as qto

# ----
# Shared test:
# Check if the Key/Value is applied to all objects in
#  the unit case, if shared, UnitId can't be input
panel_22 = Panel("""N28_OverrideTest_1
N28_OverrideTest_2
N28_OverrideTest_3""")
panel_23 = Panel("""N28_CommonData_1
N28_CommonData_2
N28_CommonData_3""")
override_4 = Python3Script(Obj=cluster_67.obj, Key=panel_22, Value=panel_23)  # -> out, Log, MatData; inputs Obj: tree, Key: tree of String, Value: tree of String, UnitId: tree of String; same code as override

override_5 = Python3Script(Obj=data_2, Key=mockdata_2.okey_2, Value=mockdata_2.ovalue_2)  # -> out, Log, MatData; inputs Obj: tree, Key: tree of String, Value: tree of String, UnitId: tree of String; same code as override
override_6 = Python3Script(Obj=data, Key=mockdata.okey_2, Value=mockdata.ovalue_2)  # -> out, Log, MatData; inputs Obj: tree, Key: tree of String, Value: tree of String, UnitId: tree of String; same code as override
list_16 = ValueList({"Vertical", "Horizontal", "Fitting", "Panel", "Glass", "Mullion", "Transom", "Bracket", "Accessory", "Fastener", "Bolt", "Screw"}, selected="Accessory")
list_17 = ValueList({"Vertical", "Horizontal", "Fitting", "Panel", "Glass", "Mullion", "Transom", "Bracket", "Accessory", "Fastener", "Bolt", "Screw"}, selected="Fitting")
override_7 = Python3Script(Obj=data_3, Key=mockdata_3.okey_2, Value=mockdata_3.ovalue_2)  # -> out, Log, MatData; inputs Obj: tree, Key: tree of String, Value: tree of String, UnitId: tree of String; same code as override
nonunit_builder_8 = Python3Script(Obj=merge_10, Category=list_11)  # -> out, Log, MatData; inputs Obj: tree, Category: String; same code as nonunit_builder
nonunit_builder_9 = Python3Script(Obj=merge_6, Category=list_12)  # -> out, Log, MatData; inputs Obj: tree, Category: String; same code as nonunit_builder
merge_11 = Merge(Data1=cluster_34.obj, Data2=cluster_36.obj)
context_builder = Python3Script(Obj=cluster_94.obj, Category=list_13)  # -> out, Log, MatData; inputs Obj: tree, Category: String
# ---------- context_builder: Python ----------
import sys, os, importlib

# Rhino/GH 裡通常能拿到目前 .gh 的路徑
import Grasshopper as gh
ghdoc_path = gh.Instances.ActiveCanvas.Document.FilePath  # 可能是空字串（未存檔）
if not ghdoc_path:
    raise Exception("GH document not saved yet. Save .gh first to use relative module path.")

proj_dir = os.path.dirname(ghdoc_path)
module_dir = os.path.join(proj_dir, "py_modules")

if module_dir not in sys.path:
    sys.path.append(module_dir)

def reload_pkg(prefix: str):
    # reload children first (reverse length order)
    mods = [m for name, m in sys.modules.items() if name == prefix or name.startswith(prefix + ".")]
    mods.sort(key=lambda m: len(m.__name__), reverse=True)
    for m in mods:
        importlib.reload(m)

# 先 import utils（確保從 py_modules 來）
import utils

# (可選) 確認你抓到的是哪個 utils，避免載到別份
# import utils.gh_utils as gu
# print("utils path =", gu.__file__)

# reload utils 及其已載入子模組
reload_pkg("utils")

import ifc_nonUnit_builder
importlib.reload(ifc_nonUnit_builder)

MatData, Log = ifc_nonUnit_builder.build_nonUnit_matdata(Obj, Category, 1, "CONTEXT")
# ---------- end context_builder ----------
context_builder_2 = Python3Script(Obj=cluster_101.obj, Category=list_14)  # -> out, Log, MatData; inputs Obj: tree, Category: String; same code as context_builder
context_builder_3 = Python3Script(Obj=cluster_102.obj, Category=list_15)  # -> out, Log, MatData; inputs Obj: tree, Category: String; same code as context_builder

# ----
# Normal test:
# Check if the Key/Value works correctly in the unit case.
panel_24 = Panel("""N15_OverrideTest_1
N15_OverrideTest_2
N15_OverrideTest_3
N15_OverrideTest_4""")
data_5 = Data(cluster_57.obj)
mockdata_5 = MockData(key=panel_24, obj=data_5)  # -> okey_2, ovalue_2
override_8 = Python3Script(Obj=data_5, Key=mockdata_5.okey_2, Value=mockdata_5.ovalue_2, UnitId=graft_2)  # -> out, Log, MatData; inputs Obj: tree, Key: tree of String, Value: tree of String, UnitId: tree of String; same code as override

unit_builder_2 = Python3Script(Obj=merge_7, Category=list_16, UnitId=graft_2)  # -> out, Log, MatData; inputs Obj: tree, Category: String, UnitId: tree of String; same code as unit_builder
unit_builder_3 = Python3Script(Obj=merge_5, Category=list_17, UnitId=graft_2)  # -> out, Log, MatData; inputs Obj: tree, Category: String, UnitId: tree of String; same code as unit_builder
merge_12 = Merge(Data1=cluster_71.obj, Data2=cluster_72.obj)
panel_25 = Panel("""N01_Group
Vertical_Group""")
merge_13 = Merge(Data1=cluster_35.obj, Data2=cluster_33.obj, Data3=override_3.MatData, Data4=override_5.MatData, Data5=cluster_38.obj)
merge_14 = Merge(Data1=override_7.MatData, Data2=cluster_80.obj)
merge_15 = Merge(Data1=bulk_builder_3.MatData, Data2=nonunit_builder_2.MatData)
group_10 = Python3Script(Obj=qto_2.MatData, Names=panel_25)  # -> out, Log, MatData; inputs Obj: tree, Names: tree of String; same code as group
list_18 = ValueList({"Vertical", "Horizontal", "Fitting", "Panel", "Glass", "Mullion", "Transom", "Bracket", "Accessory", "Fastener", "Bolt", "Screw"}, selected="Panel")
group_11 = Python3Script(Obj=qto_4.MatData, Names="Vertical_Group")  # -> out, Log, MatData; inputs Obj: tree, Names: tree of String; same code as group
list_19 = ValueList({"Vertical", "Horizontal", "Fitting", "Panel", "Glass", "Mullion", "Transom", "Bracket", "Accessory", "Fastener", "Bolt", "Screw"}, selected="Fastener")
list_20 = ValueList({"Vertical", "Horizontal", "Fitting", "Panel", "Glass", "Mullion", "Transom", "Bracket", "Accessory", "Fastener", "Bolt", "Screw"}, selected="Panel")
list_21 = ValueList({"Unit": "UNIT", "Non Unit": "NON_UNIT"}, selected="Non Unit")
list_22 = ValueList({"Vertical", "Horizontal", "Fitting", "Panel", "Glass", "Mullion", "Transom", "Bracket", "Accessory", "Fastener", "Bolt", "Screw"}, selected="Accessory")
list_23 = ValueList({"Vertical", "Horizontal", "Fitting", "Panel", "Glass", "Mullion", "Transom", "Bracket", "Accessory", "Fastener", "Bolt", "Screw"}, selected="Horizontal")
list_24 = ValueList({"Vertical", "Horizontal", "Fitting", "Panel", "Glass", "Mullion", "Transom", "Bracket", "Accessory", "Fastener", "Bolt", "Screw"}, selected="Horizontal")
list_25 = ValueList({"Vertical", "Horizontal", "Fitting", "Panel", "Glass", "Mullion", "Transom", "Bracket", "Accessory", "Fastener", "Bolt", "Screw"}, selected="Horizontal")
list_26 = ValueList({"Vertical", "Horizontal", "Fitting", "Panel", "Glass", "Mullion", "Transom", "Bracket", "Accessory", "Fastener", "Bolt", "Screw"}, selected="Panel")
list_27 = ValueList({"Vertical", "Horizontal", "Fitting", "Panel", "Glass", "Mullion", "Transom", "Bracket", "Accessory", "Fastener", "Bolt", "Screw"}, selected="Fitting")
list_28 = ValueList({"Vertical", "Horizontal", "Fitting", "Panel", "Glass", "Mullion", "Transom", "Bracket", "Accessory", "Fastener", "Bolt", "Screw"}, selected="Fitting")
list_29 = ValueList({"Vertical", "Horizontal", "Fitting", "Panel", "Glass", "Mullion", "Transom", "Bracket", "Accessory", "Fastener", "Bolt", "Screw"}, selected="Horizontal")
list_30 = ValueList({"Vertical", "Horizontal", "Fitting", "Panel", "Glass", "Mullion", "Transom", "Bracket", "Accessory", "Fastener", "Bolt", "Screw"}, selected="Vertical")
list_31 = ValueList({"Vertical", "Horizontal", "Fitting", "Panel", "Glass", "Mullion", "Transom", "Bracket", "Accessory", "Fastener", "Bolt", "Screw"}, selected="Panel")
list_32 = ValueList({"Vertical", "Horizontal", "Fitting", "Panel", "Glass", "Mullion", "Transom", "Bracket", "Accessory", "Fastener", "Bolt", "Screw"}, selected="Fitting")
merge_16 = Merge(Data1=override_2.MatData, Data2=cluster_26.obj, Data3=cluster_27.obj, Data4=cluster_28.obj, Data5=cluster_31.obj)
merge_17 = Merge(Data1=cluster_32.obj, Data2=cluster_29.obj)
unit_builder_4 = Python3Script(Obj=cluster_68.obj, Category=list_18, UnitId=graft_2)  # -> out, Log, MatData; inputs Obj: tree, Category: String, UnitId: tree of String; same code as unit_builder
list_33 = ValueList({"Vertical", "Horizontal", "Fitting", "Panel", "Glass", "Mullion", "Transom", "Bracket", "Accessory", "Fastener", "Bolt", "Screw"}, selected="Fastener")
list_34 = ValueList({"Vertical", "Horizontal", "Fitting", "Panel", "Glass", "Mullion", "Transom", "Bracket", "Accessory", "Fastener", "Bolt", "Screw"}, selected="Fitting")
list_35 = ValueList({"Unit": "UNIT", "Non Unit": "NON_UNIT"}, selected="Non Unit")
list_36 = ValueList({"Vertical", "Horizontal", "Fitting", "Panel", "Glass", "Mullion", "Transom", "Bracket", "Accessory", "Fastener", "Bolt", "Screw"}, selected="Fitting")
nonunit_builder_10 = Python3Script(Obj=override_6.MatData, Category=list_20)  # -> out, Log, MatData; inputs Obj: tree, Category: String; same code as nonunit_builder
list_37 = ValueList({"Unit": "UNIT", "Non Unit": "NON_UNIT"}, selected="Non Unit")
list_38 = ValueList({"Vertical", "Horizontal", "Fitting", "Panel", "Glass", "Mullion", "Transom", "Bracket", "Accessory", "Fastener", "Bolt", "Screw"}, selected="Horizontal")
nonunit_builder_11 = Python3Script(Obj=cluster_21.obj, Category=list_22)  # -> out, Log, MatData; inputs Obj: tree, Category: String; same code as nonunit_builder
merge_18 = Merge(
    Data1=cluster_73.obj,
    Data2=group_2.MatData,
    Data3=cluster_70.obj,
    Data4=cluster_65.obj,
    Data5=override_4.MatData,
    Data6=cluster_66.obj)
nonunit_builder_12 = Python3Script(Obj=merge_9, Category=list_24)  # -> out, Log, MatData; inputs Obj: tree, Category: String; same code as nonunit_builder
nonunit_builder_13 = Python3Script(Obj=cluster_19.obj, Category=list_25)  # -> out, Log, MatData; inputs Obj: tree, Category: String; same code as nonunit_builder
nonunit_builder_14 = Python3Script(Obj=cluster_14.obj, Category=list_26)  # -> out, Log, MatData; inputs Obj: tree, Category: String; same code as nonunit_builder
bulk_builder_4 = Python3Script(Obj=cluster_20.obj, Category=list_19, Scope=list_21)  # -> out, Log, MatData; inputs Obj: tree, Category: String, Scope: String, UnitId: tree of String; same code as bulk_builder
nonunit_builder_15 = Python3Script(Obj=cluster_22.obj, Category=list_28)  # -> out, Log, MatData; inputs Obj: tree, Category: String; same code as nonunit_builder
nonunit_builder_16 = Python3Script(Obj=merge_13, Category=list_23)  # -> out, Log, MatData; inputs Obj: tree, Category: String; same code as nonunit_builder
nonunit_builder_17 = Python3Script(Obj=merge_11, Category=list_27)  # -> out, Log, MatData; inputs Obj: tree, Category: String; same code as nonunit_builder
nonunit_builder_18 = Python3Script(Obj=merge, Category=list_30)  # -> out, Log, MatData; inputs Obj: tree, Category: String; same code as nonunit_builder
nonunit_builder_19 = Python3Script(Obj=merge_2, Category=list_29)  # -> out, Log, MatData; inputs Obj: tree, Category: String; same code as nonunit_builder
nonunit_builder_20 = Python3Script(Obj=merge_3, Category=list_31)  # -> out, Log, MatData; inputs Obj: tree, Category: String; same code as nonunit_builder
nonunit_builder_21 = Python3Script(Obj=cluster_11.obj, Category=list_32)  # -> out, Log, MatData; inputs Obj: tree, Category: String; same code as nonunit_builder
merge_19 = Merge(
    Data1=nonunit_builder_5.MatData,
    Data2=nonunit_builder_3.MatData,
    Data3=nonunit_builder_4.MatData,
    Data4=nonunit_builder_6.MatData)

# ----
# Normal test:
# Check if the Key/Value works correctly in the unit case.
panel_26 = Panel("""N01_OverrideTest_1
N01_OverrideTest_2
N01_OverrideTest_3""")
panel_27 = Panel("""N02_OverrideTest_1
N02_OverrideTest_2""")
data_6 = Data(group_10.MatData)
data_7 = Data(group_11.MatData)
mockdata_6 = MockData(key=panel_26, obj=data_6)  # -> okey_2, ovalue_2
mockdata_7 = MockData(key=panel_27, obj=data_7)  # -> okey_2, ovalue_2
override_9 = Python3Script(Obj=data_6, Key=mockdata_6.okey_2, Value=mockdata_6.ovalue_2, UnitId=graft_2)  # -> out, Log, MatData; inputs Obj: tree, Key: tree of String, Value: tree of String, UnitId: tree of String; same code as override
override_10 = Python3Script(Obj=data_7, Key=mockdata_7.okey_2, Value=mockdata_7.ovalue_2, UnitId=graft_2)  # -> out, Log, MatData; inputs Obj: tree, Key: tree of String, Value: tree of String, UnitId: tree of String; same code as override

list_39 = ValueList({"Vertical", "Horizontal", "Fitting", "Panel", "Glass", "Mullion", "Transom", "Bracket", "Accessory", "Fastener", "Bolt", "Screw"}, selected="Panel")
list_40 = ValueList({"Vertical", "Horizontal", "Fitting", "Panel", "Glass", "Mullion", "Transom", "Bracket", "Accessory", "Fastener", "Bolt", "Screw"}, selected="Horizontal")
list_41 = ValueList({"Vertical", "Horizontal", "Fitting", "Panel", "Glass", "Mullion", "Transom", "Bracket", "Accessory", "Fastener", "Bolt", "Screw"}, selected="Vertical")
assembly_2 = Python3Script(MatData=context_builder.MatData, Name="GRP_Column", Role="Column")  # -> out, Log, MatDataOut; inputs MatData: tree, Name: tree of String, KeySuffix: String, Key: tree of String, Value: tree of String, QtoName: tree of String, QtoKey: tree of String, QtoValue: tree of String, UnitId: tree of String; same code as assembly
assembly_3 = Python3Script(MatData=context_builder_2.MatData, Name="GRP_Beam", Role="Beam")  # -> out, Log, MatDataOut; inputs MatData: tree, Name: tree of String, KeySuffix: String, Key: tree of String, Value: tree of String, QtoName: tree of String, QtoKey: tree of String, QtoValue: tree of String, UnitId: tree of String; same code as assembly
unit_builder_5 = Python3Script(Obj=merge_12, Category=list_34, UnitId=graft_2)  # -> out, Log, MatData; inputs Obj: tree, Category: String, UnitId: tree of String; same code as unit_builder
unit_builder_6 = Python3Script(Obj=merge_18, Category=list_38, UnitId=graft_2)  # -> out, Log, MatData; inputs Obj: tree, Category: String, UnitId: tree of String; same code as unit_builder

# ----
# Normal test:
# Check if the Key/Value works correctly in the unit case.
panel_28 = Panel("""N69_OverrideTest_1
N69_OverrideTest_2
N69_OverrideTest_3
N69_OverrideTest_4""")
data_8 = Data(cluster_77.obj)
mockdata_8 = MockData(key=panel_28, obj=data_8)  # -> okey_2, ovalue_2
override_11 = Python3Script(Obj=data_8, Key=mockdata_8.okey_2, Value=mockdata_8.ovalue_2, UnitId=graft_2)  # -> out, Log, MatData; inputs Obj: tree, Key: tree of String, Value: tree of String, UnitId: tree of String; same code as override

bulk_builder_5 = Python3Script(Obj=merge_14, Category=list_33, Scope=list_35)  # -> out, Log, MatData; inputs Obj: tree, Category: String, Scope: String, UnitId: tree of String; same code as bulk_builder
bulk_builder_6 = Python3Script(Obj=cluster_79.obj, Category=list_36, Scope=list_37)  # -> out, Log, MatData; inputs Obj: tree, Category: String, Scope: String, UnitId: tree of String; same code as bulk_builder
assembly_4 = Python3Script(MatData=bulk_builder_2.MatData, Name="GRP_Bulk", Role="BulkParts")  # -> out, Log, MatDataOut; inputs MatData: tree, Name: tree of String, KeySuffix: String, Key: tree of String, Value: tree of String, QtoName: tree of String, QtoKey: tree of String, QtoValue: tree of String, UnitId: tree of String; same code as assembly
assembly_5 = Python3Script(MatData=unit_builder_2.MatData, Name="GRP_Accessory", Role="AccessoryParts")  # -> out, Log, MatDataOut; inputs MatData: tree, Name: tree of String, KeySuffix: String, Key: tree of String, Value: tree of String, QtoName: tree of String, QtoKey: tree of String, QtoValue: tree of String, UnitId: tree of String; same code as assembly
assembly_6 = Python3Script(MatData=merge_15, Name="GRP_NonUnitPile", Role="NonUnitPiles")  # -> out, Log, MatDataOut; inputs MatData: tree, Name: tree of String, KeySuffix: String, Key: tree of String, Value: tree of String, QtoName: tree of String, QtoKey: tree of String, QtoValue: tree of String, UnitId: tree of String; same code as assembly
assembly_7 = Python3Script(MatData=unit_builder_3.MatData, Name="GRP_Fitting", Role="FittingParts")  # -> out, Log, MatDataOut; inputs MatData: tree, Name: tree of String, KeySuffix: String, Key: tree of String, Value: tree of String, QtoName: tree of String, QtoKey: tree of String, QtoValue: tree of String, UnitId: tree of String; same code as assembly
assembly_8 = Python3Script(MatData=nonunit_builder_9.MatData, Name="GRP_EmbeddedPart", Role="EmbeddedPart")  # -> out, Log, MatDataOut; inputs MatData: tree, Name: tree of String, KeySuffix: String, Key: tree of String, Value: tree of String, QtoName: tree of String, QtoKey: tree of String, QtoValue: tree of String, UnitId: tree of String; same code as assembly
assembly_9 = Python3Script(
    MatData=nonunit_builder_8.MatData,
    Name="GRP_UnderBeam",
    Role="underBeam",
    Key="underBeam_OverrideTest_1",
    Value="underBeam_test_1")  # -> out, Log, MatDataOut; inputs MatData: tree, Name: tree of String, KeySuffix: String, Key: tree of String, Value: tree of String, QtoName: tree of String, QtoKey: tree of String, QtoValue: tree of String, UnitId: tree of String; same code as assembly
unit_builder_7 = Python3Script(Obj=cluster_30.obj, Category=list_39, UnitId=graft_2)  # -> out, Log, MatData; inputs Obj: tree, Category: String, UnitId: tree of String; same code as unit_builder
unit_builder_8 = Python3Script(Obj=merge_16, Category=list_40, UnitId=graft_2)  # -> out, Log, MatData; inputs Obj: tree, Category: String, UnitId: tree of String; same code as unit_builder
unit_builder_9 = Python3Script(Obj=merge_17, Category=list_41, UnitId=graft_2)  # -> out, Log, MatData; inputs Obj: tree, Category: String, UnitId: tree of String; same code as unit_builder
merge_20 = Merge(
    Data1=override_8.MatData,
    Data2=group_3.MatData,
    Data3=group_9.MatData,
    Data4=group_4.MatData,
    Data5=group_5.MatData,
    Data6=group_6.MatData,
    Data7=group_7.MatData,
    Data8=group_8.MatData)
panel_29 = Panel("""innerBalconyAssembly_OverrideTest_1
innerBalconyAssembly_OverrideTest_2""")
merge_21 = Merge(Data1=nonunit_builder_16.MatData, Data2=nonunit_builder_17.MatData)
panel_30 = Panel("""innerBalconyLaa_1
innerBalconyLaa_2""")
merge_22 = Merge(
    Data1=nonunit_builder_18.MatData,
    Data2=nonunit_builder_19.MatData,
    Data3=nonunit_builder_20.MatData,
    Data4=nonunit_builder_21.MatData)
merge_23 = Merge(Data1=bulk_builder_5.MatData, Data2=bulk_builder_6.MatData)
list_42 = ValueList({"Vertical", "Horizontal", "Fitting", "Panel", "Glass", "Mullion", "Transom", "Bracket", "Accessory", "Fastener", "Bolt", "Screw"}, selected="Vertical")
merge_24 = Merge(Data1=unit_builder_4.MatData, Data2=unit_builder_6.MatData, Data3=unit_builder_5.MatData)
assembly_10 = Python3Script(MatData=merge_19, Name="GRP_BalconySoffit", Role="BalconySoffitParts")  # -> out, Log, MatDataOut; inputs MatData: tree, Name: tree of String, KeySuffix: String, Key: tree of String, Value: tree of String, QtoName: tree of String, QtoKey: tree of String, QtoValue: tree of String, UnitId: tree of String; same code as assembly
unit_builder_10 = Python3Script(Obj=merge_20, Category=list_42, UnitId=graft_2)  # -> out, Log, MatData; inputs Obj: tree, Category: String, UnitId: tree of String; same code as unit_builder
merge_25 = Merge(Data1=assembly_2.MatDataOut, Data2=assembly_3.MatDataOut, Data3=context_builder_3.MatData)
merge_26 = Merge(
    Data1=nonunit_builder_10.MatData,
    Data2=nonunit_builder_11.MatData,
    Data3=nonunit_builder_13.MatData,
    Data4=nonunit_builder_14.MatData,
    Data5=nonunit_builder_12.MatData,
    Data6=bulk_builder_4.MatData,
    Data7=nonunit_builder_15.MatData)
assembly_11 = Python3Script(MatData=merge_22, Name="InnerBalconyAssembly", Role="InnerBalconyParts", Key=panel_29, Value=panel_30)  # -> out, Log, MatDataOut; inputs MatData: tree, Name: tree of String, KeySuffix: String, Key: tree of String, Value: tree of String, QtoName: tree of String, QtoKey: tree of String, QtoValue: tree of String, UnitId: tree of String; same code as assembly
assembly_12 = Python3Script(MatData=merge_21, Name="GRP_BalconytrimPanel", Role="BalconytrimPanelParts")  # -> out, Log, MatDataOut; inputs MatData: tree, Name: tree of String, KeySuffix: String, Key: tree of String, Value: tree of String, QtoName: tree of String, QtoKey: tree of String, QtoValue: tree of String, UnitId: tree of String; same code as assembly
merge_27 = Merge(Data1=unit_builder_8.MatData, Data2=unit_builder_9.MatData, Data3=unit_builder_7.MatData)
merge_28 = Merge(Data1=override_9.MatData, Data2=override_10.MatData)
merge_29 = Merge(Data1=qto_3.MatData, Data2=cluster_74.obj, Data3=cluster_76.obj, Data4=override_11.MatData, Data5=cluster_78.obj)
assembly_13 = Python3Script(MatData=merge_23, Name="GRP_BalconyBulk", Role="BalconyBulks")  # -> out, Log, MatDataOut; inputs MatData: tree, Name: tree of String, KeySuffix: String, Key: tree of String, Value: tree of String, QtoName: tree of String, QtoKey: tree of String, QtoValue: tree of String, UnitId: tree of String; same code as assembly
panel_31 = Panel("""測試spread_1
測試spread_2""")
panel_32 = Panel("""trimAssembly_OverrideTest_3
trimAssembly_OverrideTest_4""")
list_43 = ValueList({"Vertical", "Horizontal", "Fitting", "Panel", "Glass", "Mullion", "Transom", "Bracket", "Accessory", "Fastener", "Bolt", "Screw"}, selected="Vertical")
list_44 = ValueList({"Vertical", "Horizontal", "Fitting", "Panel", "Glass", "Mullion", "Transom", "Bracket", "Accessory", "Fastener", "Bolt", "Screw"}, selected="Horizontal")
assembly_14 = Python3Script(MatData=unit_builder_10.MatData, Name="ButterflyFinAssembly", Role="ButterflyFinParts")  # -> out, Log, MatDataOut; inputs MatData: tree, Name: tree of String, KeySuffix: String, Key: tree of String, Value: tree of String, QtoName: tree of String, QtoKey: tree of String, QtoValue: tree of String, UnitId: tree of String; same code as assembly
assembly_15 = Python3Script(MatData=merge_26, Name="GRP_BalconyCeiling", Role="BalconyCeilingParts")  # -> out, Log, MatDataOut; inputs MatData: tree, Name: tree of String, KeySuffix: String, Key: tree of String, Value: tree of String, QtoName: tree of String, QtoKey: tree of String, QtoValue: tree of String, UnitId: tree of String; same code as assembly
unit_builder_11 = Python3Script(Obj=merge_28, Category=list_43, UnitId=graft_2)  # -> out, Log, MatData; inputs Obj: tree, Category: String, UnitId: tree of String; same code as unit_builder
unit_builder_12 = Python3Script(Obj=merge_29, Category=list_44, UnitId=graft_2)  # -> out, Log, MatData; inputs Obj: tree, Category: String, UnitId: tree of String; same code as unit_builder
assembly_16 = Python3Script(MatData=merge_27, Name="GRP_SecondStage", Role="SecondStageParts")  # -> out, Log, MatDataOut; inputs MatData: tree, Name: tree of String, KeySuffix: String, Key: tree of String, Value: tree of String, QtoName: tree of String, QtoKey: tree of String, QtoValue: tree of String, UnitId: tree of String; same code as assembly
assembly_17 = Python3Script(MatData=merge_24, Name="TrimPanelAssembly", Role="TrimPanelParts", Key=panel_32, Value=panel_31)  # -> out, Log, MatDataOut; inputs MatData: tree, Name: tree of String, KeySuffix: String, Key: tree of String, Value: tree of String, QtoName: tree of String, QtoKey: tree of String, QtoValue: tree of String, UnitId: tree of String; same code as assembly
merge_30 = Merge(Data1=unit_builder_11.MatData, Data2=unit_builder_12.MatData)
assembly_18 = Python3Script(MatData=merge_30, Name="MainFrameAssembly", Role="MainFrameParts")  # -> out, Log, MatDataOut; inputs MatData: tree, Name: tree of String, KeySuffix: String, Key: tree of String, Value: tree of String, QtoName: tree of String, QtoKey: tree of String, QtoValue: tree of String, UnitId: tree of String; same code as assembly
panel_33 = Panel(assembly_18.MatDataOut)
panel_34 = Panel("""frameAssembly_OverrideTest_1
frameAssembly_OverrideTest_2""")
merge_31 = Merge(
    Data1=assembly_18.MatDataOut,
    Data2=assembly_14.MatDataOut,
    Data3=assembly_16.MatDataOut,
    Data4=assembly_5.MatDataOut,
    Data5=assembly_7.MatDataOut)
merge_32 = Merge(
    Data1=assembly_12.MatDataOut,
    Data2=assembly_15.MatDataOut,
    Data3=assembly_11.MatDataOut,
    Data4=assembly_13.MatDataOut,
    Data5=assembly_6.MatDataOut,
    Data6=assembly_10.MatDataOut)
panel_35 = Panel("""BalconyGroup_OverrideTest_1
BalconyGroup_OverrideTest_2""")
mockassemblydata = MockAssemblyData(T=merge_31, key=panel_34, value="測試_")  # -> simplify(key_4), simplify(value_4)
panel_36 = Panel("""balconyLaa_1
balconyLaa_2""")
key = Data(mockassemblydata.key_4)
value = Data(mockassemblydata.value_4)
assembly_19 = Python3Script(MatData=merge_32, Name="GRP_Balcony", Role="BalconyParts", Key=panel_35, Value=panel_36)  # -> out, Log, MatDataOut; inputs MatData: tree, Name: tree of String, KeySuffix: String, Key: tree of String, Value: tree of String, QtoName: tree of String, QtoKey: tree of String, QtoValue: tree of String, UnitId: tree of String; same code as assembly
assembly_20 = Python3Script(MatData=merge_31, Name="UnitFrameAssembly", Role="UnitFrameParts", Key=key, Value=value)  # -> out, Log, MatDataOut; inputs MatData: tree, Name: tree of String, KeySuffix: String, Key: tree of String, Value: tree of String, QtoName: tree of String, QtoKey: tree of String, QtoValue: tree of String, UnitId: tree of String; same code as assembly
getgeo = Python3Script(MatData=assembly_20.MatDataOut)  # -> Log, GeoTree, NameTree; inputs MatData: tree
# ---------- getgeo: Python ----------
"""
IN:
  MatData (Tree Access): DataTree[Object] (pythonnet style or GH style)
OUT:
  GeoTree  (DataTree)
  NameTree (DataTree)
  Log      (list[str])
"""

from Grasshopper import DataTree
from Grasshopper.Kernel.Data import GH_Path

def unwrap(x):
    if x is None:
        return None
    # GH_ObjectWrapper-like
    try:
        return x.Value
    except:
        return x

def as_payload(item):
    """Return dict payload or None."""
    raw = unwrap(item)
    raw = unwrap(raw)

    if isinstance(raw, dict):
        # optional nested {"value": {...}}
        if ("geo" not in raw or "name" not in raw) and isinstance(raw.get("value", None), dict):
            raw = raw["value"]
        return raw
    return None

GeoTree  = DataTree[object]()
NameTree = DataTree[object]()
Log = []

def add_out(path, payload):
    geo = payload.get("geo", None)
    name = payload.get("name", None)
    if geo is None or name is None:
        Log.append("skip: missing geo/name @ {} keys={}".format(path, list(payload.keys())))
        return
    GeoTree.Add(geo, path)
    NameTree.Add(str(name), path)

done = False

# --- Strategy A: Paths + Branch(path) ---
if hasattr(MatData, "Paths") and hasattr(MatData, "Branch"):
    try:
        for path in MatData.Paths:
            branch = MatData.Branch(path)
            for i, item in enumerate(branch):
                payload = as_payload(item)
                if payload is None:
                    Log.append("skip: not dict @ {}[{}] type={}".format(path, i, type(unwrap(item))))
                    continue
                add_out(path, payload)
        done = True
    except Exception as e:
        Log.append("Strategy A failed: {}".format(e))

# --- Strategy B: PathCount + Path(i) + Branch(path) ---
if not done and hasattr(MatData, "PathCount") and hasattr(MatData, "Path") and hasattr(MatData, "Branch"):
    try:
        for p_i in range(MatData.PathCount):
            path = MatData.Path(p_i)
            branch = MatData.Branch(path)
            for i, item in enumerate(branch):
                payload = as_payload(item)
                if payload is None:
                    Log.append("skip: not dict @ {}[{}] type={}".format(path, i, type(unwrap(item))))
                    continue
                add_out(path, payload)
        done = True
    except Exception as e:
        Log.append("Strategy B failed: {}".format(e))

# --- Strategy C: AllData() (supports dict/iterables) ---
if not done and hasattr(MatData, "AllData"):
    try:
        pairs = MatData.AllData()

        # Case 1: returns dict-like mapping {path: item} OR {path: [items]}
        if isinstance(pairs, dict):
            for k, v in pairs.items():
                path = k if isinstance(k, GH_Path) else GH_Path(0)
                if isinstance(v, (list, tuple)):
                    for i, item in enumerate(v):
                        payload = as_payload(item)
                        if payload is None:
                            Log.append("skip: not dict @ {}[{}] type={}".format(path, i, type(unwrap(item))))
                            continue
                        add_out(path, payload)
                else:
                    payload = as_payload(v)
                    if payload is None:
                        Log.append("skip: not dict @ {} type={}".format(path, type(unwrap(v))))
                        continue
                    add_out(path, payload)

        # Case 2: returns iterable of (path, item) OR KeyValuePair OR weird dict rows
        else:
            for idx, pair in enumerate(pairs):
                # (path, item)
                if isinstance(pair, (list, tuple)) and len(pair) == 2:
                    path, item = pair[0], pair[1]
                # KeyValuePair-like
                elif hasattr(pair, "Key") and hasattr(pair, "Value"):
                    path, item = pair.Key, pair.Value
                # dict row: try common keys
                elif isinstance(pair, dict):
                    # you can inspect keys by watching Log once
                    # try common conventions:
                    path = pair.get("Path", None) or pair.get("path", None) or pair.get("Key", None) or pair.get("key", None)
                    item = pair.get("Value", None) or pair.get("value", None) or pair.get("Item", None) or pair.get("item", None)
                    if path is None and item is None:
                        Log.append("skip: dict-pair unknown keys @ {} keys={}".format(idx, list(pair.keys())))
                        continue
                else:
                    Log.append("skip: unknown pair format @ {} type={}".format(idx, type(pair)))
                    continue

                if not isinstance(path, GH_Path):
                    try:
                        path = GH_Path(path)
                    except:
                        path = GH_Path(0)

                payload = as_payload(item)
                if payload is None:
                    Log.append("skip: not dict @ {} type={}".format(path, type(unwrap(item))))
                    continue
                add_out(path, payload)

        done = True
    except Exception as e:
        Log.append("Strategy C failed: {}".format(e))

if not done:
    Log.append("Failed: MatData isn't iterable as a GH tree. Check input access/wiring.")
# ---------- end getgeo ----------
panel_37 = Panel(getgeo.NameTree)
panel_38 = Panel(assembly_20.MatDataOut)
py3 = Python3Script(MatData=assembly_20.MatDataOut)  # -> out, Log; inputs MatData: tree
# ---------- py3: Python ----------
from utils.gh_utils import to_branch_dict_any, unwrap_gh

bd, paths = to_branch_dict_any(MatData)

lines = []
for p in paths:
    items = bd.get(p, [])
    n_all = len(items)
    n_meta = 0
    cats = {}
    for it in items:
        r = unwrap_gh(it)
        if isinstance(r, dict):
            cat = r.get("category") or ""
            cats[cat] = cats.get(cat, 0) + 1
            if cat == "__ASSEMBLY_META__":
                n_meta += 1
    lines.append(f"{p} len_all={n_all} meta={n_meta} cats={cats}")

Log = "\n".join(lines)
# ---------- end py3 ----------
merge_33 = Merge(Data1=assembly_20.MatDataOut, Data2=assembly_17.MatDataOut, Data3=assembly_4.MatDataOut)
panel_39 = Panel(py3.Log)
merge_34 = Merge(Data1=assembly_19.MatDataOut, Data2=assembly_9.MatDataOut, Data3=assembly_8.MatDataOut)
series = Series(Start=Slider(1, range=0..10), Step=1, Count=10)  # -> graft(Series)
dup = DuplicateData(Data=series, Number=Slider(3, range=0..10), Order=True)  # -> flatten(Data)
tstat = TreeStatistics(Tree=merge_33)  # -> Paths, Length, Count
short = ShortestList(ListA=tstat.Paths, ListB=dup, TrimMode=2)  # -> ListA, ListB
getgeo_2 = Python3Script(MatData=merge_33)  # -> Log, GeoTree, NameTree; inputs MatData: tree; same code as getgeo
getgeo_3 = Python3Script(MatData=merge_33)  # -> Log, GeoTree, NameTree; inputs MatData: tree; same code as getgeo
concat = Concatenate(FragmentA="Bay ", FragmentB=short.ListB)  # -> simplify(graft(Result))
series_2 = Series(Start="1", Step=1, Count=tstat.Count)  # -> simplify(graft(Series))
dup_2 = DuplicateData(Data=Slider(3, range=0..10), Number=tstat.Count, Order=True)  # -> simplify(graft(Data))
panel_40 = Panel("""BayNo
BuildingLevel
InstallSequence""")
brep = Brep(getgeo_2.GeoTree)
null = NullItem(Item=brep)  # -> NullFlags, InvalidFlags, Description
installsequence = Data(series_2)
cluster_106 = Cluster_7(geo=getgeo_3.GeoTree, T=getgeo_3.NameTree, txt="N01")  # -> c_name_2, count_2, txt_4, num_2
cluster_107 = Cluster_7(geo=getgeo_3.GeoTree, T=getgeo_3.NameTree, txt="N08")  # -> c_name_2, count_2, txt_4, num_2
cluster_108 = Cluster_7(geo=getgeo_3.GeoTree, T=getgeo_3.NameTree, txt="N69")  # -> c_name_2, count_2, txt_4, num_2
cluster_109 = Cluster_7(geo=getgeo_3.GeoTree, T=getgeo_3.NameTree, txt="N02")  # -> c_name_2, count_2, txt_4, num_2
bayno = Data(concat)
level = Data(dup_2)
dispatch = Dispatch(List=getgeo_2.GeoTree, DispatchPattern=null.NullFlags)  # -> ListA, ListB
cluster_110 = Cluster_5(T=merge_33, data=panel_40)
item_5 = ListItem(List=flatten(dispatch.ListA), Index=0, Wrap=True)
merge_35 = Merge(Data1=bayno, Data2=level, Data3=installsequence)
data_9 = Data(simplify(cluster_110))
merge_36 = Merge(
    Data1=cluster_106.c_name_2,
    Data2=cluster_106.txt_4,
    Data3=cluster_109.c_name_2,
    Data4=cluster_109.txt_4,
    Data5=cluster_108.c_name_2,
    Data6=cluster_108.txt_4,
    Data7=cluster_107.c_name_2,
    Data8=cluster_107.txt_4)
merge_37 = Merge(
    Data1=cluster_106.count_2,
    Data2=cluster_106.num_2,
    Data3=cluster_109.count_2,
    Data4=cluster_109.num_2,
    Data5=cluster_108.count_2,
    Data6=cluster_108.num_2,
    Data7=cluster_107.count_2,
    Data8=cluster_107.num_2)
panel_41 = Panel("""ContextAssembly_test_1
ContextAssembly_test_2""")
panel_42 = Panel("""ContextAssembly_OverrideTest_1
ContextAssembly_OverrideTest_2""")
panel_43 = Panel("""nonUnit_assembly_test_1
nonUnit_assembly_test_2""")
panel_44 = Panel("""nonUnitAssembly_OverrideTest_1
nonUnitAssembly_OverrideTest_2""")
ma = MassAddition(Input=flatten(cluster_107.num_2))  # -> Result, PartialResults
ma_2 = MassAddition(Input=flatten(cluster_106.num_2))  # -> Result, PartialResults
ma_3 = MassAddition(Input=flatten(cluster_109.num_2))  # -> Result, PartialResults
ma_4 = MassAddition(Input=flatten(cluster_108.num_2))  # -> Result, PartialResults
item_6 = ListItem(List=flatten(cluster_107.txt_4), Index=0, Wrap=True)
item_7 = ListItem(List=flatten(cluster_106.txt_4), Index=0, Wrap=True)
item_8 = ListItem(List=flatten(cluster_109.txt_4), Index=0, Wrap=True)
item_9 = ListItem(List=flatten(cluster_108.txt_4), Index=0, Wrap=True)
ma_5 = MassAddition(Input=flatten(cluster_107.count_2))  # -> Result, PartialResults
ma_6 = MassAddition(Input=flatten(cluster_106.count_2))  # -> Result, PartialResults
ma_7 = MassAddition(Input=flatten(cluster_109.count_2))  # -> Result, PartialResults
ma_8 = MassAddition(Input=flatten(cluster_108.count_2))  # -> Result, PartialResults
item_10 = ListItem(List=flatten(cluster_107.c_name_2), Index=0, Wrap=True)
item_11 = ListItem(List=flatten(cluster_106.c_name_2), Index=0, Wrap=True)
item_12 = ListItem(List=flatten(cluster_109.c_name_2), Index=0, Wrap=True)
item_13 = ListItem(List=flatten(cluster_108.c_name_2), Index=0, Wrap=True)
# main assembly
assembly_21 = Python3Script(MatData=merge_25, Name="Context_Group", Role="Context_components", Key=panel_42, Value=panel_41)  # -> out, Log, MatDataOut; inputs MatData: tree, Name: tree of String, KeySuffix: String, Key: tree of String, Value: tree of String, QtoName: tree of String, QtoKey: tree of String, QtoValue: tree of String, UnitId: tree of String; same code as assembly
# main assembly
assembly_22 = Python3Script(MatData=merge_34, Name="NON_UNIT", Role="nonUnit_components", Key=panel_44, Value=panel_43)  # -> out, Log, MatDataOut; inputs MatData: tree, Name: tree of String, KeySuffix: String, Key: tree of String, Value: tree of String, QtoName: tree of String, QtoKey: tree of String, QtoValue: tree of String, UnitId: tree of String; same code as assembly
# main assembly
assembly_23 = Python3Script(MatData=merge_33, Name=graft_2, Role="unit_components", Key=data_9, Value=merge_35, QtoKey=merge_36, QtoValue=merge_37)  # -> out, Log, MatDataOut; inputs MatData: tree, Name: tree of String, KeySuffix: String, Key: tree of String, Value: tree of String, QtoName: tree of String, QtoKey: tree of String, QtoValue: tree of String, UnitId: tree of String; same code as assembly
txt_3 = Text(graft_2)
merge_38 = Merge(Data1=item_11, Data2=item_7, Data3=item_12, Data4=item_8, Data5=item_13, Data6=item_9, Data7=item_10, Data8=item_6)
allgroup_2 = Python3Script(Obj=assembly_23.MatDataOut, Name=txt_3, QtoKey=merge_36, QtoValue=merge_37)  # -> out, Log, MatData; inputs Obj: tree, Name: tree of String, Key: tree of String, Value: tree of String, QtoName: tree of String, QtoKey: tree of String, QtoValue: tree of String; same code as allgroup
merge_39 = Merge(
    Data1=ma_6.Result,
    Data2=ma_2.Result,
    Data3=ma_7.Result,
    Data4=ma_3.Result,
    Data5=ma_8.Result,
    Data6=ma_4.Result,
    Data7=ma_5.Result,
    Data8=ma.Result)
allgroup_3 = Python3Script(Obj=allgroup_2.MatData, Name="UnitsGroupLa", QtoKey=merge_38, QtoValue=merge_39)  # -> out, Log, MatData; inputs Obj: tree, Name: tree of String, Key: tree of String, Value: tree of String, QtoName: tree of String, QtoKey: tree of String, QtoValue: tree of String; same code as allgroup
entwine = Entwine(Branch0X=allgroup_3.MatData, Branch1X=assembly_22.MatDataOut, Branch2X=assembly_21.MatDataOut, FlattenInputs=False)
py3_2 = Python3Script()  # -> main_path
# ---------- py3_2: Python ----------
import os
gh_doc = ghenv.Component.OnPingDocument()

main_path = os.path.dirname(gh_doc.FilePath)
# ---------- end py3_2 ----------
concat_2 = Concatenate(FragmentA=py3_2, FragmentC="\ifc_test_file\N03F_fixed.ifc")

# ----
# import mode
exporter = Python3Script(MatData=entwine, StoreyName="N02FHaHa", StoreyElev=Slider(9, range=0..100), OutPath=concat_2, Run=Toggle(False))  # -> out, OK, Log; inputs MatData: tree, StoreyName: String, StoreyElev: Double, OutPath: String, Run: Boolean
# ---------- exporter: Python ----------
import sys, os, importlib

# Rhino/GH 裡通常能拿到目前 .gh 的路徑
import Grasshopper as gh
ghdoc_path = gh.Instances.ActiveCanvas.Document.FilePath  # 可能是空字串（未存檔）
if not ghdoc_path:
    raise Exception("GH document not saved yet. Save .gh first to use relative module path.")

proj_dir = os.path.dirname(ghdoc_path)
module_dir = os.path.join(proj_dir, "py_modules")

if module_dir not in sys.path:
    sys.path.append(module_dir)

def reload_pkg(prefix: str):
    # reload children first (reverse length order)
    mods = [m for name, m in sys.modules.items() if name == prefix or name.startswith(prefix + ".")]
    mods.sort(key=lambda m: len(m.__name__), reverse=True)
    for m in mods:
        importlib.reload(m)

# 先 import utils（確保從 py_modules 來）
import utils

# (可選) 確認你抓到的是哪個 utils，避免載到別份
# import utils.gh_utils as gu
# print("utils path =", gu.__file__)

# reload utils 及其已載入子模組
reload_pkg("utils")

import ifc_exporter
importlib.reload(ifc_exporter) #development mode

OK, Log, ResolvedOutPath = ifc_exporter.export_ifc_from_matdata(
    Run,
    MatData,
    StoreyName,
    StoreyElev,
    OutPath
)
# ---------- end exporter ----------

panel_45 = Panel(exporter.Log)

# ==== cluster Cluster
mode = ClusterInput()
name = ClusterInput()
data = ClusterInput()
mode_2 = Number(mode)
name_2 = Text(name)
filterdata = FilterData(data=simplify(data), mode=mode_2, filter=name_2)  # -> object_3, bool_2
clean = CleanTree(RemoveNulls=True, RemoveInvalid=True, RemoveEmpty=invert(False), Tree=filterdata.object_3)
lng = ListLength(List=flatten(clean))
rep = ReplaceText(Text=name_2, Find=" ", RecursiveReplace=False)
repeat = RepeatData(Data=rep, Length=lng)
unflatten = UnflattenTree(Tree=repeat, Guide=clean)  # -> graft(Tree)
unflatten_2 = UnflattenTree(Tree=clean, Guide=unflatten)
trimbranch = TrimBranch(tree=unflatten_2, level="1")  # -> result; inputs tree: tree, level: Int32
# ---------- trimbranch: Python ----------
from Grasshopper import DataTree
from Grasshopper.Kernel.Data import GH_Path
from Grasshopper.Kernel import GH_RuntimeMessageLevel

if tree is None or level is None or tree.DataCount==0:
    ghenv.Component.AddRuntimeMessage(
        GH_RuntimeMessageLevel.Warning,
        "data is empty"
    )

def integrate_branches(data_tree, level):
    new_tree = DataTree[object]()
    
    # 遍歷數據樹的每個分支
    for i in range(data_tree.BranchCount):
        path = data_tree.Path(i)  # 取得當前分支的路徑
        items = data_tree.Branch(i)  # 取得當前分支的數據
        
        # 根據指定層級截取路徑
        new_path_indices = [path[j] for j in range(level) if j < path.Length]
        new_path = GH_Path(new_path_indices)
        
        # 將數據添加到新的分支
        for item in items:
            new_tree.Add(item, new_path)
    
    return new_tree

# 輸入參數
# data_tree: 數據樹
# level_input: 整數，表示保留的層級數
result = integrate_branches(tree, level)
# ---------- end trimbranch ----------
trimbranch_2 = TrimBranch(tree=unflatten, level="1")  # -> result; inputs tree: tree, level: Int32; same code as trimbranch
geo = Geometry(trimbranch)
py3 = Python3Script(Geo=geo, Guid=trimbranch_2)  # -> out, Obj; inputs Geo: tree of GeometryBase, Guid: tree
# ---------- py3: Python ----------
from Grasshopper.Kernel.Types import GH_ObjectWrapper
from Grasshopper import DataTree
from Grasshopper.Kernel.Data import GH_Path

Obj = DataTree[object]()

for bi in range(Geo.BranchCount):
    path = Geo.Path(bi)
    geos = list(Geo.Branch(bi))
    guids = list(Guid.Branch(bi))

    if len(geos) != len(guids):
        raise Exception("Geo/Guid count mismatch at path {}".format(path))

    for i in range(len(geos)):
        Obj.Add(GH_ObjectWrapper([geos[i], guids[i]]), path)
# ---------- end py3 ----------
geo_2 = ClusterOutput(geo)
obj = ClusterOutput(py3.Obj)

# ==== cluster Cluster_3
py3 = Python3Script(x="N01", y=ColourSwatch(SwatchColor=RGB(158, 98, 109)))  # -> a; inputs y: Color
# ---------- py3: Python ----------
colorDict = {x:y}

class data:
    pass

d = data()
d.colorDict = colorDict

a = d
# ---------- end py3 ----------
py3_2 = Python3Script(x="N02", y=ColourSwatch(SwatchColor=RGB(158, 98, 109)))  # -> a; inputs y: Color; same code as py3
py3_3 = Python3Script(x="N87", y=ColourSwatch(SwatchColor=RGB(191, 64, 255)))  # -> a; inputs y: Color; same code as py3
py3_4 = Python3Script(x="N85", y=ColourSwatch(SwatchColor=RGB(140, 91, 0)))  # -> a; inputs y: Color; same code as py3
py3_5 = Python3Script(x="N84", y=ColourSwatch(SwatchColor=RGB(140, 91, 0)))  # -> a; inputs y: Color; same code as py3
py3_6 = Python3Script(x="N15", y=ColourSwatch(SwatchColor=RGB(224, 146, 0)))  # -> a; inputs y: Color; same code as py3
py3_7 = Python3Script(x="N64", y=ColourSwatch(SwatchColor=RGB(39, 105, 227)))  # -> a; inputs y: Color; same code as py3
py3_8 = Python3Script(x="N86", y=ColourSwatch(SwatchColor=RGB(49, 107, 214)))  # -> a; inputs y: Color; same code as py3
py3_9 = Python3Script(x="N53", y=ColourSwatch(SwatchColor=RGB(73, 122, 214)))  # -> a; inputs y: Color; same code as py3
py3_10 = Python3Script(x="N69", y=ColourSwatch(SwatchColor=RGB(102, 138, 204)))  # -> a; inputs y: Color; same code as py3
py3_11 = Python3Script(x="N69_down", y=ColourSwatch(SwatchColor=RGB(102, 138, 204)))  # -> a; inputs y: Color; same code as py3
py3_12 = Python3Script(x="S04", y=ColourSwatch(SwatchColor=RGB(0, 225, 255)))  # -> a; inputs y: Color; same code as py3
py3_13 = Python3Script(x="N71", y=ColourSwatch(SwatchColor=RGB(102, 185, 204)))  # -> a; inputs y: Color; same code as py3
py3_14 = Python3Script(x="AL02", y=ColourSwatch(SwatchColor=RGB(166, 161, 161)))  # -> a; inputs y: Color; same code as py3
py3_15 = Python3Script(x="AL02_1", y=ColourSwatch(SwatchColor=RGB(166, 161, 161)))  # -> a; inputs y: Color; same code as py3
py3_16 = Python3Script(x="AL02_2", y=ColourSwatch(SwatchColor=RGB(166, 161, 161)))  # -> a; inputs y: Color; same code as py3
py3_17 = Python3Script(x="角鋁", y=ColourSwatch(SwatchColor=RGB(133, 169, 255)))  # -> a; inputs y: Color; same code as py3
py3_18 = Python3Script(x="角鋁1", y=ColourSwatch(SwatchColor=RGB(133, 169, 255)))  # -> a; inputs y: Color; same code as py3
py3_19 = Python3Script(x="角鋁2", y=ColourSwatch(SwatchColor=RGB(133, 169, 255)))  # -> a; inputs y: Color; same code as py3
py3_20 = Python3Script(x="角鋁3", y=ColourSwatch(SwatchColor=RGB(133, 169, 255)))  # -> a; inputs y: Color; same code as py3
py3_21 = Python3Script(x="N78", y=ColourSwatch(SwatchColor=RGB(87, 207, 155)))  # -> a; inputs y: Color; same code as py3
py3_22 = Python3Script(x="N07", y=ColourSwatch(SwatchColor=RGB(83, 94, 115)))  # -> a; inputs y: Color; same code as py3
py3_23 = Python3Script(x="N09", y=ColourSwatch(SwatchColor=RGB(255, 128, 219)))  # -> a; inputs y: Color; same code as py3
py3_24 = Python3Script(x="N08", y=ColourSwatch(SwatchColor=RGB(101, 103, 235)))  # -> a; inputs y: Color; same code as py3
py3_25 = Python3Script(x="AluBlock", y=ColourSwatch(SwatchColor=RGB(196, 196, 196)))  # -> a; inputs y: Color; same code as py3
py3_26 = Python3Script(x="N65", y=ColourSwatch(SwatchColor=RGB(155, 157, 232)))  # -> a; inputs y: Color; same code as py3
py3_27 = Python3Script(x="S02", y=ColourSwatch(SwatchColor=RGB(128, 255, 191)))  # -> a; inputs y: Color; same code as py3
py3_28 = Python3Script(x="S02_1", y=ColourSwatch(SwatchColor=RGB(128, 255, 191)))  # -> a; inputs y: Color; same code as py3
py3_29 = Python3Script(x="N35", y=ColourSwatch(SwatchColor=RGB(177, 155, 232)))  # -> a; inputs y: Color; same code as py3
py3_30 = Python3Script(x="N32", y=ColourSwatch(SwatchColor=RGB(24, 150, 87)))  # -> a; inputs y: Color; same code as py3
py3_31 = Python3Script(x="N20", y=ColourSwatch(SwatchColor=RGB(79, 199, 255)))  # -> a; inputs y: Color; same code as py3
py3_32 = Python3Script(x="N20_down", y=ColourSwatch(SwatchColor=RGB(79, 199, 255)))  # -> a; inputs y: Color; same code as py3
py3_33 = Python3Script(x="N20_up", y=ColourSwatch(SwatchColor=RGB(79, 199, 255)))  # -> a; inputs y: Color; same code as py3
py3_34 = Python3Script(x="N19", y=ColourSwatch(SwatchColor=RGB(142, 159, 189)))  # -> a; inputs y: Color; same code as py3
py3_35 = Python3Script(x="F10", y=ColourSwatch(SwatchColor=RGB(232, 74, 206)))  # -> a; inputs y: Color; same code as py3
py3_36 = Python3Script(x="N76", y=ColourSwatch(SwatchColor=RGB(0, 128, 21)))  # -> a; inputs y: Color; same code as py3
py3_37 = Python3Script(x="S07", y=ColourSwatch(SwatchColor=RGB(255, 142, 128)))  # -> a; inputs y: Color; same code as py3
py3_38 = Python3Script(x="SSL", y=ColourSwatch(SwatchColor=RGB(255, 185, 87)))  # -> a; inputs y: Color; same code as py3
py3_39 = Python3Script(x="SSL_2", y=ColourSwatch(SwatchColor=RGB(255, 185, 87)))  # -> a; inputs y: Color; same code as py3
py3_40 = Python3Script(x="F10", y=ColourSwatch(SwatchColor=RGB(255, 41, 194)))  # -> a; inputs y: Color; same code as py3
py3_41 = Python3Script(x="F19", y=ColourSwatch(SwatchColor=RGB(87, 235, 255)))  # -> a; inputs y: Color; same code as py3
py3_42 = Python3Script(x="N66", y=ColourSwatch(SwatchColor=RGB(115, 178, 66)))  # -> a; inputs y: Color; same code as py3
py3_43 = Python3Script(x="N67", y=ColourSwatch(SwatchColor=RGB(115, 178, 66)))  # -> a; inputs y: Color; same code as py3
py3_44 = Python3Script(x="N68", y=ColourSwatch(SwatchColor=RGB(115, 178, 66)))  # -> a; inputs y: Color; same code as py3
py3_45 = Python3Script(x="N28", y=ColourSwatch(SwatchColor=RGB(115, 178, 66)))  # -> a; inputs y: Color; same code as py3
py3_46 = Python3Script(x="N77", y=ColourSwatch(SwatchColor=RGB(115, 178, 66)))  # -> a; inputs y: Color; same code as py3
py3_47 = Python3Script(x="N66", y=ColourSwatch(SwatchColor=RGB(115, 178, 66)))  # -> a; inputs y: Color; same code as py3
py3_48 = Python3Script(x="N79a", y=ColourSwatch(SwatchColor=RGB(115, 178, 66)))  # -> a; inputs y: Color; same code as py3
py3_49 = Python3Script(x="N79", y=ColourSwatch(SwatchColor=RGB(115, 178, 66)))  # -> a; inputs y: Color; same code as py3
py3_50 = Python3Script(x="N29", y=ColourSwatch(SwatchColor=RGB(115, 178, 66)))  # -> a; inputs y: Color; same code as py3
py3_51 = Python3Script(x="AL01", y=ColourSwatch(SwatchColor=RGB(117, 117, 117)))  # -> a; inputs y: Color; same code as py3
py3_52 = Python3Script(x="AL01_sm", y=ColourSwatch(SwatchColor=RGB(117, 117, 117)))  # -> a; inputs y: Color; same code as py3
py3_53 = Python3Script(x="N56", y=ColourSwatch(SwatchColor=RGB(0, 255, 0)))  # -> a; inputs y: Color; same code as py3
py3_54 = Python3Script(x="N60", y=ColourSwatch(SwatchColor=RGB(255, 128, 0)))  # -> a; inputs y: Color; same code as py3
py3_55 = Python3Script(x="F20", y=ColourSwatch(SwatchColor=RGB(191, 63, 63)))  # -> a; inputs y: Color; same code as py3
py3_56 = Python3Script(x="N59", y=ColourSwatch(SwatchColor=RGB(0, 128, 0)))  # -> a; inputs y: Color; same code as py3
py3_57 = Python3Script(x="F24", y=ColourSwatch(SwatchColor=RGB(63, 191, 127)))  # -> a; inputs y: Color; same code as py3
py3_58 = Python3Script(x="N58", y=ColourSwatch(SwatchColor=RGB(128, 255, 0)))  # -> a; inputs y: Color; same code as py3
py3_59 = Python3Script(x="F22", y=ColourSwatch(SwatchColor=RGB(252, 83, 83)))  # -> a; inputs y: Color; same code as py3
py3_60 = Python3Script(x="S09", y=ColourSwatch(SwatchColor=RGB(252, 154, 83)))  # -> a; inputs y: Color; same code as py3
py3_61 = Python3Script(x="S06", y=ColourSwatch(SwatchColor=RGB(252, 207, 83)))  # -> a; inputs y: Color; same code as py3
py3_62 = Python3Script(x="N60", y=ColourSwatch(SwatchColor=RGB(255, 128, 0)))  # -> a; inputs y: Color; same code as py3
py3_63 = Python3Script(x="S08", y=ColourSwatch(SwatchColor=RGB(252, 207, 83)))  # -> a; inputs y: Color; same code as py3
py3_64 = Python3Script(x="S01", y=ColourSwatch(SwatchColor=RGB(207, 165, 50)))  # -> a; inputs y: Color; same code as py3
py3_65 = Python3Script(x="AL01_飾條", y=ColourSwatch(SwatchColor=RGB(178, 178, 178)))  # -> a; inputs y: Color; same code as py3
py3_66 = Python3Script(x="F11", y=ColourSwatch(SwatchColor=RGB(191, 63, 63)))  # -> a; inputs y: Color; same code as py3
py3_67 = Python3Script(x="N66up", y=ColourSwatch(SwatchColor=RGB(115, 178, 66)))  # -> a; inputs y: Color; same code as py3
py3_68 = Python3Script(x="N66dn", y=ColourSwatch(SwatchColor=RGB(115, 178, 66)))  # -> a; inputs y: Color; same code as py3
py3_69 = Python3Script(x="L_25x25x3", y=ColourSwatch(SwatchColor=RGB(255, 149, 0)))  # -> a; inputs y: Color; same code as py3
py3_70 = Python3Script(x="N67_bridge", y=ColourSwatch(SwatchColor=RGB(115, 178, 66)))  # -> a; inputs y: Color; same code as py3
py3_71 = Python3Script(x="N68_bridge", y=ColourSwatch(SwatchColor=RGB(115, 178, 66)))  # -> a; inputs y: Color; same code as py3
merge = Merge(
    Data1=py3,
    Data2=py3_2,
    Data3=py3_3,
    Data4=py3_4,
    Data5=py3_5,
    Data6=py3_6,
    Data7=py3_7,
    Data8=py3_8,
    Data9=py3_9,
    Data10=py3_10,
    Data11=py3_11,
    Data12=py3_12,
    Data13=py3_13,
    Data14=py3_14,
    Data15=py3_15,
    Data16=py3_16,
    Data17=py3_17,
    Data18=py3_18,
    Data19=py3_19,
    Data20=py3_20,
    Data21=py3_21,
    Data22=py3_22,
    Data23=py3_23,
    Data24=py3_24,
    Data25=py3_25,
    Data26=py3_26,
    Data27=py3_27,
    Data28=py3_28,
    Data29=py3_29,
    Data30=py3_30,
    Data31=py3_31,
    Data32=py3_32,
    Data33=py3_33,
    Data34=py3_34,
    Data35=py3_35,
    Data36=py3_36,
    Data37=py3_37,
    Data38=py3_38,
    Data39=py3_39,
    Data40=py3_40,
    Data41=py3_41,
    Data42=py3_42,
    Data43=py3_43,
    Data44=py3_44,
    Data45=py3_45,
    Data46=py3_46,
    Data47=py3_47,
    Data48=py3_48,
    Data49=py3_49,
    Data50=py3_50,
    Data51=py3_51,
    Data52=py3_54,
    Data53=py3_55,
    Data54=py3_66,
    Data55=py3_56,
    Data56=py3_57,
    Data57=py3_62,
    Data58=py3_58,
    Data59=py3_53,
    Data60=py3_59,
    Data61=py3_60,
    Data62=py3_63,
    Data63=py3_61,
    Data64=py3_64,
    Data65=py3_52,
    Data66=py3_65,
    Data67=py3_67,
    Data68=py3_68,
    Data69=py3_70,
    Data70=py3_71,
    Data71=py3_69)
py3_72 = Python3Script(x=merge)  # -> a, b; inputs x: list
# ---------- py3_72: Python ----------
import ghpythonlib.treehelpers as th
wholeDict = {}
b = []
for i in x:
    wholeDict.update(i.colorDict)
    for key in i.colorDict.keys():
        b.append([key, i.colorDict[key]])
    

class data:
    pass

d = data()
d.data = wholeDict
a = d

b = th.list_to_tree(b)
# ---------- end py3_72 ----------
layername = ClusterInput()
layers = QueryModelLayers(AutoUpdateState=True)
item = ListItem(List=py3_72.b, Index=0, Wrap=True)  # -> Item, Item1
layername_2 = Text(layername)
idata = ClusterInput()
layer = ModelLayer(Layer=layers)  # -> Layer, Name, Hidden, Locked, DisplayColour, Material, Linetype
split = TextSplit(Text=item.Item1, Separators=",")
panel = Panel("##_Kevin::")
py3_73 = Python3Script(iData=idata, colorData=py3_72.a)  # -> out, dataGeo, graft(dataName), graft(colorList)
# ---------- py3_73: Python ----------
import System.Drawing as sd

dataGeo = iData.geo
dataName = iData.names

colorDict = colorData.data
rgb = [0, 0, 0]  # 黑色
black = sd.Color.FromArgb(rgb[0], rgb[1], rgb[2])

colorList = []
for name in dataName:
    if name in colorDict:
        colorList.append(colorDict[name])
    else:
        print(name)
        colorList.append(black)
# ---------- end py3_73 ----------
item_2 = ListItem(List=split, Index=0, Wrap=True)  # -> Item, Item1, Item2
watchbranch = WatchBranch(alldata=py3_73.dataGeo)  # -> seedata_2, path_2
split_2 = TextSplit(Text=layer.DisplayColour, Separators=",")
concat = Concatenate(FragmentA=layername_2, FragmentB=py3_73.dataName)
item_3 = ListItem(List=split_2, Index=0, Wrap=True)  # -> Item, Item1, Item2
cluster = Cluster_2(object=py3_73.dataGeo)
layer_2 = ModelLayer(Layer=concat, DisplayColour=py3_73.colorList)
panel_2 = Panel(py3_73.out)
panel_3 = Panel(item_3.Item2)
object = ModelObject(Object=cluster, Name=py3_73.dataName, Layer=layer_2)
object_2 = ModelObject(object)
object_3 = ClusterOutput(object_2)

# ==== cluster MockData
obj = ClusterInput()
key = ClusterInput()
obj_2 = Data(obj)
key_2 = Text(key)
graft = GraftTree(Tree=obj_2, IncludeEmptyLists=True, IncludeNullItems=True)
tstat = TreeStatistics(Tree=graft)  # -> Paths, Length, Count
lng = ListLength(List=key_2)
dup = DuplicateData(Data=key_2, Number=tstat.Count, Order=True)
partition = PartitionList(List=dup, Size=lng)  # -> simplify(Chunks)
lng_2 = ListLength(List=flatten(partition))
series = Series(Start=Slider(0, range=0..1000), Step=1, Count=lng_2)
partition_2 = PartitionList(List=series, Size=lng)  # -> simplify(Chunks)
cluster = Cluster_4(data=partition, T=obj_2)
concat = Concatenate(FragmentA="測試_", FragmentB=partition_2)
cluster_2 = Cluster_4(data=concat, T=obj_2)
okey = Data(cluster)
ovalue = Data(cluster_2)
okey_2 = ClusterOutput(okey)
ovalue_2 = ClusterOutput(ovalue)

# ==== cluster MockAssemblyData
value = ClusterInput()
T = ClusterInput()
key = ClusterInput()
value_2 = Data(value)
tstat = TreeStatistics(Tree=T)  # -> Paths, Length, Count
key_2 = Data(key)
dup = DuplicateData(Data=key_2, Number=tstat.Count, Order=True)
lng = ListLength(List=key_2)
lng_2 = ListLength(List=dup)
series = Series(Start=0, Step=1, Count=lng_2)
partition = PartitionList(List=dup, Size=lng)
partition_2 = PartitionList(List=series, Size=lng)
concat = Concatenate(FragmentA=value_2, FragmentB=partition_2)
value_3 = Data(concat)
key_3 = Data(partition)
value_4 = ClusterOutput(value_3)
key_4 = ClusterOutput(key_3)

# ==== cluster Cluster_5
T = ClusterInput()
data = ClusterInput()
tstat = TreeStatistics(Tree=T)  # -> Paths, Length, Count
data_2 = Data(data)
dup = DuplicateData(Data=data_2, Number=tstat.Count, Order=True)
lng = ListLength(List=data_2)
partition = PartitionList(List=dup, Size=lng)
data_3 = Data(partition)
data_4 = ClusterOutput(data_3)

# ==== cluster Rename
O = ClusterInput()
object = ModelObject(Object=O)  # -> Object, Layer
layer = ModelLayer(Layer=object.Layer)  # -> Layer, Name
object_2 = ModelObject(Object=object.Object, Name=layer.Name)
O_2 = ClusterOutput(object_2)

# ==== cluster Cluster_6
B = ClusterInput()
debrep = DeconstructBrep(Brep=B)  # -> Faces, Edges, Vertices
len = Length(Curve=debrep.Edges)
sort = SortList(Keys=len)  # -> Keys, ValuesA
item = ListItem(List=reverse(sort.Keys), Index=0, Wrap=True)
roundd = RoundToDecimalPlace(NumberX=item, DecimalPlace="2", RoundType=0)  # -> Rounded, Difference
trimbranch = TrimBranch(data_tree=roundd.Rounded, level_input="1")  # -> out, result; inputs data_tree: tree, level_input: Int32; same code as trimbranch
D = ClusterInput()
lng = ListLength(List=trimbranch.result)
result = ClusterOutput(trimbranch.result)
repeat = RepeatData(Data=D, Length=lng)
D_2 = ClusterOutput(repeat)

# ==== cluster Cluster_7
txt = ClusterInput()
T = ClusterInput()
geo = ClusterInput()
txt_2 = Text(txt)
tmatch = MatchText(Text=T, Pattern=txt_2, Case=True)
geo_2 = Geometry(geo)
dispatch = Dispatch(List=geo_2, DispatchPattern=tmatch)  # -> ListA, ListB
geo_3 = Geometry(dispatch.ListA)
debrep = DeconstructBrep(Brep=geo_3)  # -> Faces, Edges, Vertices
len = Length(Curve=debrep.Edges)
sort = SortList(Keys=len)  # -> Keys, ValuesA
item = ListItem(List=reverse(sort.Keys), Index=0, Wrap=True)
roundd = RoundToDecimalPlace(NumberX=item, DecimalPlace="2", RoundType=0)  # -> Rounded, Difference
concat = Concatenate(FragmentA=txt_2, FragmentB="_Count")
concat_2 = Concatenate(FragmentA=txt_2, FragmentB="_TotalLength")
trimbranch = TrimBranch(data_tree=roundd.Rounded, level_input="1")  # -> out, result; inputs data_tree: tree, level_input: Int32; same code as trimbranch
concat_3 = Concatenate(FragmentA="C", FragmentC=":", FragmentB=concat)
concat_4 = Concatenate(FragmentA="L", FragmentC=":", FragmentB=concat_2)
tstat = TreeStatistics(Tree=trimbranch.result)  # -> Paths, Length, Count
ma = MassAddition(Input=trimbranch.result)  # -> Result, PartialResults
repeat = RepeatData(Data=concat_4, Length=tstat.Count)
repeat_2 = RepeatData(Data=concat_3, Length=tstat.Count)
unflatten = UnflattenTree(Tree=repeat, Guide=ma.Result)
lng = ListLength(List=trimbranch.result)
unflatten_2 = UnflattenTree(Tree=repeat_2, Guide=ma.Result)
txt_3 = Text(unflatten)
c_name = Text(unflatten_2)
num = Number(ma.Result)
count = Number(lng)
c_name_2 = ClusterOutput(c_name)
txt_4 = ClusterOutput(txt_3)
num_2 = ClusterOutput(num)
count_2 = ClusterOutput(count)

# ==== cluster FilterData
data = ClusterInput()
mode = ClusterInput()
filter = ClusterInput()
data_2 = ModelObject(data)
mode_2 = Integer(mode)
filter_2 = Data(filter)
object = ModelObject(Object=data_2)  # -> Object, Name, Layer
py3 = Python3Script(x=object.Object)  # -> a
# ---------- py3: Python ----------
if x:
    a = x
else:
    a = 'None'
# ---------- end py3 ----------
py3_2 = Python3Script(x=object.Name)  # -> a; same code as py3
py3_3 = Python3Script(x=object.Layer)  # -> a; same code as py3
matchtext = Python3Script(layerList=py3_3, searchList=filter_2)  # -> out_bool; inputs layerList: list, searchList: list of String
# ---------- matchtext: Python ----------
from ghpythonlib.components import MatchText
from Grasshopper import DataTree
from Grasshopper.Kernel.Data import GH_Path
from Grasshopper.Kernel import GH_RuntimeMessageLevel
from itertools import zip_longest

if layerList is None or searchList is None:
    ghenv.Component.AddRuntimeMessage(
        GH_RuntimeMessageLevel.Warning,
        "data is empty"
    )
else:
    def to_bool_seq(x):
        # 統一轉為「list[bool]」
        # IronPython 的 List 可以直接 list(x)
        if isinstance(x, bool) or x is None:
            return [bool(x)]
        try:
            # 若是 IronPython.Runtime.List、list、tuple 等可迭代
            return [bool(v) for v in list(x)]
        except TypeError:
            # 其他不可迭代的一律包成單一元素
            return [bool(x)]

    nest_bool = []
    for pattern in searchList:
        temp = MatchText(text=layerList, regex=pattern, case=True)
        seq = to_bool_seq(temp)     # 先規範化
        nest_bool.append(seq)

    # 只有一條序列 → 你想要：直接回傳它？還是壓成單一布林？
    # 1) 若要「逐欄結果」就直接複製那條：
    if len(nest_bool) == 1:
        out_bool = list(nest_bool[0])
    else:
        # 多條序列 → 逐欄 OR，長度不齊用 False 補齊
        out_bool = [any(col) for col in zip_longest(*nest_bool, fillvalue=False)]

    # 檢查
    # print(nest_bool)
    # print(out_bool)
# ---------- end matchtext ----------
matchtext_2 = Python3Script(layerList=py3_2, searchList=filter_2)  # -> out_bool; inputs layerList: list, searchList: list of String; same code as matchtext
matchtext_3 = Python3Script(layerList=py3, searchList=filter_2)  # -> out_bool; inputs layerList: list, searchList: list of String; same code as matchtext
tmatch = MatchText(Text=data_2, RegEx=filter_2, Case=True)
or = GateOr(A=tmatch, D=matchtext_3, B=matchtext_2, C=matchtext)
filter_3 = StreamFilter(Gate=mode_2, Stream0=or, Stream1=tmatch, Stream2=matchtext_3, Stream3=matchtext_2, Stream4=matchtext)
dispatch = Dispatch(List=data_2, DispatchPattern=filter_3)  # -> ListA, ListB
object_2 = ModelObject(dispatch.ListA)
bool = Boolean(filter_3)
bool_2 = ClusterOutput(bool)
object_3 = ClusterOutput(object_2)

# ==== cluster WatchBranch
alldata = ClusterInput()
index = ClusterInput()
alldata_2 = Data(alldata)
index_2 = Number(index)
item = ListItem(List=flatten(index_2), Index="0", Wrap=True)
null = NullItem(Item=item)  # -> NullFlags, InvalidFlags, Description
filter = StreamFilter(Gate=null.NullFlags, Stream0=index_2, Stream1="0")
tstat = TreeStatistics(Tree=alldata_2)  # -> Paths, Length, Count
item_2 = ListItem(List=tstat.Paths, Index=filter, Wrap=True)
branch = TreeBranch(Tree=alldata_2, Path=item_2, MaintainPaths=True)
seedata = Data(branch)
path = Data(item_2)
seedata_2 = ClusterOutput(seedata)
path_2 = ClusterOutput(path)

# ==== cluster Cluster_2
object = ClusterInput()
object_2 = ModelObject(simplify(graft(object)))
null = NullItem(Item=object_2)  # -> NullFlags, InvalidFlags, Description
dispatch = Dispatch(List=object_2, DispatchPattern=null.InvalidFlags)  # -> ListA, ListB
shift = ShiftPaths(Data=dispatch.ListB, Offset=-1)
geo = Geometry(dispatch.ListA)
debrep = DeconstructBrep(Brep=geo)  # -> simplify(Faces), Edges, Vertices
null_2 = NullItem(Item=debrep.Faces)  # -> NullFlags, InvalidFlags, Description
dispatch_2 = Dispatch(List=debrep.Faces, DispatchPattern=null_2.InvalidFlags)  # -> ListA, ListB
edges = BrepEdges(Brep=dispatch_2.ListA)  # -> Naked, Interior, NonManifold
clean = CleanTree(RemoveNulls=True, RemoveInvalid=True, RemoveEmpty=invert(False), Tree=edges.Naked)
join = JoinCurves(Curves=clean, Preserve=False)
patch = Patch(Curves=join, Spans=20, Flexibility=1, Trim=True)
trimbranch = TrimBranch(data_tree=patch, level_input="1")  # -> out, result; inputs data_tree: tree, level_input: Int32
# ---------- trimbranch: Python ----------
from Grasshopper import DataTree
from Grasshopper.Kernel.Data import GH_Path
from Grasshopper.Kernel import GH_RuntimeMessageLevel

if data_tree is None or level_input is None:
    ghenv.Component.AddRuntimeMessage(
        GH_RuntimeMessageLevel.Warning,
        "data is empty"
    )

def integrate_branches(data_tree, level):
    new_tree = DataTree[object]()
    
    # 遍歷數據樹的每個分支
    for i in range(data_tree.BranchCount):
        path = data_tree.Path(i)  # 取得當前分支的路徑
        items = data_tree.Branch(i)  # 取得當前分支的數據
        
        # 根據指定層級截取路徑
        new_path_indices = [path[j] for j in range(level) if j < path.Length]
        new_path = GH_Path(new_path_indices)
        
        # 將數據添加到新的分支
        for item in items:
            new_tree.Add(item, new_path)
    
    return new_tree

# 輸入參數
# data_tree: 數據樹
# level_input: 整數，表示保留的層級數
result = integrate_branches(data_tree, level_input)
# ---------- end trimbranch ----------
shift_2 = ShiftPaths(Data=dispatch_2.ListB, Offset=-1)
merge = Merge(Data1=shift_2, Data2=trimbranch.result)
join_2 = BrepJoin(Breps=merge)  # -> Breps, Closed
merge_2 = Merge(Data1=shift, Data2=join_2.Breps)
R = ClusterOutput(merge_2)

# ==== cluster Cluster_4
data = ClusterInput()
T = ClusterInput()
data_2 = Data(data)
graft = GraftTree(Tree=T, IncludeEmptyLists=True, IncludeNullItems=True)
tstat = TreeStatistics(Tree=data_2)  # -> Paths, Length, Count
tstat_2 = TreeStatistics(Tree=graft)  # -> Paths, Length, Count
replace = ReplacePaths(Data=data_2, Search=tstat.Paths, Replace=tstat_2.Paths)
data_3 = Data(replace)
data_4 = ClusterOutput(data_3)
